# Grasshopper definition 250408_UI Connector.ghx (Grasshopper 1.0.8)
# plug-ins: Karamba3D

mytoggle = BooleanToggle(True)

# ---- group: Extra Sliders
number_slider = Slider(0.25, range=0..1)
number_slider_2 = Slider(0.25, range=0..1)

# ---- group: connector
py3 = Python3Script(get_inputs=Toggle(True))  # -> out, a
# ---------- py3: Python ----------
#r: openpyxl

import System.IO as sysIO
import sys
import Grasshopper
import importlib
import scriptcontext as sc
from Grasshopper.Kernel.Data import GH_Path
from Grasshopper import DataTree
from System import Object
import openpyxl
import json

# GH path
ghFilePath = Grasshopper.Instances.ActiveDocument.FilePath
ghDirPath = sysIO.Directory.GetParent(ghFilePath)
ghDirPathStr = ghDirPath.ToString()
# Access to ALL python files in the GH file directory as modules
sys.path.append((ghDirPathStr))

import connector
importlib.reload(connector)


if get_inputs:
    myParentDir = ghDirPath.Parent.FullName
    htmlPath = sysIO.Path.Join(myParentDir, "\\index.html")
    # print(htmlPath)
    # Prepare references to the GH doc and component
    gh_doc = Grasshopper.Instances.ActiveCanvas.Document
    thisComp = ghenv.Component

    #myComp = connector.MyComponent()
    result = connector.MyComponent.RunScript(gh_doc, thisComp, get_inputs, htmlPath)
# ---------- end py3 ----------

# ----
py3_2 = Python3Script(x=mytoggle)  # -> out, a, b, c
# ---------- py3_2: Python ----------
import System
import Rhino
import Grasshopper
import Eto.Forms as forms
import Eto.Drawing as drawing
import scriptcontext as sc
import json
import urllib.parse  # Import to handle URL encoding

from Grasshopper.Kernel.Data import GH_Path
from Grasshopper import DataTree
from System import Object


EFM = sc.sticky.get("EFM", {})
element_names = DataTree[Object]()
element_geo = DataTree[Object]()
element_thik = DataTree[Object]()
if "GeomDict" in EFM and "Elements" in EFM["GeomDict"]:
    for i, element in enumerate(EFM["GeomDict"]["Elements"]): 
        path = GH_Path(i)
        element_names.Add(element["name"], path)
        element_thik.Add(element["thickness"], path)
        for geo in element["geometries"]:
            element_geo.Add(geo, path)

mat_names = [] 
if "MatDict" in EFM and "Materials" in EFM["MatDict"]:
    mat_list = EFM["MatDict"]["Materials"]
    for mat in mat_list:
        mat_names.append(mat["Name"])


a = element_names
b = element_thik
c = mat_names
# ---------- end py3_2 ----------
sender = Python3Script(write=mytoggle)  # -> out, a
# ---------- sender: Python ----------
import System.IO as sysIO
import sys
import Grasshopper
import importlib
import scriptcontext as sc
from Grasshopper.Kernel.Data import GH_Path
from Grasshopper import DataTree
from System import Object

# from Karamba.GHopper.Param import Param_Material

# GH path
ghFilePath = Grasshopper.Instances.ActiveDocument.FilePath
ghDirPath = sysIO.Directory.GetParent(ghFilePath)
ghDirPathStr = ghDirPath.ToString()
# Access to ALL python files in the GH file directory as modules
sys.path.append((ghDirPathStr))

import kar_sender
importlib.reload(kar_sender)

if write:
    # Prepare references to the GH doc and component
    gh_doc = Grasshopper.Instances.ActiveCanvas.Document
    thisComp = ghenv.Component
    result2 = kar_sender.MyComponent.RunScript(gh_doc, thisComp)
# ---------- end sender ----------
sender_2 = Python3Script(write=mytoggle)  # -> out, a
# ---------- sender_2: Python ----------
import System.IO as sysIO
import sys
import Grasshopper
import importlib
import scriptcontext as sc
from Grasshopper.Kernel.Data import GH_Path
from Grasshopper import DataTree
from System import Object

# GH path
ghFilePath = Grasshopper.Instances.ActiveDocument.FilePath
ghDirPath = sysIO.Directory.GetParent(ghFilePath)
ghDirPathStr = ghDirPath.ToString()
# Access to ALL python files in the GH file directory as modules
sys.path.append((ghDirPathStr))

import sender
importlib.reload(sender)

if write:
    # Prepare references to the GH doc and component
    gh_doc = Grasshopper.Instances.ActiveCanvas.Document
    thisComp = ghenv.Component
    result2 = sender.MyComponent.RunScript(gh_doc, thisComp)
# ---------- end sender_2 ----------
panel = Panel(py3_2.a)
panel_2 = Panel(py3_2.b)
panel_3 = Panel(py3_2.c)
panel_4 = Panel(sender_2.a)
panel_5 = Panel(py3.a)
buffon_13 = Buffon13(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)
