# Grasshopper definition 250122_Masterfile_Toggle.ghx (Grasshopper 1.0.8)
# plug-ins: Karamba3D, ScriptParasite

# ----
# Geotechnic
# Coefficient de combinaison pour les actions variables,
# ψE,i = φ * ψ2i :
# Roof ?
# Oui = 1 // Non = 0
image = ImageSampler(Filter="Colour", Interpolate=False, Umax=1, Umin=0, Vmax=1, Vmin=0, Wrap=1)
image_2 = ImageSampler(Filter="Colour", Interpolate=False, Umax=1, Umin=0, Vmax=1, Vmin=0, Wrap=1)
list = ValueList({"Steel Portal Frame": 1, "Concrete Portal Frame or Eccentric Triangulated Steel": 2, "Windbracing Wall in Concrete or Masonry": 3, "Other": 4}, selected="Windbracing Wall in Concrete or Masonry")
panel = Panel("φ :")

# ----
# Coefficient de comportement :
# q = q0*kw >= 1.5
panel_2 = Panel("""Type de sol
A = 1
B = 2
C = 3
D = 4
E = 5""")
catégorie_d_importance_du_bâtiment = Slider(2, range=1..4)
zone_sismique = Slider(4, range=1..5)
type_de_sol = Slider(3, range=1..5)
q = Panel("1.5")

masse_volumique_pierre = Panel("19.5")
matprops = MaterialPropertiesKaramba3D(
    FamilyOfMaterial="Stone",
    Name="19.5 kN/m3 - Mortier 20 MPa",
    YoungsModulus_kN_cm²="2608",
    InPlaneShearModulus_kN_cm²="1043",
    TransverseShearModulus_kN_cm²="1043",
    SpecificWeight_kN_m³=masse_volumique_pierre,
    CoefficientOfThermalExpansion_1="7.00E-06",
    TensileStrength_kN_cm²=23.5,
    CompressiveStrength_kN_cm²=-23.5,
    StrengthHypothesis="MISES",
    mode="Isotrop")

panel_3 = Panel("3.43E+08")
division = Division(A="1E+09", B=2.8)
panel_4 = Panel(division)
matprops_2 = MaterialPropertiesKaramba3D(
    FamilyOfMaterial="Masonry",
    Name="rigide",
    YoungsModulus_kN_cm²="1E+09",
    InPlaneShearModulus_kN_cm²=panel_4,
    TransverseShearModulus_kN_cm²=panel_4,
    SpecificWeight_kN_m³=masse_volumique_pierre,
    CoefficientOfThermalExpansion_1="1.0E-05",
    TensileStrength_kN_cm²=23.5,
    CompressiveStrength_kN_cm²=-23.5,
    StrengthHypothesis="MISES",
    mode="Isotrop")

data = Data("1043")
matprops_3 = MaterialPropertiesKaramba3D(
    FamilyOfMaterial="infinite",
    Name="rigide",
    YoungsModulus_kN_cm²="2608",
    InPlaneShearModulus_kN_cm²=data,
    TransverseShearModulus_kN_cm²=data,
    SpecificWeight_kN_m³=masse_volumique_pierre,
    CoefficientOfThermalExpansion_1="7.0E-06",
    TensileStrength_kN_cm²=23.5,
    CompressiveStrength_kN_cm²=-23.5,
    StrengthHypothesis="MISES",
    mode="Isotrop")

masse_volumique_béton = Panel("25")
matprops_4 = MaterialPropertiesKaramba3D(
    FamilyOfMaterial="Concrete",
    Name="C30/37",
    YoungsModulus_kN_cm²="3300",
    InPlaneShearModulus_kN_cm²="1375",
    TransverseShearModulus_kN_cm²="1375",
    SpecificWeight_kN_m³=masse_volumique_béton,
    CoefficientOfThermalExpansion_1="1.00E-05",
    TensileStrength_kN_cm²=23.5,
    CompressiveStrength_kN_cm²=-23.5,
    StrengthHypothesis="MISES",
    mode="Isotrop")

# ----
# Material
panel_5 = Panel("Concrete")
masse_volumique_béton_2 = Panel("25")

# ----
# Button to toggle b/w sync and async modelling
toggle = BooleanToggle(True)

# ----
# Toggle for interactive result mode
toggle_2 = BooleanToggle(False)

# ----
# Geometric
concrete_wall_thickness = Slider(0.2, range=0..1)
stone_wall_thickness = Slider(0.2, range=0..1)
floor_thick = Panel("0.20")

# ---- group: Real-time Container
pipeline = GeometryPipeline(
    GroupByLayer=False,
    GroupByType=False,
    IncludeHidden=True,
    IncludeLocked=True,
    LayerFilter="B+G::Model::Concrete Walls",
    NameFilter="*",
    SublayerFiltering=True,
    TypeFilter=1073741848)
pipeline_2 = GeometryPipeline(
    GroupByLayer=False,
    GroupByType=False,
    IncludeHidden=True,
    IncludeLocked=True,
    LayerFilter="B+G::Model::Concrete Floor",
    NameFilter="*",
    SublayerFiltering=True,
    TypeFilter=1073741848)
pipeline_3 = GeometryPipeline(
    GroupByLayer=False,
    GroupByType=False,
    IncludeHidden=True,
    IncludeLocked=True,
    LayerFilter="B+G::Model::Stone Walls",
    NameFilter="*",
    SublayerFiltering=True,
    TypeFilter=1073741848)

# ----
# Loads
Q = Panel("Q")
g2 = Panel("G2")
live_load_roof = Panel("0.8")
live_load_floor = Panel("1.5")
permanent_load_floor = Panel("4.0")

# ---- group: Floor
matprops_5 = MaterialPropertiesKaramba3D(
    FamilyOfMaterial=panel_5,
    Name="C30/37",
    YoungsModulus_kN_cm²="3300",
    InPlaneShearModulus_kN_cm²="1375",
    TransverseShearModulus_kN_cm²="1375",
    SpecificWeight_kN_m³=masse_volumique_béton_2,
    CoefficientOfThermalExpansion_1="1.00E-05",
    TensileStrength_kN_cm²=23.5,
    CompressiveStrength_kN_cm²=-23.5,
    StrengthHypothesis="MISES",
    mode="Isotrop")

# ----
coeff_phi_floors = Panel("0.8")
coeff_phi_roof = Panel("1")

coeff_psi2_floors = Panel("0.3")
coeff_psi2_roof = Panel("0")

# ---- group: Roof
list_2 = ValueList({"Yes": 1, "No": 0}, selected="Yes")

# ---- group: Geometric Container
concrete_walls = Geometry([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])
concrete_floors = Geometry([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])
stone_walls = Geometry([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])

# ----
permanent_load_roof = Panel("2.0")
filter = StreamFilter(Gate=toggle, Stream0=concrete_walls, Stream1=pipeline)
filter_2 = StreamFilter(Gate=toggle, Stream0=stone_walls, Stream1=pipeline_3)
filter_3 = StreamFilter(Gate=toggle, Stream0=concrete_floors, Stream1=pipeline_2)

entwine = Entwine(Branch00=matprops_4, Branch01=matprops, Branch02=matprops_2, Branch03=matprops_3, FlattenInputs=True)
cluster = Cluster_5(num_2=concrete_wall_thickness, num=stone_wall_thickness, geo=filter, geo_2=filter_2, geo_3=filter_3)  # -> grouped_2, line_5, z_orient_5, domain_x_5, domain_y_5, material_2, T, gf_area_2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
# Two Way >>> Beams: X & Y
# 
# X >>> Beams: in X
# 
# Y >>> Beams: in Y
toggle_3 = BooleanToggle(False)

# ---- group: Slab Direction
list_3 = ValueList({"Two Way": 0, "X": 1, "Y": 2}, selected="Two Way")

# ----
c_script = CSharpScript()  # -> out, a
# ---------- c_script: C# ----------
// Grasshopper Script Instance
#region Usings
using System;
using System.Linq;
using System.Collections;
using System.Collections.Generic;
using System.Drawing;
using System.IO;

using Rhino;
using Rhino.Geometry;

using Grasshopper;
using Grasshopper.Kernel;
using Grasshopper.Kernel.Data;
using Grasshopper.Kernel.Types;

#endregion

public class Script_Instance : GH_ScriptInstance
{
    #region Notes
    /* 
      Members:
        RhinoDoc RhinoDocument
        GH_Document GrasshopperDocument
        IGH_Component Component
        int Iteration

      Methods (Virtual & overridable):
        Print(string text)
        Print(string format, params object[] args)
        Reflect(object obj)
        Reflect(object obj, string method_name)
    */
    #endregion

    private void RunScript(ref object a)
    {
        // Write your logic here
        var filePath = this.GrasshopperDocument.FilePath;
        DirectoryInfo parentDir = Directory.GetParent(filePath);
        var myParentDir = parentDir.FullName;
        
        // IGH_DocumentObject csName = null;
        // var spId = this.Component.Params.Output[1].Recipients[0].Attributes.Parent.DocObject.ComponentGuid;
        // var ghDoc = this.GrasshopperDocument;
        // foreach(IGH_DocumentObject obj in ghDoc.Objects)
        // {

        //     if(obj is Grasshopper.Kernel.Special.GH_Group myGroup)
        //     {
        //         foreach(Guid id in myGroup.ObjectIDs)
        //         {
        //             if(id != spId)
        //             {
        //                 csName = ghDoc.FindObject(id, false);
        //             }
        //         }
        //     }
        // }

        // var folderPath = Path.Join(myParentDir, $"c#\\{csName.NickName}");
        var folderPath = Path.Join(myParentDir, "c#");
        
        a = folderPath;
    }
}
# ---------- end c_script ----------

extrude = EXTRUDE_2(line=cluster.line_5, z_orient=cluster.z_orient_5, domain_x=cluster.domain_x_5, domain_y=cluster.domain_y_5)
entwine_2 = Entwine(
    Branch00=ColourSwatch(SwatchColor=RGB(255, 0, 0)),
    Branch01=ColourSwatch(SwatchColor=RGB(0, 68, 255)),
    Branch02=ColourSwatch(SwatchColor=RGB(255, 140, 0)),
    Branch03=ColourSwatch(SwatchColor=RGB(0, 255, 255)),
    Branch04=ColourSwatch(SwatchColor=RGB(0, 0, 0)),
    FlattenInputs=True)

# ----
# EFM Viz
number_slider = Slider(0.02, range=0..10)
number_slider_2 = Slider(0.1, range=0..10)
swatch = ColourSwatch(SwatchColor=RGB(255, 140, 0))
swatch_2 = ColourSwatch(SwatchColor=RGB(0, 79, 163))
entwine_3 = Entwine(
    Branch00=number_slider,
    Branch01=number_slider,
    Branch02=number_slider_2,
    Branch03=number_slider_2,
    Branch04=number_slider_2,
    FlattenInputs=True)
entwine_4 = Entwine(
    Branch00=ColourSwatch(SwatchColor=RGB(0, 0, 0)),
    Branch01=ColourSwatch(SwatchColor=RGB(255, 0, 0)),
    Branch02=swatch_2,
    Branch03=swatch_2,
    FlattenInputs=True)
tstat = TreeStatistics(Tree=entwine_3)  # -> Paths, Length, Count
linetype = ModelLinetype(Name=tstat.Count, Width=entwine_3)

ia = CSharpScript(
    F=cluster.T,
    D=list_3,
    B=cluster.geo_15,
    Reference=["C:\Users\vrajasekar\AppData\Roaming\McNeel\Rhinoceros\packages\8.0\Karamba3D\3.1.50129\net8.0-windows\KarambaCommon.dll", "C:\Users\vrajasekar\AppData\Roaming\McNeel\Rhinoceros\packages\8.0\Karamba3D\3.1.50129\net8.0-windows\Karamba.gha"])  # -> out, C, M, A; inputs F: tree of Brep, D: Int32, B: tree of Curve
# ---------- ia: C# usings ----------
using System.Runtime.Serialization.Formatters.Binary;
using System.Runtime.Serialization;
using System.Threading;
using System.Threading.Tasks;
using System.Linq;
using Karamba.Models;
using KarambaCommon;
using Karamba.Elements;
using Karamba.Geometry;
using Karamba.Loads.Combination;
using Karamba.Utilities;
using Karamba.GHopper.Geometry;
using Karamba.Results;
using Karamba.Utilities.Mesher;
using Karamba.GHopper.Utilities.Mesher;
using Rhino.Geometry.Collections;
using System.IO;
using Rhino.Display;
# ---------- ia: C# ----------
    // 1) Shift the beam tree if needed
    DataTree<Curve> wholeTree = TrimTree(B, 3);
    DataTree<Curve> beamTree = new DataTree<Curve>();


    // 1.1) Cull beam based on direction
    for (int i = 0; i < wholeTree.BranchCount; i++)
    {
      foreach (Curve beam in wholeTree.Branch(i))
      {
        Vector3d tan = beam.TangentAt(0.5);
        if (D == 1)
        {
          if (tan.X < -0.5 || tan.X > 0.5)  beamTree.Add(beam, new GH_Path(i));
          else                              beamTree.Add(null, new GH_Path(i));
        }
        else if (D == 2)
        {
          if (tan.Y < -0.5 || tan.Y > 0.5)  beamTree.Add(beam, new GH_Path(i));
          else                              beamTree.Add(null, new GH_Path(i));
        }
        else beamTree.Add(beam, new GH_Path(i));
      }
    }

    // 2) Create final output trees
    DataTree<Mesh> beamFaceMeshesTree = new DataTree<Mesh>();
    DataTree<double> beamFaceAreasTree = new DataTree<double>();
    DataTree<Mesh> beamColoredMeshesTree = new DataTree<Mesh>();

    // 3) Loop over branches
    for (int i = 0; i < beamTree.BranchCount; i++)
    {
      GH_Path path = F.Path(i);

      // (A) Mesh the first brep in this branch
      List<Brep> breps = F.Branch(i);
      if (breps == null || breps.Count < 1) continue;
      Brep mainBrep = breps[0];
      mainBrep.MergeCoplanarFaces(0.01);

      // Mesh the brep
      string warn, inf;
      List<Mesh> meshedBrepFaces = KarambaMesher(
          new List<Brep> { mainBrep },
          new List<Point3d>(), // no interior points
          0.2,                  // mResolution
          out warn,
          out inf
      );

      // (B) Break the big meshed brep(s) into face-level meshes
      List<Mesh> faceMeshes = new List<Mesh>();
      List<double> faceAreas = new List<double>();
      List<Point3d> centroids = new List<Point3d>();

      foreach (Mesh bigMesh in meshedBrepFaces)
      {
        // Break each "bigMesh" into single-face submeshes + area + centroid
        MeshFaceProperties(bigMesh, ref faceMeshes, ref faceAreas, ref centroids);
      }

      // (C) For each face centroid, find which beam is closest
      //     We keep the same beam indexing, including null beams
      List<Curve> beamList = beamTree.Branch(i);
      List<int> faceToBeamIndex = new List<int>(faceMeshes.Count);

      for (int face_i = 0; face_i < faceMeshes.Count; face_i++)
      {
        Point3d cPt = centroids[face_i];
        double bestDist = double.MaxValue;
        int bestBeam = -1;

        for (int bIdx = 0; bIdx < beamList.Count; bIdx++)
        {
          if (beamList[bIdx] != null)
          {
            double t;
            beamList[bIdx].ClosestPoint(cPt, out t);
            Point3d beamPt = beamList[bIdx].PointAt(t);
            double dist = cPt.DistanceTo(beamPt);

            if (dist < bestDist)
            {
              bestDist = dist;
              bestBeam = bIdx;
            }
          }
        }
        faceToBeamIndex.Add(bestBeam);
      }
      // (D) Create a color gradient for beams in this branch
      //     e.g. from Red to Blue, or any custom function you like
      List<ColorRGBA> beamColors = new List<ColorRGBA>();
      int beamCount = beamList.Count;
      for (int bIdx = 0; bIdx < beamCount; bIdx++)
      {
        double t = (beamCount == 1) ? 0.0 : bIdx / (beamCount - 1.0);
        ColorHSV hsv = new ColorHSV(t, 1.0, 1.0);
        ColorRGBA rgb = hsv.ToArgbColor();
        Print(rgb.ToString());
        beamColors.Add(rgb);
      }

      // (E) Group faces by beam, assign color, store in data trees
      for (int bIdx = 0; bIdx < beamCount; bIdx++)
      {
        GH_Path subPath = new GH_Path(path);
        subPath = subPath.AppendElement(bIdx);

        Curve beamRef = beamList[bIdx];
        if (beamRef == null)
        {
          // No valid beam => fill with "0" area & "null" mesh
          beamFaceAreasTree.Add(0.0, subPath);
          beamFaceMeshesTree.Add(null, subPath);
          beamColoredMeshesTree.Add(null, subPath);
          continue;
        }

        ColorRGBA groupColor = beamColors[bIdx];
        bool foundAnyFace = false;

        for (int face_i = 0; face_i < faceMeshes.Count; face_i++)
        {
          if (faceToBeamIndex[face_i] == bIdx)
          {
            foundAnyFace = true;
            // 1) Add to the uncolored final tree
            beamFaceMeshesTree.Add(faceMeshes[face_i], subPath);
            beamFaceAreasTree.Add(faceAreas[face_i], subPath);

            // 2) Make a copy (or reuse) and color it
            Mesh coloredMesh = faceMeshes[face_i].DuplicateMesh();
            coloredMesh.VertexColors.CreateMonotoneMesh((System.Drawing.Color)groupColor);

            // Add to the "colored" output
            beamColoredMeshesTree.Add(coloredMesh, subPath);
          }
        }
        if (!foundAnyFace)
        {
          beamFaceAreasTree.Add(0.0, subPath);
          beamFaceMeshesTree.Add(null, subPath);
          beamColoredMeshesTree.Add(null, subPath);
        }
      }
    }

    A = beamFaceAreasTree;
    M = beamTree;
    C = beamColoredMeshesTree;
# ---------- ia: C# additional code ----------
  //--------------------------------------------------------------------------------
  // 2) KARAMBA MESHER (UNCHANGED)
  //--------------------------------------------------------------------------------
  private List<Mesh> KarambaMesher(
                              // A few mandatory parameters up front, e.g. mResolution
                              List<Brep> breps,
                              List<Point3d> incPoints,
                              double mResolution,
                              // out parameters cannot have defaults and they must be declared before the optional ones
                              out string warning,
                              out string info,
                              // Optional parameters with defaults:
                              int mMode = 0,
                              double refineEdgeResFactor = 0.67,
                              double cullDist = 0.01,
                              double tolerance = 0.001,
                              double smooth = 0,
                              int steps = 5)
  {
    // This list will be filled by the Karamba mesher
    List<Mesh> remappedMeshes = new List<Mesh>();
    // Call Karamba's MeshBrepsHeimrath solver
    Karamba.GHopper.Utilities.Mesher.MeshBrepsHeimrath.solve( breps,
                                                              incPoints,
                                                              mResolution,
                                                              mMode,
                                                              refineEdgeResFactor,
                                                              cullDist,
                                                              tolerance,
                                                              smooth,
                                                              steps,
                                                              out warning,
                                                              out info,
                                                              out remappedMeshes);

    return remappedMeshes;
  }
  //--------------------------------------------------------------------------------
  // 3) EXTRACT SINGLE-FACE SUBMESHES + AREA + CENTROID
  //--------------------------------------------------------------------------------
  private void MeshFaceProperties(Mesh m, ref List<Mesh> faceMeshes, ref List<double> faceAreas, ref List<Point3d> faceCentres)
  {
    MeshFaceList meshFaces = m.Faces;
    foreach (MeshFace face in meshFaces)
    {
      Mesh faceMesh = new Mesh();
      if (face.IsTriangle)
      {
        faceMesh.Vertices.Add(m.Vertices[face.A]);
        faceMesh.Vertices.Add(m.Vertices[face.B]);
        faceMesh.Vertices.Add(m.Vertices[face.C]);
        faceMesh.Faces.AddFace(0, 1, 2);
      }
      else
      {
        faceMesh.Vertices.Add(m.Vertices[face.A]);
        faceMesh.Vertices.Add(m.Vertices[face.B]);
        faceMesh.Vertices.Add(m.Vertices[face.C]);
        faceMesh.Vertices.Add(m.Vertices[face.D]);
        faceMesh.Faces.AddFace(0, 1, 2, 3);
      }
      faceMesh.Normals.ComputeNormals();
      faceMesh.Compact();
      faceMeshes.Add(faceMesh);
      var amProp = AreaMassProperties.Compute(faceMesh);
      faceAreas.Add(amProp.Area);
      faceCentres.Add(amProp.Centroid);
    }
  }
  //--------------------------------------------------------------------------------
  // 4) TRIMTREE
  //--------------------------------------------------------------------------------
  private DataTree<T> TrimTree<T>(DataTree<T> tree, int depth)
  {
    DataTree<T> trimTree = new DataTree<T>();
    for (int i = 0; i < tree.BranchCount; i++)
    {
      GH_Path path = new GH_Path(tree.Path(i));
      List<T> tree_list = tree.Branch(i);
      var shift = Math.Abs(depth);
      // Positive shift
      if (depth >= 0)
      {
        while (shift > 0 && path.Length > 1)
        {
          path = path.CullFirstElement();
          shift -= 1;
        }
      }
      // Negative shift
      else
      {
        while (shift > 0 && path.Length > 1)
        {
          path = path.CullElement();
          shift -= 1;
        }
      }
      foreach (var item in tree_list) trimTree.Add(item, path);
    }
    return trimTree;
  }
  // Simple linear interpolation between two System.Drawing.Colors
  private System.Drawing.Color HSVToColor(double hue, double sat, double val)
  {
    //Use Rhino's built-in if you prefer:
    ColorHSV colHsv = new ColorHSV(hue * 360.0, sat, val);
    return colHsv.ToArgbColor();

    //// Or do your own custom HSV->RGB math:
    //double H = hue * 360.0;
    //Rhino.Display.ColorHSV colHsv = new Rhino.Display.ColorHSV(H, sat, val);
    //return colHsv.ToArgbColor();
  }
# ---------- end ia ----------
scriptpar = ScriptParasite(Enable=toggle_3, Folder=c_script.a)

# ---- group: Mesh to see direction
data_2 = Data(ia.C)

# ----
data_3 = Data(ia.M)
ma = MassAddition(Input=ia.A)  # -> Result, PartialResults
pshift = ShiftPaths(Data=ma.Result, Offset=-1)

# ----
# Breps
preview = CustomPreview(Geometry=extrude, Material=entwine_2)

# ----
# Lines
curve_preview = CustomCurvePreview(Curve=cluster.line_5, Linetype=linetype, Colour=entwine_4)

ma_2 = MassAddition(Input=pshift)  # -> Result, PartialResults
py3 = Python3Script(
    floor_thick=floor_thick,
    concrete_thickness=concrete_wall_thickness,
    stone_thickness=stone_wall_thickness,
    e_stone="2608",
    g_stone="1043",
    gamma_stone=masse_volumique_pierre,
    e_conc="3300",
    g_conc="1375",
    gamma_conc=masse_volumique_béton,
    gf_area=cluster.gf_area_2,
    floor_num=cluster.no_of_floors_2,
    bld_height=cluster.bld_height,
    gf_height=cluster.gf_height_2,
    floor_height=cluster.flr_height_2,
    lines=cluster.geo_15,
    permanent_load_floor=permanent_load_floor,
    permanent_load_roof=permanent_load_roof,
    live_load_floor=live_load_floor,
    live_load_roof=live_load_roof,
    coeff_phi_floors=coeff_phi_floors,
    coeff_phi_roof=coeff_phi_roof,
    coeff_psi2_floors=coeff_psi2_floors,
    coeff_psi2_roof=coeff_psi2_roof,
    roof=list_2,
    category=catégorie_d_importance_du_bâtiment,
    q=q,
    zone=zone_sismique,
    soil_type=type_de_sol,
    bracing_typology=list,
    inf_area=pshift)  # -> out, F_X, F_Y, trim_stone_lines; inputs floor_thick: Double, concrete_thickness: Double, stone_thickness: Double, e_stone: Int32, g_stone: Int32, gamma_stone: Double, e_conc: Int32, g_conc: Int32, gamma_conc: Double, gf_area: Double, floor_num: Int32, bld_height: Double, gf_height: Double, floor_height: Double, lines: tree of Line, permanent_load_floor: Double, permanent_load_roof: Double, live_load_floor: Double, live_load_roof: Double, coeff_phi_floors: Double, coeff_phi_roof: Double, coeff_psi2_floors: Double, coeff_psi2_roof: Double, roof: Int32, category: Int32, q: Double, zone: Int32, soil_type: Int32, bracing_typology: Int32, inf_area: tree of Double
# ---------- py3: Python ----------
import rhinoscriptsyntax as rs
import Rhino.Geometry as rg
import re
from Grasshopper import DataTree
from Grasshopper.Kernel.Data import GH_Path
from Grasshopper.Kernel.Types import IGH_Goo
from System import Object

#######################################################################################################
# CUSTOM DEFINITIONS
#######################################################################################################

# Category of importance of building
def Category_Importance(x):
    if x==1:
        gamma = 0.8
    elif x==2:
        gamma =1
    elif x==3:
        gamma = 1.2
    elif x==4:
        gamma = 1.4
    return gamma

# Seismic Zone 
def AGR(x):
    if x==1:
        a=0.4
    elif x==2:
        a=0.7
    elif x==3:
        a=1.1
    elif x==4:
        a=1.6
    elif x==5:
        a=3
    return a

# Calculation acceleration for a class floor A:
def AG(gamma, agr):
    return gamma * agr

# Soil parameter, SP:
# Lower limit of periods corresponding to the constant spectral acceleration stage, Tb:
# Higher limit of periods corresponding at the constant spectral acceleration level, Tc:
# Value defining the start of the constant spectral shift branch, Td:
def SP_TB_TC_TD(zone, soil_type):
    if zone<=4:
        if soil_type == 1:
            sp = 1
            tb = 0.03
            tc = 0.2
            td = 2.5
        elif soil_type == 2:
            sp = 1.35
            tb = 0.05
            tc = 0.25
            td = 2.5
        elif soil_type == 3:
            sp = 1.5
            tb = 0.06
            tc = 0.4
            td = 2
        elif soil_type ==4:
            sp = 1.6
            tb = 0.1
            tc = 0.6
            td = 1.4
        elif soil_type ==5:
            sp = 1.8
            tb = 0.08
            tc = 0.45
            td = 1.25
    else:
        td = 2
        if soil_type == 1:
            sp = 1
            tb = 0.15
            tc = 0.4
        elif soil_type ==2:
            sp = 1.2
            tb = 0.14
            tc = 0.5
        elif soil_type ==3:
            sp = 1.15
            tb = 0.2
            tc = 0.6
        elif soil_type ==4:
            sp = 1.35
            tb = 0.8
            tc = 0.2
        elif soil_type == 5:
            sp = 1.4
            tb = 0.05
            tc = 0.5
    return sp, tb, tc, td

# Total effective cross-sectional area of bracing walls at 1st level, Ac:
# Effective area of ​​the cross-section of the wall in the direction considered i at the 1st level, Ai:
def Ac(lines, building_height, stone_thk, conc_thk):
    conc, stone = Path_List(lines, '{0;')
    ax = DataTree[Object]()
    ay = DataTree[Object]()
    inx = DataTree[Object]()
    iny = DataTree[Object]()
    ax_tot_list = []
    ay_tot_list = []

    for i in range(lines.BranchCount):
        ac_accumulator_x = 0.0  # Initialize accumulator for x-axis
        ac_accumulator_y = 0.0  # Initialize accumulator for y-axis
        #print (ac_accumulator_x,"-", ac_accumulator_y)
        branchList = lines.Branch(i)
        path = lines.Path(i)
        for j in range(branchList.Count):
            line = branchList[j]
            vec = line.UnitTangent
            #print (vec)
            length = line.Length
            #print (length)
            if vec.X<-0.5 or vec.X>0.5:
                if path in conc:  
                    ai = length*conc_thk                
                    ax.Add(ai, path)

                elif path in stone: 
                    ai = length*stone_thk
                    ax.Add(ai, path)
                ac_x = ai*(0.2+(length/building_height)**2)
                inx.Add(ac_x, path)

                ac_accumulator_x += ac_x

            else:
                ax.Add(None, path)
                inx.Add(None, path)


            if vec.Y<-0.5 or vec.Y>0.5:
                if path in conc:
                    ai = length*conc_thk
                    ay.Add(ai, path)
                elif path in stone: 
                    ai = length*stone_thk
                    ay.Add(ai, path)
                ac_y = ai*(0.2+(length/building_height)**2)
                iny.Add(ac_y, path)

                ac_accumulator_y += ac_y
            else:
                ay.Add(None, path)
                iny.Add(None, path)


            #print (ac_accumulator_x,ac_accumulator_y)
        ax_tot_list.append(ac_accumulator_x)
        ay_tot_list.append(ac_accumulator_y)

            
    return ax_tot_list[0], ay_tot_list[0], ax, ay, inx, iny

#######################################################################################################
# Local Plane

def get_plane(lines, stone_thickness, concrete_thickness):

    trim_lines = Trim_Tree(lines, -3) # two branches {0} is conc and {1} is stone
    copied_lines = DataTree[rg.Line](lines)
    copied_lines.Flatten() # Still a tree with one branch

    branch_lines = copied_lines.Branch(0)
    pts = [pt for line in branch_lines for pt in [line.From, line.To]]
    global_bbox = rg.BoundingBox(pts)
    corner = global_bbox.Min # corner is in FF

    min_dist_x = float("inf")
    min_dist_y = float("inf")
    index_x = None
    index_y = None
    for i in range(copied_lines.Branch(0).Count):
        line = copied_lines.Branch(0)[i]
        vec = line.UnitTangent
        mid = line.PointAt(0.5)
        if vec.X<-0.5 or vec.X>0.5:
            dist_x = corner.DistanceTo(mid)
            if dist_x < min_dist_x:
                min_dist_x = dist_x
                index_x = i
        if vec.Y<-0.5 or vec.Y>0.5:
            dist_y = corner.DistanceTo(mid)
            if dist_y < min_dist_y:
                min_dist_y = dist_y
                index_y = i
    conc_inds = rg.Interval(0, trim_lines.Branch(0).Count-1)
    stone_inds = rg.Interval(trim_lines.Branch(0).Count, trim_lines.Branch(1).Count + trim_lines.Branch(0).Count-1)

    if conc_inds.IncludesParameter(index_x):
        x_offset = concrete_thickness/2
    else:
        x_offset = stone_thickness/2
    if conc_inds.IncludesParameter(index_y):
       y_offset = concrete_thickness/2
    else:
        y_offset = stone_thickness/2

    origin = rg.Point3d(corner)
    origin.X -=  x_offset
    origin.Y -=  y_offset
    origin.Z = 0

    pl = rg.Plane.WorldXY
    pl.Origin = origin
    return pl

# Length Coefficients:
def L_Val(lines, stone_thk, conc_thk, local_plane):
    conc, stone = Path_List(lines, '{0;')
    Lx = DataTree[Object]()
    Ly = DataTree[Object]()
    xi = DataTree[Object]()
    yi = DataTree[Object]()
    vecs = DataTree[Object]()
    for i in range(lines.BranchCount):
        branchList = lines.Branch(i)
        path = lines.Path(i)
        for j in range(branchList.Count):
            line = branchList[j]
            line_curve = rg.LineCurve(line)
            line_curve.Domain = rg.Interval(0, 1)
            mid = line_curve.PointAt(0.5)
            test, remap_mid = local_plane.RemapToPlaneSpace(mid)
            vec = line.UnitTangent
            length = line.Length

            if vec.X<-0.5 or vec.X>0.5:
                if path in conc:                   
                    Ly.Add(conc_thk, path)
                    yi.Add(remap_mid.Y, path)
                elif path in stone: 
                    Ly.Add(stone_thk, path)
                    yi.Add(remap_mid.Y, path)
            else: 
                Ly.Add(length, path)
                yi.Add(remap_mid.Y, path)

            if vec.Y<-0.5 or vec.Y>0.5:
                if path in conc:
                    Lx.Add(conc_thk, path)
                    xi.Add(remap_mid.X, path)
                elif path in stone: 
                    Lx.Add(stone_thk, path)   
                    xi.Add(remap_mid.X, path)           
            else: 
                Lx.Add(length, path)
                xi.Add(remap_mid.X, path)    

    return Lx, Ly, xi, yi

# Moment of Inertia:
def I_Val(all_lines, Lx, Ly):
    ix = DataTree[Object]()
    iy = DataTree[Object]()
    for i in range(all_lines.BranchCount):
        branchList = all_lines.Branch(i)
        path = all_lines.Path(i)
        for j in range(branchList.Count):
            vec = all_lines[path, j].UnitTangent
            if vec.X<-0.5 or vec.X>0.5:
                # iy_val=(Ly.Branch(i)[j] * Lx.Branch(i)[j]**3)/12
                # ix_val=0
                iy_val=(Ly.Branch(i)[j] * Lx.Branch(i)[j]**3)/12
                ix_val=(Lx.Branch(i)[j] * Ly.Branch(i)[j]**3)/12
                iy.Add(iy_val, path)
                ix.Add(ix_val, path)

            if vec.Y<-0.5 or vec.Y>0.5:
                # ix_val=(Lx.Branch(i)[j] * Ly.Branch(i)[j]**3)/12
                # iy_val=0
                ix_val=(Lx.Branch(i)[j] * Ly.Branch(i)[j]**3)/12
                iy_val=(Ly.Branch(i)[j] * Lx.Branch(i)[j]**3)/12
                
                iy.Add(iy_val, path)
                ix.Add(ix_val, path)
 
    return ix, iy

# Mass addition Function:
def Mass_Addition(data):
    data_tot = 0
    for i in (data):
        data_tot += i
    return data_tot

# mi_tot: sum of load descent on each wall
# mi_x_tot: sum of mi*xi for each wall
# mi_y_tot: sum of mi*yi for each wall
# ix_x_tot: sum of ix*xi for each wall
# iy_y_tot: sum of iy*yi for each wall
# ix_tot: sum of inertia of each wall in x
# iy_tot: sum of inertia of each wall in y
# oriented_x
# oriented_y
def Other_Val(all_lines, mi, Ix, Iy, local_coor):
    oriented_x = DataTree[Object]()
    oriented_y = DataTree[Object]()
    mi_x_tree = DataTree[Object]()
    mi_y_tree = DataTree[Object]()
    ix_x_tree = DataTree[Object]()
    iy_y_tree = DataTree[Object]()

    for i in range(all_lines.BranchCount):
        mi_tot, mi_x_tot, mi_y_tot, ix_x_tot, iy_y_tot, ix_tot, iy_tot = 0, 0, 0, 0, 0, 0, 0
        line_list = all_lines.Branch(i)
        mi_list = mi.Branch(i)
        ix_list = Ix.Branch(i)
        iy_list = Iy.Branch(i)

        path = all_lines.Path(i)
        for j in range(line_list.Count):
            mid_pt = line_list[j].PointAt(0.5)

            orient_pt = local_coor.RemapToPlaneSpace(mid_pt)[1]
            x_val = orient_pt[0]
            oriented_x.Add(x_val, path)
            
            y_val = orient_pt[1]
            oriented_y.Add(y_val, path)

            # mi total
            mi_val = mi_list[j]
            mi_tot += mi_val
            # mi_x total
            mi_x = mi_val * x_val
            mi_x_tree.Add(mi_x, path)

            mi_x_tot += mi_x
            # mi_y total
            mi_y = mi_val * y_val
            mi_y_tree.Add(mi_y, path)

            mi_y_tot += mi_y

            ix_val = ix_list[j]
            ix_tot += ix_val

            iy_val = iy_list[j]
            iy_tot += iy_val

            ix_x = ix_val * x_val
            ix_x_tot += ix_x
            ix_x_tree.Add(ix_x, path)


            iy_y = iy_val * y_val
            iy_y_tot += iy_y
            iy_y_tree.Add(iy_y, path)

    return mi_tot, mi_x_tot, mi_y_tot, ix_x_tot, iy_y_tot, ix_tot, iy_tot, oriented_x, oriented_y, mi_x_tree, mi_y_tree, ix_x_tree, iy_y_tree

#######################################################################################################

# Bracing Typology
def Ct(bracing_typology, ac):
    if bracing_typology == 1:
        ct = 0.085
    elif bracing_typology == 2:
        ct = 0.075
    elif bracing_typology == 3:
        ct = 0.075/(ac**(1/2))
    elif bracing_typology == 4:
        ct = 0.05
    return ct

# Fundamental period of building vibration for translational motion in the direction under consideration, T1 :
def T1(ct, h):
    t1 = ct*h**(3/4)
    return t1

# Coefficient of correction, lambda :
def Lambda(t1, tc):
    if  t1 <= (2*tc):
        a = 0.85
    else:
        a = 1
    return a

# Spectre de calcul pour l'analyse élastique pour les composantes horizontales, Sd(T) :
def Sd_T(t1,tb, tc, td, ag, sp, q):
    if 0<=t1<=tb:
        a = ag*sp*((2/3)+(t1/tb)*((2.5/q)-(2/3)))
    elif tb<=t1<=tc:
        a = ag*sp*2.5/q
    elif tc <= t1 <= ag:
        a = ag*sp*(2.5/q)*(tc/t1)
    else :
        a = ag*sp*(2.5/q)*(tc*td/(t1**2))
    return a

# Fi: (kN.m)
def Fi(floor_num, fb_x, gf_height, floor_height, m_floors, m_roof):
    x = 0
    # for i in range(floor_num + roof + 1):
    for i in range(floor_num + roof):

        if i == 0:
            val = gf_height * m_floors
            x += val
        elif i < floor_num+roof+1:
            val = (gf_height + (floor_height * i)) * m_floors
            x += val
        elif i == floor_num+roof+1:
            val = bld_height * m_roof
            x += val

    Fi = []
    # for i in range(floor_num + roof + 1):
    for i in range(floor_num + roof):

        if i < floor_num+roof+1:
            fi = fb_x * (gf_height + i * floor_height) * m_floors / x
            Fi.append(fi)
        else :
            fi = fb_x * (gf_height + i * floor_height) * m_roof / x
            Fi.append(fi)

    return Fi

#######################################################################################################
# Tree operations
#######################################################################################################
def Path_List(tree, pattern):
    pos_branches = []
    neg_branches = []
    #pattern = ';1}'
    for i in range(tree.BranchCount):
        path =  (tree.Path(i))
        found = re.search(pattern, str(path))
        if found: 
            pos_branches.append((path))
        else:
            neg_branches.append((path))
    return pos_branches, neg_branches

def Get_Tree(tree, path_list):
    output_tree = DataTree[Object]()
    for path in path_list:
        # Create a GH_Path object
        gh_path = GH_Path(path)      
        branch_data = tree.Branch(path)
        for item in branch_data:
            output_tree.Add(item, gh_path)
    return output_tree

def Trim_Tree(tree, depth):
    trim_tree = DataTree[Object]()
    for i in range(tree.BranchCount):
        path = GH_Path(tree.Path(i))
        tree_list = tree.Branch(i)
        shift = abs(depth)
        # Positive shift
        if depth >= 0:                
            while shift > 0 and path.Length > 1:
                path = path.CullFirstElement()
                shift -= 1
        # Negative shift
        else:   
            while shift > 0 and path.Length > 1:
                path = path.CullElement()
                shift -= 1
        for item in tree_list:
            trim_tree.Add(item, path)
    return trim_tree
#######################################################################################################
def Stone_Check(lines):
    stone_tree = DataTree[Object]()
    conc, stone = Path_List(lines, '{0;')
    for i in range(lines.BranchCount):
            branchList = lines.Branch(i)
            path = lines.Path(i)
            for j in range(branchList.Count):
                if path in stone:
                    stone_tree.Add(True, path)
                elif path in conc:
                    stone_tree.Add(False, path)
    stone_trim = Trim_Tree(stone_tree, 3)
    return stone_trim

def K_Calc(lines, all_lines, Lx, Ly, ix, iy, bld_height, e_stone, g_stone, e_conc, g_conc):
    kx = DataTree[Object]()
    ky = DataTree[Object]()
    stone_bool = Stone_Check(lines)

    for i in range(all_lines.BranchCount):
        branchList = all_lines.Branch(i)
        path = all_lines.Path(i)
        for j in range(branchList.Count):
            E = 0
            G = 0
            vec = all_lines[path, j].UnitTangent
            
            lx_val = Lx.Branch(i)[j]
            ly_val = Ly.Branch(i)[j]
            ix_val = ix.Branch(i)[j]
            iy_val = iy.Branch(i)[j]

            if vec.X<-0.5 or vec.X>0.5:
                if stone_bool.Branch(i)[j] == False:
                    E = e_conc
                    G = g_conc
                else:
                    E = e_stone
                    G = g_stone                                
                kx_val = 1 / (2 * ((bld_height ** 3) / (3 * E * iy_val) + 6 / 5 * bld_height / (ly_val * lx_val * G)))
                # ky_val = 0
                ky_val = 1 / (2 * ((bld_height ** 3) / (3 * E * ix_val) + 6 / 5 * bld_height / (ly_val * lx_val * G)))

                kx.Add(kx_val, path)
                ky.Add(ky_val, path)

            if vec.Y<-0.5 or vec.Y>0.5:
                if stone_bool.Branch(i)[j] == False:
                    E = e_conc
                    G = g_conc
                else:
                    E = e_stone
                    G = g_stone
                ky_val = 1 / (2 * ((bld_height ** 3) / (3 * E * ix_val) + 6 / 5 * bld_height / (ly_val * lx_val * G)))
                # kx_val = 0
                kx_val = 1 / (2 * ((bld_height ** 3) / (3 * E * iy_val) + 6 / 5 * bld_height / (ly_val * lx_val * G)))
                
                ky.Add(ky_val, path)
                kx.Add(kx_val, path)
    return kx, ky, stone_bool

def Torsional_Inertia(kx, ky, oriented_x, oriented_y, xg, yg):   
    kx_val_tree = DataTree[Object]() # kxi.(yi-yg)²
    ky_val_tree = DataTree[Object]() # kyi.(xi-xg)²

    for i in range(kx.BranchCount):
        kx_tot = 0
        ky_tot = 0
        branchList = kx.Branch(i)
        path = kx.Path(i)
        for j in range(branchList.Count):
            kx_val = kx.Branch(i)[j] * (oriented_y.Branch(i)[j] - yg) ** 2
            kx_val_tree.Add(kx_val, path) # For checking with excel
            kx_tot += kx_val

            ky_val = ky.Branch(i)[j] * (oriented_x.Branch(i)[j] - xg) ** 2
            ky_val_tree.Add(ky_val, path) # For checking with excel
            ky_tot += ky_val
    return kx_tot, ky_tot, kx_val_tree, ky_val_tree

def Vi(kx, ky, fb_x, fb_y):
    vi_x = DataTree[Object]()
    vi_y = DataTree[Object]()

    for i in range(kx.BranchCount):
        kx_branch = kx.Branch(i)
        ky_branch = ky.Branch(i)
        path = kx.Path(i)
        kx_tot_flat = Mass_Addition(kx_branch)
        ky_tot_flat = Mass_Addition(ky_branch)
        for j in range(kx_branch.Count):
            vi_x_val = (kx.Branch(i)[j] / kx_tot_flat) * fb_x # MN
            vi_x.Add(vi_x_val, path)
            vi_y_val = (ky.Branch(i)[j] / ky_tot_flat) * fb_y# MN
            vi_y.Add(vi_y_val, path)
    return vi_x,vi_y 

# Seismic horizontal efforts at each level in both directions x and y:
def Force_Calc (kx, ky, oriented_x, oriented_y, xg, yg, kxy_tot, fb_x, fb_y, e_x, e_y, Lx, Ly, vi_x, vi_y):
    fin_x = DataTree[Object]()
    fin_y = DataTree[Object]()

    fin_x_ch = DataTree[Object]()
    fin_y_ch = DataTree[Object]()
    for i in range(kx.BranchCount):
        branchList = kx.Branch(i)
        path = kx.Path(i)
        for j in range(branchList.Count):
            kx_val = kx.Branch(i)[j]
            ky_val = ky.Branch(i)[j]
            oriented_x_val = oriented_x.Branch(i)[j]
            oriented_y_val = oriented_y.Branch(i)[j]
            Lx_val = Lx.Branch(i)[j]
            Ly_val = Ly.Branch(i)[j]
            vi_x_val = vi_x.Branch(i)[j]
            vi_y_val = vi_y.Branch(i)[j]

            # fin_x_val = ((kx_val * (oriented_y_val - yg)) / kxy_tot) * (fb_x *((e_x+0.05 * Ly_val) + (e_y+0.05*Lx_val)))
            # fin_y_val = ((ky_val * (oriented_x_val - xg)) / kxy_tot) * (fb_y*((e_x+0.05 * Ly_val) + (e_y+0.05*Lx_val)))
            fin_x_val = ((kx_val * (oriented_y_val - yg)) / kxy_tot) * (fb_x * ((e_x + 0.05 * Ly_val) + (e_y + 0.05 * Lx_val)))
            fin_y_val = ((ky_val * (oriented_x_val - xg)) / kxy_tot) * (fb_y * ((e_x + 0.05 * Ly_val) + (e_y + 0.05 * Lx_val)))
            f_x_tot = fin_x_val + vi_x_val
            f_y_tot = fin_y_val + vi_y_val
            
            fin_x.Add(f_x_tot, path)
            fin_y.Add(f_y_tot, path)

            fin_x_ch.Add(fin_x_val, path)
            fin_y_ch.Add(fin_y_val, path)
    return fin_x, fin_y, fin_x_ch, fin_y_ch

# Dispatches the forces only for stone elements
def Dispatch_Forces(fin_x, fin_y, lines):
    fin_x_disp = DataTree[Object]()
    fin_y_disp = DataTree[Object]()
    stone_bool = Stone_Check(lines)
    for i in range(fin_x.BranchCount):
        branchList = fin_x.Branch(i)
        path = fin_x.Path(i)
        for j in range(branchList.Count):
            if stone_bool.Branch(i)[j] == True:
                fin_x_disp.Add(fin_x.Branch(i)[j], path)
                fin_y_disp.Add(fin_y.Branch(i)[j], path)
            # else:
            #     fin_x_disp.Add(0, path)
            #     fin_y_disp.Add(0, path)
    return fin_x_disp,fin_y_disp

#######################################################################################################
#######################################################################################################    
#######################################################################################################
# ALGORITHM
#######################################################################################################
#######################################################################################################
#######################################################################################################   
# Get local origin plane of the building
local_pl = get_plane(lines, stone_thickness, concrete_thickness)
# Geometry
ground_floor, allother_floor = Path_List(lines, ';1}') # ;0 is empty, ;1 is gf and 2,3.. is upper floors
gf_lines = Get_Tree(lines, ground_floor)
#aof_lines = Get_Tree(lines, allother_floor)
trim_gf_lines = Trim_Tree(gf_lines, -3) # Trim depth of 1 {0} is conc; {1} is stone

conc_path, stone_path = Path_List(lines, '{0;')
conc_lines = Get_Tree(lines, conc_path)
trim_conc_lines = Trim_Tree(conc_lines, 3) # Trim depth of 1 {0} is conc; {1} is stone

all_lines = Trim_Tree(lines, 3)
#Lx_all, Ly_all, testx, testy = L_Val(lines) ##
Lx_all, Ly_all, xi_all, yi_all = L_Val(lines, stone_thickness, concrete_thickness, local_pl) ##

Lx = Trim_Tree(Lx_all, 3)
Ly = Trim_Tree(Ly_all, 3)
## X and Y coords of centroid >>> To compare with excel 
xi = Trim_Tree(xi_all, 3)
yi = Trim_Tree(yi_all, 3)



ix, iy = I_Val(all_lines, Lx, Ly)

gamma = Category_Importance(category)
agr = AGR(zone)
ag = AG(gamma, agr)
sp, tb, tc, td = SP_TB_TC_TD(zone, soil_type)

#ac_x, ac_y = Ac(trim_gf_lines, bld_height) # check here if 1st argument is just two branches (refer the Ac def)
ac_accumulator_x, ac_accumulator_y, ax, ay, ac_x, ac_y  = Ac(all_lines, bld_height, stone_thickness, concrete_thickness)

ct_x = Ct(bracing_typology, ac_accumulator_x)
ct_y = Ct(bracing_typology, ac_accumulator_y)

t1_x = T1(ct_x, bld_height)
t1_y = T1(ct_y, bld_height)

lambda_x = Lambda(t1_x, tc)
lambda_y = Lambda(t1_y, tc)

sd_x = Sd_T(t1_x, tb, tc, td, ag, sp, q)
sd_y = Sd_T(t1_y, tb, tc, td, ag, sp, q)

#######################################################################################################
# Can be shrunk!!!

# Lxy = Lx * Ly
Lxy = DataTree[Object]()
for i in range(Lx.BranchCount):
        branchList = Lx.Branch(i)
        path = Lx.Path(i)
        for j in range(branchList.Count):
            lxy = Lx.Branch(i)[j] * Ly.Branch(i)[j]
            Lxy.Add(lxy, path)

# Lxy_Tot  = Mass Addition (Lxy)
Lxy_Tot = DataTree[Object]()
for i in range(Lxy.BranchCount):
    branchList = Lxy.Branch(i)
    path = Lxy.Path(i)
    add = 0
    for j in range(branchList.Count):
        add += branchList[j]
    Lxy_Tot.Add(add, path)

# Lxy_Avg = Lxy / Lxy_Tot
Lxy_Avg = DataTree[Object]()
for i in range(Lxy.BranchCount):
        branchList = Lxy.Branch(i)
        path = Lxy.Path(i)
        for j in range(branchList.Count):
            lxy_avg = branchList[j] / Lxy_Tot[path, 0]
            Lxy_Avg.Add(lxy_avg, path)

# Load multipliers
Lxy_Tot_Roof = Lxy_Tot.Branch(Lxy_Tot.BranchCount-1)[0]
Lxy_Tot_Floors = 0
for i in range(Lxy_Tot.BranchCount-1):
    Lxy_Tot_Floors += Lxy_Tot.Branch(i)[0]
Lxy_Tot_Floors /= Lxy_Tot.BranchCount-1

#############################################################################################################################
# INPUTS
#############################################################################################################################
# Loads
#permanent_load_floor_100 = permanent_load_floor * 100
#permanent_load_roof_100 = permanent_load_roof * 100
#live_load_floor_100 = live_load_floor * 100
#live_load_roof_100 = live_load_roof * 100

# Material
#concrete_density = gamma_conc * 100    ##gamma_conc = 25 kN/m3
#stone_density = gamma_stone * 100   ##gamma_stone = 19.5 kN/m3
# E_stone, G_stone, E_conc, G_conc = e_stone * 10, g_stone * 10, e_conc * 10, g_conc * 10 # MPa
E_stone, G_stone, E_conc, G_conc = e_stone , g_stone , e_conc , g_conc # MPa


# Total mass of building above foundation or top of rigid basement, m :
pp = floor_thick * gamma_conc # Self load floor: kN/m²
wall_sa = floor_height * gamma_stone # Self load wall: kN/m² of surface of walls in plan

#a1 = Qf*Sf*psi (kN)
Q1 = live_load_floor * gf_area * coeff_phi_floors * coeff_psi2_floors
#a2 = Qr*Sr*psi (kN)
Q2 = live_load_roof * gf_area * coeff_phi_roof * coeff_psi2_roof
#a11 = G2f*Sfloor (kN)
G2 = permanent_load_floor * gf_area
#a22 = G2r*Sroof (kN)
G22 = permanent_load_roof * gf_area
#a4 = PPf * Sfloor (kN)
G1 = pp * gf_area
#a5 = PPw * Swalls (kN)
G11 = wall_sa * Lxy_Tot_Floors

Q1_floor = Q1 * (floor_num + 1)
Q2_roof = Q2 * roof
G2_floor = G2 * (floor_num + 1)
G22_roof = G22 * roof
G1_f = G1 * (floor_num + 1)
G11_f = G11 * (floor_num + 1)

m = (Q1_floor + Q2_roof + G2_floor + G22_roof + G1_f + G11_f) / 9.81 # Total mass (tonnes)
# m = (a1_floor + a2_roof + a11_floor + a22_roof + a4_f + a5_f) #(kN)

m_roof = (Q2 + G22 + G1) #(kN)
m_floors = (Q1 + G2 + G1 + G11) #(kN)

# Seismic shear force at the base of the structure, Fb - depending on x:
fb_x = sd_x * m * lambda_x / 1000 # MN
fi_x = Fi(floor_num, fb_x, gf_height, floor_height, m_floors, m_roof)

# Seismic shear force at the base of the structure, Fb - depending on y:
fb_y = sd_y * m * lambda_y / 1000 # MN
fi_y = Fi(floor_num, fb_y, gf_height, floor_height, m_floors, m_roof)

# Gwalls: (tonnes)
g_wall_tree = DataTree[Object]()
for i in range(Lxy_Tot.BranchCount):
    path = Lxy_Tot.Path(i)
    # g_wall =  gamma_stone * floor_height * Lxy_Tot.Branch(i)[0] / 9.81
    g_wall =  gamma_stone * floor_height * Lxy_Tot.Branch(i)[0]

    g_wall_tree.Add(g_wall, path)

# Gfloors: (tonnes)
g_floor = (pp+ live_load_floor) * gf_area / 9.81 # this was removed from mi calculation




# inf_area * gf_area:
inf_area_calc = DataTree[Object]()
for i in range(inf_area.BranchCount):
    inf_area_branch = inf_area.Branch(i)
    path = Lxy_Avg.Path(i)
    for j in range(inf_area_branch.Count):
        value = inf_area_branch[j] / gf_area
        inf_area_calc.Add(value, path) 

# mi - load descent on each wall in accordance with the formula: sum(G)+sum(psi*Q)
mi = DataTree[Object]()
for i in range(Lxy_Avg.BranchCount):
    lxy_avg_branch = Lxy_Avg.Branch(i)
    g_wall_branch = g_wall_tree.Branch(i)[0]
    inf_area_calc_branch = inf_area_calc.Branch(i)

    path = Lxy_Avg.Path(i)
    for j in range(lxy_avg_branch.Count):
        # value = lxy_avg_branch[j] * g_wall_branch + inf_area_calc_branch[j] * g_floor 
        value = lxy_avg_branch[j] * g_wall_branch + inf_area_calc_branch[j] * G1 # g_floor to G1
        
        mi.Add(value, path)

# Center of gravity
mi_tot, mi_x_tot, mi_y_tot, ix_x_tot, iy_y_tot, ix_tot, iy_tot, oriented_x, oriented_y, mi_x_tree, mi_y_tree, ix_x_tree, iy_y_tree = Other_Val(all_lines, mi, ix, iy, local_pl)
xg = mi_x_tot/mi_tot
yg = mi_y_tot/mi_tot
xc = ix_x_tot/ix_tot
yc = iy_y_tot/iy_tot
e_x = xg - xc
e_y = yg - yc

kx, ky, stone_bool = K_Calc(lines, all_lines, Lx, Ly, ix, iy, bld_height, E_stone, G_stone, E_conc, G_conc)

kxi_tot, kyi_tot, kx_val, ky_val = Torsional_Inertia(kx, ky, oriented_x, oriented_y, xg, yg)
kxy_tot = kxi_tot + kyi_tot

vi_x, vi_y = Vi(kx, ky, fb_x, fb_y)
fin_x, fin_y, fin_x_val, fin_y_val = Force_Calc (kx, ky, oriented_x, oriented_y, xg, yg, kxy_tot, fb_x, fb_y, e_x, e_y, Lx, Ly, vi_x, vi_y)

# Dispatch forces only for stone elements
fin_x_disp, fin_y_disp = Dispatch_Forces(fin_x, fin_y, lines)

#############################################################################################################################
# OUTPUTS
#############################################################################################################################
F_X = fin_x_disp
F_Y = fin_y_disp

stone_lines = Get_Tree(lines, stone_path)
trim_stone_lines = Trim_Tree(stone_lines, 3)
# ---------- end py3 ----------

# ---- group: Check floor areas
panel_6 = Panel(ma_2.Result)

# ----
data_4 = Data(py3.trim_stone_lines)
data_5 = Data(flatten(cluster.data_9))
end = EndPoints(Curve=data_5)  # -> Start, End
midpt = CurveMiddle(Curve=data_4)
data_6 = Data(end.End)
cps = ClosestPoints(Point=midpt, Cloud=data_6, Count=1)  # -> ClosestPoint, CPIndex, Distance
pshift_2 = ShiftPaths(Data=cps.CPIndex, Offset=-1)
item = ListItem(List=data_5, Index=pshift_2, Wrap=True)
data_7 = Data(item)

# ---- group: Only for rigid stone elements
data_8 = Data(py3.F_X)
data_9 = Data(py3.F_Y)

# ----
extrude_2 = EXTRUDE(
    def_cols=data_7,
    line=cluster.line_5,
    z_orient=cluster.z_orient_5,
    domain_x=cluster.domain_x_5,
    domain_y=cluster.domain_y_5)  # -> T, D, rect, height

partial_material_coefficients_for_masonr = ValueList({"A": 2, "B": 2.2, "C": 2.5, "D": 2.2, "E": 1.15, "F": 2.2, "G": 2}, selected="A")  # "Partial material coefficients for masonry constructions - γM"
fm_compressive_strength_mortar_mpa = Slider(0, range=0..25)
fb_wall_compressive_strength_mpa = Slider(19.5, range=0..25)
masonry_type = ValueList({"brick group 1": "b1", "brick group 2": "b2", "brick group 3": "b3", "brick group 4": "b4", "sand-lime brick group 1": "slb1", "sand-lime brick group 2": "slb2", "concrete group 1": "c1", "concrete group 2": "c2", "concrete group 3": "c3", "concrete group 4": "c4", "aerated concrete": "ac", "concrete brick": "cb", "nature stone": "ns"}, selected="brick group 1")
mortar = ValueList({"normal mortar M1-M2": "nm1", "normal mortar M2.5-M9": "nm2", "normal mortar M10-M20": "nm3", "leightweight mortar pd<800": "lwm1", "leightweight mortar pd>800": "lwm2", "thin-bed mortar (0.5-3mm)": "tbm"}, selected="thin-bed mortar (0.5-3mm)")
py3_2 = Python3Script(
    masonry=masonry_type,
    mortar=mortar,
    gamma_M=partial_material_coefficients_for_masonr,
    fb=fb_wall_compressive_strength_mpa,
    fm=fm_compressive_strength_mortar_mpa)  # -> out, formula, df1, df2, K, fds, fd, fk, gamma_Ms, fvk0
# ---------- py3_2: Python ----------
# requirements: pandas
from Grasshopper import DataTree
import locale
locale.setlocale(locale.LC_ALL, 'fr_FR')
import pandas as pd

#9.6 Vérification de sécurité - EN 1996-1-1 :2004 
def gamma_Ms(gamma_M):
    result = max(2 / 3 * gamma_M, 1.5)
    return result

gamma_Ms = gamma_Ms(gamma_M)
print(gamma_Ms)

#choose the right formula for fk
# Define the function
def formula(masonry, mortar):
    if mortar == "nm1" or mortar == "nm2" or mortar == "nm3" or mortar == "lwm1" or mortar == "lwm2":
        return "f1"
    elif mortar == "tbm":
        if masonry in ["b1", "b4", "slb1", "slb2", "ab", "cb"]:
            return "f2"
        if masonry in ["b2", "b3"]:
            return "f3"
        else:
            return "input false"
    else:
        return "input false"

# Call the function with arguments
formula = formula(masonry, mortar)

# Now 'output' will contain the result, e.g., "f2"
print(formula)

################################################################################################################

#K values for masonry with normal mortar, thin-bed mortar and lightweight mortar EN 1996-1-1: 5.7.1.4

#column names + data
data = {
    'nm1': [0.55, 0.45, 0.35, 0.35, 0.55, 0.45, 0.55, 0.45, 0.40, 0.35, 0.55, 0.45, 0.45],
    'nm2': [0.55, 0.45, 0.35, 0.35, 0.55, 0.45, 0.55, 0.45, 0.40, 0.35, 0.55, 0.45, 0.45],
    'nm3': [0.55, 0.45, 0.35, 0.35, 0.55, 0.45, 0.55, 0.45, 0.40, 0.35, 0.55, 0.45, 0.45],
    'tbm': [0.75, 0.70, 0.50, 0.35, 0.80, 0.65, 0.80, 0.65, 0.50, 0, 0.80, 0.75, 0],
    'lwm1': [0.30, 0.25, 0.20, 0.20, 0, 0, 0.45, 0.45, 0,0, 0.45, 0, 0],
    'lwm2': [0.40, 0.30, 0.25, 0.25, 0, 0, 0.45, 0.45, 0, 0, 0.45, 0, 0]
}

# row names
index = ['b1', 'b2', 'b3', 'b4', 'slb1', 'slb2', 'c1', 'c2', 'c3', 'c4', 'ab', 'cb', 'ns']

#create DataFrame 
df1 = pd.DataFrame(data, index=index)

#show Data
print(df1)

def K(row_name, col_name):
    try: 
        result = df1.loc[row_name, col_name]
        return result
    except KeyError:
        return "Invalid row or column name"

K = K(masonry, mortar)

print(K)

########################################################################################################################

#Initial shear strength of masonry, fvk0 - table EN 1996-1-1: 5.7.2.2

#column names + data
data = {
    'nm1'   : [0.10, 0.10, 0.10, 0.10, 0.10, 0.10, 0, 0, 0, 0, 0, 0.10, 0],
    'nm2'   : [0.20, 0.20, 0.20, 0.20, 0.10, 0.10, 0.10, 0.10, 0, 0, 0.15, 0, 0],
    'nm3'   : [0.30, 0.30, 0.30, 0.30, 0.20, 0.20, 0.20, 0.20, 0.20, 0.20, 0, 0, 0],
    'tbm'   : [0.30, 0.30, 0.30, 0.30, 0.40, 0.40, 0.30, 0.30, 0.30, .30, 0.30, 0.30, 0],
    'lwm1'  : [0.15, 0.15, 0.15, 0.15, 0.15, 0.15, 0.15, 0.15, 0.15, 0.15, 0.15, 0.15, 0],
    'lwm2'  : [0.15, 0.15, 0.15, 0.15, 0.15, 0.15, 0.15, 0.15, 0.15, 0.15, 0.15, 0.15, 0]
}

# row names
index = ['b1', 'b2', 'b3', 'b4', 'slb1', 'slb2', 'c1', 'c2', 'c3', 'c4', 'ab', 'cb', 'ns']

#create DataFrame
df2 = pd.DataFrame(data, index=index)

print(df2)

def fvk0(row_name, col_name):
    try: 
        result = df2.loc[row_name, col_name]
        return result
    except KeyError:
        return "Invalid row or column name"

fvk0 = fvk0(masonry, mortar)

print(fvk0)

#############################################################################################################################

#Characteristic compressive strength of masonry without interrupted joints
def fd(fk, gamma_M):
    result = fk / gamma_M
    return result

def fds(fk, gamma_Ms):
    result = fk / gamma_Ms
    return result

def verify_and_calculate(fb, fm, mortar):

 if mortar == 'nm1' or mortar == 'nm2' or mortar == 'nm3':
        fb_limit = 75  # Limit value for fb for normal mortar
        fm_limit = 20  # Limit value for fm for normal mortar
 elif mortar == 'tbm':
        fb_limit = 50  # Limit value for fb for thin-bed mortar
        fm_limit = min(20, 2 * fb)  # Limit value for fm for thin-bed mortar or max 2 * fb
 elif mortar == 'lwm1' or mortar == 'lwm2':
        fb_limit = float('inf')  # No limit value for fb for lightweight mortar, therefore infinite
        fm_limit = 10  # Limit value for fm for lightweight mortar
 else:
    raise ValueError("Error - fm or fb limit")

 if fb > fb_limit:
    raise ValueError("Error - fb limit")
 if fm > fm_limit:
    raise ValueError("Error - fm limit")

 return fb, fm

fb, fm = verify_and_calculate(fb, fm, mortar)
print("This val: {}", fb)

#K -> 5.7.1.4 -> Tableau 5.3

def fk(K, fb, fm, formula):
    if formula == "f1":
        result = K * fb ** 0.8 * fm ** 0.3
    elif formula == "f2": 
        result = K * fb ** 0.85
    elif formula == "f3":
        result = K * fb ** 0.7
    else:
        raise ValueError("Invalid formula specified")  # Raise an error if formula is not recognized
    return result 

fk = fk(K, fb, fm, formula)
print(fk)

fd = fd(fk, gamma_M)
print(fd)

fds = fds(fk, gamma_Ms)
print(fds)
# ---------- end py3_2 ----------

cluster_2 = Cluster_3(
    data=matprops_5,
    num=floor_thick,
    D=entwine,
    line=cluster.line_5,
    z_orient=cluster.z_orient_5,
    domain_x=cluster.domain_x_5,
    domain_y=cluster.domain_y_5,
    geo=cluster.T,
    f_x=data_8,
    Y=data_9,
    crv=data_7,
    num_2=permanent_load_floor,
    num_5=permanent_load_roof,
    num_3=live_load_floor,
    num_4=live_load_roof)  # -> model, elem_id_3, lcnames, elem_id_4
cap = CapHoles(Brep=extrude_2.T)
data_10 = Data(graft(data_7))
analyse = AnalyseKaramba3D(Model=cluster_2.model)  # -> AnalysedModel, MaximumDisplacement_cm, ResultingForce_kN, ChangeOfElasticEnergy_kNm
match = MatchTree(Tree=graft(cluster_2.elem_id_3), Guide=graft(data_7))
len = Length(Curve=data_4)  # -> graft(Length)
len_2 = Length(Curve=data_10)

# ---- group: true == reverse list
# 0 >> Bottom node of element
# 1 >> Top node of element
# if true: 0 >> Top node of element
# 1 >> Bottom node of element
toggle_4 = BooleanToggle(True)

# ----
c_script_2 = CSharpScript()  # -> out, a; same code as c_script

ver = CSharpScript(
    switchFlag=toggle_4,
    Model_in=analyse.AnalysedModel,
    beamId=match,
    L=len,
    stone_thk=stone_wall_thickness,
    h_eff=len_2,
    fb=fb_wall_compressive_strength_mpa,
    fds=py3_2.fds,
    gammaMs=py3_2.gamma_Ms,
    fvk0=py3_2.fvk0,
    Reference=["C:\Users\vrajasekar\AppData\Roaming\McNeel\Rhinoceros\packages\8.0\Karamba3D\3.1.50129\net8.0-windows\KarambaCommon.dll", "C:\Users\vrajasekar\AppData\Roaming\McNeel\Rhinoceros\packages\8.0\Karamba3D\3.1.50129\net8.0-windows\Karamba.gha"])  # -> out, gLC, gPhi, gVz, gMz, gMy, gN, oL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; inputs switchFlag: Boolean, beamId: list of String, L: Double, stone_thk: Double, h_eff: Double, fb: Double, fds: Double, gammaMs: Double, fvk0: Double
# ---------- ver: C# usings ----------
using System.Runtime.Serialization;
using System.Threading;
using System.Threading.Tasks;
using System.Linq;
using Karamba.Models;
using KarambaCommon;
using Karamba.Elements;
using Karamba.Geometry;
using Karamba.Loads.Combination;
using feb;
using Karamba.GHopper.Geometry;
using Karamba.Results;
using System.Linq.Expressions;
using System.Reflection.Metadata.Ecma335;
# ---------- ver: C# ----------
    var model = Model_in as Karamba.Models.Model;

    // Positions along the element (0.0 = start, 1.0 = end)
    List<double> ts = new List<double> { 0.0, 1.0 };


    List<BeamForceOutput> outputsLC6 = KarBeamForces(Model_in, beamId, "LC6");

    // Create lists to store the extracted force components
    List<double> nEd_LC6 = outputsLC6.Select(output => output.N ?? 0).ToList();
    List<double> mEd_LC6 = outputsLC6.Select(output => output.My ?? 0).ToList();

    // Nodal displacemnets 
    List<double> yTrans_LC1 = new List<double>();
    KarNodalDisp(Model_in, beamId, "LC1", ref yTrans_LC1);

    // Create lists to store the extracted force components
    List<BeamForceOutput> outputsLC1 = KarBeamForces(Model_in, beamId, "LC1");
    List<double> n_LC1 = outputsLC1.Select(output => output.N ?? 0).ToList();
    List<double> vZ_LC1 = outputsLC1.Select(output => output.Vz ?? 0).ToList();
    List<double> mY_LC1 = outputsLC1.Select(output => output.My ?? 0).ToList();
    List<double> mZ_LC1 = outputsLC1.Select(output => output.Mz ?? 0).ToList();

    // Nodal displacemnets 
    List<double> yTrans_LC2 = new List<double>();
    KarNodalDisp(Model_in, beamId, "LC2", ref yTrans_LC2);

    // Create lists to store the extracted force components
    List<BeamForceOutput> outputsLC2 = KarBeamForces(Model_in, beamId, "LC2");
    List<double> n_LC2 = outputsLC2.Select(output => output.N ?? 0).ToList();
    List<double> vZ_LC2 = outputsLC2.Select(output => output.Vz ?? 0).ToList();
    List<double> mY_LC2 = outputsLC2.Select(output => output.My ?? 0).ToList();
    List<double> mZ_LC2 = outputsLC2.Select(output => output.Mz ?? 0).ToList();


    // Trigger to swicth the top and bottom values
    int top, bottom;
    if (switchFlag)
    {
      top = 1;
      bottom = 0;
    }
    else
    {
      top = 0;
      bottom = 1;
    }

    List<string> verificationLC1 = new List<string>();
    List<double> phiLC1 = new List<double>();

    bool boum_LC1 = Verification(top, bottom, mY_LC1, n_LC1, L, stone_thk, fvk0, gammaMs, fb, vZ_LC1, h_eff, mEd_LC6, nEd_LC6, yTrans_LC1, fds, ref verificationLC1, ref phiLC1);

    List<string> verificationLC2 = new List<string>();
    List<double> phiLC2 = new List<double>();


    bool boum_LC2 = Verification(top, bottom, mY_LC2, n_LC2, L, stone_thk, fvk0, gammaMs, fb, vZ_LC2, h_eff, mEd_LC6, nEd_LC6, yTrans_LC2, fds, ref verificationLC2, ref phiLC2);

    bool finalBoum = boum_LC1 || boum_LC2;

    int boumLC1_int = ToInt(boum_LC1);
    int boumLC2_int = ToInt(boum_LC2);

    string governingLC;
    List<double> governingPhi;
    List<double> governingVz;
    List<double> governingMz;
    List<double> governingMy;
    List<double> governingN;
    if (boumLC1_int > boumLC2_int)
    {
      governingLC = "LC1";
      governingPhi = phiLC1;
      governingVz = vZ_LC1;
      governingMz = mZ_LC1;
      governingMy = mY_LC1;
      governingN = n_LC1;

    }
    else
    {
      governingLC = "LC2";
      governingPhi = phiLC2;
      governingVz = vZ_LC2;
      governingMz = mZ_LC2;
      governingMy = mY_LC2;
      governingN = n_LC2;

    }
    gLC = governingLC;
    gPhi = governingPhi;
    gVz = governingVz;
    gMz = governingMz;
    gMy = governingMy;
    gN = governingN;
    oL = L;
    oStoneThk = stone_thk;
    oHeff = h_eff;
    oFb = fb;
    oFds = fds;
    oGammaMs = gammaMs;
    oFvk0 = fvk0;
# ---------- ver: C# additional code ----------
  private int ToInt(bool value)
  {
    return value ? 1 : 0;
  }

  private List<int> BeamNodalInd(object Model_in, List<string> beamId)
  {
    var model = Model_in as Karamba.Models.Model;

    List<int> nodeIndices = new List<int>();


    // Access the beam element using its index
    List<ModelElement> beams = model.elementsByID(beamId);
    foreach (ModelElement beam in beams)
    {
      // Extract the start and end node indices
      nodeIndices.AddRange(beam.node_inds);

    }

    return nodeIndices;
  }

  //--------------------------------------------------------------------------------
  // 1) Calculate Nodal Displacements
  //--------------------------------------------------------------------------------
  private void KarNodalDisp(object Model_in, List<string> beamId, string resultSelection, ref List<double> ys)
  {

    var model = Model_in as Karamba.Models.Model;
    List<int> nodeIndices = BeamNodalInd(Model_in, beamId);

    List<List<Vector3>> trans;
    List<List<Vector3>> rotat;
    List<Point3> positions;
    List<List<Karamba.Loads.Combination.LoadCase>> governingLoadCases;
    List<List<int>> governingLoadCaseInds;

    NodeDisplacements.solve(
     model,
     resultSelection,
     nodeIndices,
     out trans,
     out rotat,
     out governingLoadCases,
     out governingLoadCaseInds,
     out positions
    );

    for (int i = 0; i < trans.Count; i++)
    {
      for (int j = 0; j < trans[i].Count; j++)
      {
        // Access the Y component of the translation vector
        double yComponent = trans[i][j].Y;
        ys.Add(yComponent);
      }
    }


  }
  //--------------------------------------------------------------------------------
  // 2) Calculate Beam Forces
  //--------------------------------------------------------------------------------
  public class BeamForceOutput
  {
    public double? N { get; set; }
    public double? Vy { get; set; }
    public double? Vz { get; set; }
    public double? Mt { get; set; }
    public double? My { get; set; }
    public double? Mz { get; set; }
  }
  private List<BeamForceOutput> KarBeamForces(object Model_in, List<string> beamId, string resultSelection)
  {
    var model = Model_in as Karamba.Models.Model;

    // Positions along the element (0.0 = start, 1.0 = end)
    // Output variables for the solve method
    List<List<List<Vector3>>> forces;
    List<List<List<Vector3>>> moments;
    List<List<List<Karamba.Loads.Combination.LoadCase>>> governingLoadCases;
    List<List<List<int>>> governingLoadCaseInds;
    List<int> elementInds;

    // Call the solve method
    BeamForces.solve(
      model,
      beamId,
      resultSelection,
      0,
      0,
      out forces,
      out moments,
      out governingLoadCases,
      out governingLoadCaseInds,
      out elementInds
    );

    // Create a list to hold the results for each element/position
    List<BeamForceOutput> outputs = new List<BeamForceOutput>();

    // Iterate over the nested lists to extract force components
    for (int i = 0; i < forces.Count; i++)
    {
      // For each element
      for (int j = 0; j < forces[i].Count; j++)
      {
        // For each position along the element (ts)
        // Assuming only one load case, so index 0
        Vector3 forceVec = forces[i][j][0];
        Vector3 momentVec = moments[i][j][0];

        BeamForceOutput result = new BeamForceOutput();

        // Decide which outputs to populate based on load case or other logic.
        // For example, if you want to output axial force and shear only:
        result.N = forceVec.X;

        // Shear forces Vy and Vz (local y and z-directions)
        result.Vy = forceVec.Y;
        result.Vz = forceVec.Z;

        // Torsional moment Mt (around local x-axis)
        result.Mt = momentVec.X;

        // Bending moments My and Mz (around local y and z-axes)
        result.My = momentVec.Y;
        result.Mz = momentVec.Z;
        
        outputs.Add(result);
      }
    }
    return outputs;
  }
  //--------------------------------------------------------------------------------
  // 4) TRIMTREE
  //--------------------------------------------------------------------------------
  private DataTree<T> TrimTree<T>(DataTree<T> tree, int depth)
  {
    DataTree<T> trimTree = new DataTree<T>();
    for (int i = 0; i < tree.BranchCount; i++)
    {
      GH_Path path = new GH_Path(tree.Path(i));
      List<T> tree_list = tree.Branch(i);
      var shift = Math.Abs(depth);
      // Positive shift
      if (depth >= 0)
      {
        while (shift > 0 && path.Length > 1)
        {
          path = path.CullFirstElement();
          shift -= 1;
        }
      }
      // Negative shift
      else
      {
        while (shift > 0 && path.Length > 1)
        {
          path = path.CullElement();
          shift -= 1;
        }
      }
      foreach (var item in tree_list) trimTree.Add(item, path);
    }
    return trimTree;
  }
  class T
  { }
  //--------------------------------------------------------------------------------
  // 5) Verification Module
  //--------------------------------------------------------------------------------

  private bool Verification(int top, int bottom,
        List<double> _m_y,
        List<double> _n,
        double L,
        double stone_thk,
        double fvk_0,
        double gamma_ms,
        double fb,
        List<double> _v_z,
        double h_eff,
        List<double> m_ed,
        List<double> n_ed,
        List<double> node_disp,
        double fds, 
        ref List<string> verStrings, 
        ref List<double> phiList)
  {

    // Convert force lists to absolute values.
    List<double> n = Absolute(_n);
    List<double> v_z = Absolute(_v_z);
    List<double> m_y = Absolute(_m_y);

    double ma_bottom = Ma(m_y[bottom], n[bottom], L);
    double ma_top = Ma(m_y[top], n[top], L);
    double ea_bottom = Ea(ma_bottom, n[bottom]);
    double ea_top = Ea(ma_top, n[top]);
    double lc_bottom = Lc(L, ea_bottom);
    double lc_top = Lc(L, ea_top);
    double sigma_d_bottom = Sigma_D(lc_bottom, stone_thk, n[bottom]);
    double sigma_d_top = Sigma_D(lc_top, stone_thk, n[top]);

    double fvk_bottom = Fvk(fvk_0, sigma_d_bottom);
    double fvd_bottom = Fvd(fvk_bottom, gamma_ms, fb);
    var vrdTuple = Vrd(lc_bottom, fvd_bottom, stone_thk, v_z[bottom]);
    double? vrd_bottom = vrdTuple.Item1;
    double? vrd_false = vrdTuple.Item2;

    double phi_bottom = Phi(Ei_Bottom(stone_thk, m_ed[bottom], n_ed[bottom], Einit(h_eff), node_disp[bottom]), stone_thk);
    double phi_top = Phi(Ei_Top(stone_thk, m_ed[top], n_ed[top], Einit(h_eff), node_disp[top]), stone_thk);
    double mrd_bottom = MRd(n[bottom], L, stone_thk, phi_bottom, 1, fds);
    double mrd_top = MRd(n[top], L, stone_thk, phi_top, 1, fds);
    double nrd_bottom = NRd(phi_bottom, L, stone_thk, fds);
    double nrd_top = NRd(phi_top, L, stone_thk, fds);

    phiList = new List<double>();
    if (top != 0)
    {
      phiList.Add(phi_bottom);
      phiList.Add(phi_top);
    }
    else
    {
      phiList.Add(phi_top);
      phiList.Add(phi_bottom);
    }

    double Nb_p = (Math.Abs(n[bottom]) / Math.Abs(nrd_bottom)) * 100.0;
    if (Nb_p >= 100)
      verStrings.Add("Vérification locale en compression at the foot of the wall: not ok; " + Nb_p.ToString("F2") + "%");
    else
      verStrings.Add("Vérification locale en compression at the foot of the wall: ok; " + Nb_p.ToString("F2") + "%");

    double Mb_p = Math.Abs((m_y[bottom] / mrd_bottom) * 100.0);
    if (Mb_p >= 100)
      verStrings.Add("Local bending verification at the foot of the wall: not ok; " + Mb_p.ToString("F2") + "%");
    else
      verStrings.Add("Local bending verification at the foot of the wall: ok, " + Mb_p.ToString("F2") + "%");

    double Nt_p = Math.Abs((n[top] / nrd_top) * 100.0);
    if (Nt_p >= 100)
      verStrings.Add("Vérification locale en compression at the head of the wall: not ok; " + Nt_p.ToString("F2") + "%");
    else
      verStrings.Add("Vérification locale en compression at the head of the wall: ok; " + Nt_p.ToString("F2") + "%");

    double Mt_p = Math.Abs((m_y[top] / mrd_top) * 100.0);
    if (Mt_p >= 100)
      verStrings.Add("Local bending verification at the head of the wall: not ok; " + Mt_p.ToString("F2") + "%");
    else
      verStrings.Add("Local bending verification at the head of the wall: ok; " + Mt_p.ToString("F2") + "%");

    double check1 = Math.Abs((m_y[bottom] / n[bottom]) / (L - ea_bottom)) * 100.0;
    if ((m_y[bottom] / n[bottom]) < (L - ea_bottom))
      verStrings.Add("no tilting at the foot of the wall");
    else
      verStrings.Add("tilting at the foot of the wall");

    double check2 = Math.Abs((m_y[top] / n[top]) / (L - ea_top)) * 100.0;
    if ((m_y[top] / n[top]) < (L - ea_top))
      verStrings.Add("no tilting at the head of the wall");
    else
      verStrings.Add("tilting at the head of the wall");

    if (lc_bottom < L)
      verStrings.Add("partially compressed at the foot of the wall");
    else if (lc_bottom < 0)
      verStrings.Add("fully tensioned at the foot of the wall");
    else
      verStrings.Add("fully compressed at the foot of the wall");

    if (lc_top < L)
      verStrings.Add("partially compressed at the head of the wall");
    else if (lc_top < 0)
      verStrings.Add("fully tensioned at the head of the wall");
    else
      verStrings.Add("fully compressed at the head of the wall");

    if (Ei_Bottom(stone_thk, m_ed[bottom], n_ed[bottom], Einit(h_eff), node_disp[bottom]) >= 0.05 * stone_thk)
      verStrings.Add("Eccentricity at the foot of the wall: ok");
    else
      verStrings.Add("Eccentricity at the foot of the wall: not ok");

    if (Ei_Top(stone_thk, m_ed[top], n_ed[top], Einit(h_eff), node_disp[top]) >= 0.05 * stone_thk)
      verStrings.Add("Eccentricity at the head of the wall: ok");
    else
      verStrings.Add("Eccentricity at the head of the wall: not ok");

    verStrings.Add("v_z[bottom]: " + v_z[bottom].ToString() + ", vrd_bottom: " + (vrd_bottom.HasValue ? vrd_bottom.Value.ToString() : "null"));

    if (!vrd_bottom.HasValue || vrd_bottom.Value == 0)
    {
      verStrings.Add("Shear verification: not ok");
    }
    else
    {
      double V_p = Math.Abs((v_z[bottom] / vrd_bottom.Value) * 100.0);
      if (V_p >= 100)
        verStrings.Add("Shear verification: not ok; " + V_p.ToString("F2") + "%");
      else
        verStrings.Add("Shear verification: ok; " + V_p.ToString("F2") + "%");
    }

    double check3 = Math.Abs(sigma_d_top / fds) * 100.0;
    double check4 = Math.Abs(sigma_d_bottom / fds) * 100.0;

    bool boum = Boum(Mt_p, Mb_p, Nt_p, Nb_p, check1, check2, check3, check4);
    return boum;
  }

  // Helper methods (all declared as private for C# 5)
  private List<double> Absolute(List<double> toConvert)
  {
    List<double> result = new List<double>();
    foreach (double val in toConvert)
    {
      result.Add(Math.Abs(val));
    }
    return result;
  }

  private double Ma(double m_y_val, double n_val, double l)
  {
    return m_y_val + n_val * l / 2.0;
  }

  private double Ea(double ma, double n_val)
  {
    return ma / n_val;
  }

  private double Lc(double l, double ea)
  {
    return 2.0 * (l - ea);
  }

  private double Sigma_D(double lc, double stone_thk, double N_val)
  {
    return (N_val / 1000.0) / (stone_thk * lc);
  }

  private double Fvd(double fvk, double gamma_ms, double fb)
  {
    double result = fvk / gamma_ms;
    double check_value = fb * 0.065;
    if (result > check_value)
    {
      Print("fvd <= fb*0,065 is false");
    }
    return result;
  }

  private double Fvk(double fvk_0, double sigma_d)
  {
    return fvk_0 + sigma_d * 0.4;
  }

  private Tuple<double?, double?> Vrd(double lc, double fvd, double stone_thk, double Ved)
  {
    if (lc < 0)
    {
      return new Tuple<double?, double?>(0, null);
    }
    else
    {
      double result = fvd * lc * stone_thk * 1000.0;
      if (result > Ved)
      {
        return new Tuple<double?, double?>(result, null);
      }
      else
      {
        return new Tuple<double?, double?>(null, result);
      }
    }
  }

  private double NRd(double phi, double L, double stone_thk, double fds)
  {
    return phi * L * stone_thk * fds * 1000.0;
  }

  private double Phi(double ei, double stone_thk)
  {
    double result = 1 - 2 * ei / stone_thk;
    if (result < 0.1)
    {
      Print("phi < 0.1 is false");
    }
    return result;
  }

  private double MRd(double N_val, double L, double stone_thk, double phi, double eta, double fds)
  {
    return (N_val * L / 2.0) * (1 - N_val / (L * stone_thk * phi * eta * fds * 1000.0));
  }

  private double Einit(double h_eff)
  {
    return h_eff / 450.0;
  }

  private double Ei_Bottom(double stone_thk, double m_ed, double n_ed, double einit, double pDecon)
  {
    return Math.Abs(m_ed / n_ed) + einit + pDecon;
  }

  private double Ei_Top(double stone_thk, double m_ed, double n_ed, double einit, double pDecon)
  {
    return Math.Abs(m_ed / n_ed) + einit + pDecon;
  }

  private bool Boum(double Mt_p, double Mb_p, double Nt_p, double Nb_p, double check1, double check2, double check3, double check4)
  {
    if (Mt_p > 100 || Mb_p > 100 || Nt_p > 100 || Nb_p > 100 ||
        check1 > 100 || check2 > 100 || check3 > 100 || check4 > 100)
      return true;
    else
      return false;
  }
# ---------- end ver ----------
scriptpar_2 = ScriptParasite(Enable=Toggle(True), Folder=c_script_2.a)

c_script_3 = CSharpScript()  # -> out, a; same code as c_script

calc = CSharpScript(
    switchFlag=toggle_4,
    phi=ver.gPhi,
    vZ=ver.gVz,
    mZ=ver.gMz,
    mY=ver.gMy,
    n=ver.gN,
    L=ver.oL,
    stone_thk=ver.oStoneThk,
    h_eff=ver.oHeff,
    fb=ver.oFb,
    fds=ver.oFds,
    gammaMs=ver.oGammaMs,
    fvk0=ver.oFvk0,
    Reference=["C:\Users\vrajasekar\AppData\Roaming\McNeel\Rhinoceros\packages\8.0\Karamba3D\3.1.50129\net8.0-windows\KarambaCommon.dll", "C:\Users\vrajasekar\AppData\Roaming\McNeel\Rhinoceros\packages\8.0\Karamba3D\3.1.50129\net8.0-windows\Karamba.gha"])  # -> out, verified, As_top, As_bottom, As2, As3; inputs switchFlag: Boolean, phi: list of Double, vZ: list of Double, mZ: list of Double, mY: list of Double, n: list of Double, L: Double, stone_thk: Double, h_eff: Double, fb: Double, fds: Double, gammaMs: Double, fvk0: Double
# ---------- calc: C# ----------
    int top, bottom;
    if (switchFlag)
    {
      top = 1;
      bottom = 0;
    }
    else
    {
      top = 0;
      bottom = 1;
    }

    List<string> verificationLC1 = new List<string>();
    double as_top = 0, as_bot = 0, as_2 = 0, as_3 = 0;

    bool boum_LC1 = CalculateReinforcement( top,
                                            bottom,
                                            phi,
                                            mY,    // axial moment? (used for reduced moment calculation)
                                            mZ,    // out-of-plane bending moment
                                            n,      // axial force
                                             L,
                                             stone_thk,
                                             fvk0,
                                             gammaMs,
                                             fb,
                                            vZ,    // shear forces (vertical)
                                            h_eff,
                                            fds,
                                            ref verificationLC1,
                                            ref as_top,
                                            ref as_bot,
                                            ref as_2,
                                            ref as_3);
    verified = verificationLC1;
    As_top = as_top;
    As_bottom = as_bot;
    As2 = as_2;
    As3 = as_3;
# ---------- calc: C# additional code ----------
  //--------------------------------------------------------------------------------
  // 1) Calculate Nodal Displacements
  //--------------------------------------------------------------------------------

  //--------------------------------------------------------------------------------
  // 2) Calculate Beam Forces
  //--------------------------------------------------------------------------------

  //--------------------------------------------------------------------------------
  // 4) TRIMTREE
  //--------------------------------------------------------------------------------
  private DataTree<T> TrimTree<T>(DataTree<T> tree, int depth)
  {
    DataTree<T> trimTree = new DataTree<T>();
    for (int i = 0; i < tree.BranchCount; i++)
    {
      GH_Path path = new GH_Path(tree.Path(i));
      List<T> tree_list = tree.Branch(i);
      var shift = Math.Abs(depth);
      // Positive shift
      if (depth >= 0)
      {
        while (shift > 0 && path.Length > 1)
        {
          path = path.CullFirstElement();
          shift -= 1;
        }
      }
      // Negative shift
      else
      {
        while (shift > 0 && path.Length > 1)
        {
          path = path.CullElement();
          shift -= 1;
        }
      }
      foreach (var item in tree_list) trimTree.Add(item, path);
    }
    return trimTree;
  }
  class T
  { }
  //--------------------------------------------------------------------------------
  // 5) Calculation of reinforcement quantities
  //--------------------------------------------------------------------------------
  
  
  private bool CalculateReinforcement(
      int top,
      int bottom,
      List<double> phi,
      List<double> _m_y,    // axial moment? (used for reduced moment calculation)
      List<double> _m_z,    // out-of-plane bending moment
      List<double> _n,      // axial force
      double L,
      double stone_thk,
      double fvk0,
      double gamma_ms,
      double fb,
      List<double> _v_z,    // shear forces (vertical)
      double h_eff,
      double fds,
      ref List<string> verStrings,
      ref double as_top,
      ref double as_bot,
      ref double as_2,
      ref double as_3)
  {
    // Define constants
    double E_mu = 0.0035;       // material strain parameter
    double fyd = 500.0;         // yield strength (connection from the outside)
    double Asv_min = 0.000314;  // minimum vertical reinforcement section (m²)

    // Convert forces to absolute values.
    List<double> n = Absolute(_n);
    List<double> v_z = Absolute(_v_z);
    List<double> m_y = Absolute(_m_y);
    List<double> m_z = Absolute(_m_z);

    // --- In-plane bending (NF EN 1996-1-1 §8.7.2) ---
    double Ma_top = Ma(m_y[top], n[top], L);
    double Ma_bottom = Ma(m_y[bottom], n[bottom], L);

    // Compute reduced moment factors (Mu)
    double Mu_top = Mu(Ma_top, fds, phi[top], L, stone_thk);
    double Mu_bottom = Mu(Ma_bottom, fds, phi[bottom], L, stone_thk);

    // Effective compression lengths in the plane of the wall
    double Lc_top = LcReinf(Mu_top, L);
    double Lc_bottom = LcReinf(Mu_bottom, L);

    // Reinforcement spacing in the wall plane
    double d_val = D(L);

    // Compute design strain in reinforcement, limited by fyd/200000
    double E_su_top = E_su(E_mu, d_val, Lc_top, fyd);
    double E_su_bottom = E_su(E_mu, d_val, Lc_bottom, fyd);

    // Required vertical reinforcement sections (m²) – Asvcalc and then the used value
    double Asv_calc_top = Asv_calc(Lc_top, stone_thk, phi[top], fds, n[top], E_su_top);
    double Asv_calc_bottom = Asv_calc(Lc_bottom, stone_thk, phi[bottom], fds, n[bottom], E_su_bottom);
    double Asv_top = Asv(Asv_calc_top, Asv_min);
    double Asv_bottom = Asv(Asv_calc_bottom, Asv_min);

    // Normal stress along the wall (MPa)
    double sigma_d_top = sigma_d(n[top], m_y[top], L, stone_thk);
    double sigma_d_bottom = sigma_d(n[bottom], m_y[bottom], L, stone_thk);

    double ratio1_top = ratio1(sigma_d_top, fds);
    double ratio1_bottom = ratio1(sigma_d_bottom, fds);

    if (sigma_d_top < fds)
      verStrings.Add("Crush test top: ok; " + ratio1_top.ToString("F2") + "%");
    else
      verStrings.Add("Crush test top: not ok; " + ratio1_top.ToString("F2") + "%");

    if (sigma_d_bottom < fds)
      verStrings.Add("Crush test bottom: ok; " + ratio1_bottom.ToString("F2") + "%");
    else
      verStrings.Add("Crush test bottom: not ok; " + ratio1_bottom.ToString("F2") + "%");

    // --- Out-of-plane bending (NF EN 1996-1-1 §8.7.3) ---
    double dtr_val = dtr(stone_thk);
    double nf = 1.0; // ηf (assumed value)
    double z_top = z(dtr_val, Asv_top, fyd, L, nf, fds);
    double z_bottom = z(dtr_val, Asv_bottom, fyd, L, nf, fds);
    double Mrd_top = Mrd(Asv_top, fyd, z_top);
    double Mrd_bottom = Mrd(Asv_bottom, fyd, z_bottom);

    double ratio2_top = ratio2(m_z[top], Mrd_top);
    double ratio2_bottom = ratio2(m_z[bottom], Mrd_bottom);

    if (m_z[top] < Mrd_top)
      verStrings.Add("Local bending verification top: ok " + ratio2_top.ToString("F2") + "%");
    else
      verStrings.Add("Local bending verification top: not ok " + ratio2_top.ToString("F2") + "%");

    if (m_z[bottom] < Mrd_bottom)
      verStrings.Add("Local bending verification bottom: ok " + ratio2_bottom.ToString("F2") + "%");
    else
      verStrings.Add("Local bending verification bottom: not ok " + ratio2_bottom.ToString("F2") + "%");

    // --- Walls under horizontal in-plane loads (NF EN 1996-1-1 §8.8.2) ---
    double fvk_val = fvk_reinf(fvk0, d_val, fb);
    double fvd_val = fvd_reinf(fvk_val, gamma_ms);
    double Vrd1_val = Vrd1_reinf(fvd_val, d_val, stone_thk);

    double ratio3_top = ratio3(Vrd1_val, v_z[top]);
    double ratio3_bottom = ratio3(Vrd1_val, v_z[bottom]);

    if (v_z[top] < Vrd1_val)
      verStrings.Add("Shear verification top: ok " + ratio3_top.ToString("F2") + "%");
    else
      verStrings.Add("Shear verification top: not ok " + ratio3_top.ToString("F2") + "%");

    if (v_z[bottom] < Vrd1_val)
      verStrings.Add("Shear verification bottom: ok " + ratio3_bottom.ToString("F2") + "%");
    else
      verStrings.Add("Shear verification bottom: not ok " + ratio3_bottom.ToString("F2") + "%");

    // --- Horizontal reinforcement verification ---
    double Asw_min_val = Asw_min_reinf(stone_thk, h_eff);
    int n_reinf_val = n_reinf(h_eff, stone_thk);
    double Asw_val = Asw_reinf(Asw_min_val, n_reinf_val);
    double smax_val = smax_reinf(stone_thk);
    double d2_val = d2_reinf(h_eff);
    double Vrd2_val = Vrd2_reinf(Asw_val, fyd, d2_val, smax_val);
    double check1_val = check1_reinf(Vrd1_val, Vrd2_val);
    double check2_val = check2_reinf(fds, stone_thk, d2_val);

    if (check1_val <= check2_val)
      verStrings.Add("Vrd1+Vrd2 ≤ 0.3*fds*stone_thk*d2: ok");
    else
      verStrings.Add("Vrd1+Vrd2 ≤ 0.3*fds*stone_thk*d2: not ok");

    double ratio4_top = ratio4_reinf(v_z[top], Vrd1_val, Vrd2_val);
    double ratio4_bottom = ratio4_reinf(v_z[bottom], Vrd1_val, Vrd2_val);

    if (v_z[top] < Vrd1_val + Vrd2_val)
      verStrings.Add("Horizontal load resistance with horizontal reinforcement top: ok " + ratio4_top.ToString("F2") + "%");
    else
      verStrings.Add("Horizontal load resistance with horizontal reinforcement top: not ok " + ratio4_top.ToString("F2") + "%");

    if (v_z[bottom] < Vrd1_val + Vrd2_val)
      verStrings.Add("Horizontal load resistance with horizontal reinforcement bottom: ok " + ratio4_bottom.ToString("F2") + "%");
    else
      verStrings.Add("Horizontal load resistance with horizontal reinforcement bottom: not ok " + ratio4_bottom.ToString("F2") + "%");

    // --- Vertical tie rods ---
    as_top = As_reinf(Asv_top);
    as_bot = As_reinf(Asv_bottom);
    verStrings.Add("Vertical reinforcement top - As: " + as_top.ToString("F2") + " mm²");
    verStrings.Add("Vertical reinforcement bottom - As: " + as_bot.ToString("F2") + " mm²");

    // Optionally, if shear ratios exceed 100, compute horizontal reinforcement thicknesses.
    if (Math.Max(ratio3_top, ratio3_bottom) > 100)
    {
      as_2 = Math.Ceiling(As2_reinf(Asw_min_val, d_val));
      verStrings.Add("Thickness of horizontal reinforcement in a bed joint: " + as_2.ToString("F2") + " mm");

      as_3 = Math.Ceiling(As3_reinf(Asw_val, E_mu));
      verStrings.Add("Thickness of horizontal reinforcement over the entire vertical cross-section: " + as_3.ToString("F2") + " mm");
    }
    else
    {
      verStrings.Add("No horizontal reinforcement");
    }

    // Determine overall pass/fail: for example, if any "not ok" message appears, we return false.
    // (Here we simply flag a failure if any ratio exceeds 100% or check conditions are not met.)
    bool crushOk = (sigma_d_top < fds) && (sigma_d_bottom < fds);
    bool bendingOk = (m_z[top] < Mrd_top) && (m_z[bottom] < Mrd_bottom);
    bool shearOk = (v_z[top] < Vrd1_val) && (v_z[bottom] < Vrd1_val);
    bool horzOk = (v_z[top] < Vrd1_val + Vrd2_val) && (v_z[bottom] < Vrd1_val + Vrd2_val);

    return crushOk && bendingOk && shearOk && horzOk;
  }
  private List<double> Absolute(List<double> toConvert)
  {
    List<double> result = new List<double>();
    foreach (double val in toConvert)
      result.Add(Math.Abs(val));
    return result;
  }

  private double Ma(double My, double N, double L)
  {
    return My + N * L / 2.0;
  }

  private double Mu(double Ma, double fds, double phi, double L, double t)
  {
    double result = (2 * Ma) / (fds * 1000 * phi * Math.Pow(L, 2) * t);
    return (result >= 1) ? 1 : result;
  }

  private double LcReinf(double Mu, double L)
  {
    return (Mu == 1) ? L : L * (1 - Math.Sqrt(1 - Mu));
  }

  private double D(double L)
  {
    double result = L - 2 * 0.2;
    return (result > 0) ? result : L;
  }

  private double E_su(double E_mu, double d, double Lc, double fyd)
  {
    double result = E_mu * (d - 1.25 * Lc) / (1.25 * Lc);
    return (result > 0) ? Math.Min(result, fyd / 200000.0) : fyd / 200000.0;
  }

  private double Asv_calc(double Lc, double t, double phi, double fds, double N, double E_su)
  {
    return Math.Abs((Lc * t * phi * fds - N / 1000.0) / (200000.0 * E_su));
  }

  private double Asv(double Asv_calc, double Asv_min)
  {
    return Math.Max(Asv_calc, Asv_min);
  }

  private double sigma_d(double N, double My, double L, double t)
  {
    return (N + My / L) / (L * t) / 1000.0;
  }

  private double ratio1(double sigma_d, double fds)
  {
    return sigma_d / fds;
  }

  private double dtr(double t)
  {
    return t + 0.01;
  }

  private double z(double dtr, double Asv, double fyd, double L, double nf, double fds)
  {
    double val = dtr * (1 - 0.5 * Asv * fyd / (L * dtr * nf * fds));
    return Math.Min(val, 0.9 * dtr);
  }

  private double Mrd(double Asv, double fyd, double z)
  {
    return Asv * 1000 * fyd * z;
  }

  private double ratio2(double Mz, double Mrd)
  {
    return Mz / Mrd;
  }

  private double fvk_reinf(double fvk0, double d, double fb)
  {
    return Math.Min(fvk0 + 0.4 * d, 0.065 * fb);
  }

  private double fvd_reinf(double fvk, double gamma_Ms)
  {
    return fvk / gamma_Ms;
  }

  private double Vrd1_reinf(double fvd, double d, double t)
  {
    return Math.Max(fvd * t * d * 1000, 0);
  }

  private double ratio3(double Vrd1, double Vz)
  {
    return (Vz / Vrd1) * 100;
  }

  private double Asw_min_reinf(double t, double Heff)
  {
    return 0.0005 * t * Heff;
  }

  private int n_reinf(double Heff, double t)
  {
    return (int)Math.Floor(Heff / t + 1);
  }

  private double Asw_reinf(double Asw_min, int n)
  {
    return Asw_min / n;
  }

  private double smax_reinf(double t)
  {
    return Math.Min(t, 0.6);
  }

  private double d2_reinf(double Heff)
  {
    return 0.95 * Heff;
  }

  private double Vrd2_reinf(double Asw, double fyd, double d2, double smax)
  {
    return 1000 * 0.6 * Asw * fyd * d2 / smax;
  }

  private double check1_reinf(double Vrd1, double Vrd2)
  {
    return Vrd1 + Vrd2;
  }

  private double check2_reinf(double fds, double t, double d2)
  {
    return 1000 * 0.3 * fds * t * d2;
  }

  private double ratio4_reinf(double Vz, double Vrd1, double Vrd2)
  {
    return Vz / (Vrd1 + Vrd2);
  }

  private double As_reinf(double Asv)
  {
    return Asv * 10000;
  }

  private double As2_reinf(double Asw_min, double d)
  {
    return (Asw_min / d) * 1000;
  }

  private double As3_reinf(double Asw, double E_mu)
  {
    return (Asw / E_mu) * 1000;
  }

  // The following helper methods for the unreinforced module are assumed to be defined already:
  private double Einit(double h_eff)
  {
    return h_eff / 450.0;
  }
# ---------- end calc ----------
scriptpar_3 = ScriptParasite(Enable=Toggle(True), Folder=c_script_3.a)

panel_7 = Panel(calc.verified)
max = Maximum(A=calc.As_top, B=calc.As_bottom)
smaller = SmallerThan(FirstNumber=max, SecondNumber=0.001)  # -> SmallerThan, OrEqualTo
sift = SiftPattern(List=max, SiftPattern=smaller.SmallerThan)  # -> Output0, Output1
panel_8 = Panel(max)
num = Number(expr("Round(x,2)", max))

# ---- group: Reinforcement Requirements
bnd = Bounds(Numbers=flatten(sift.Output0))
dedomain = DeconstructDomain(Domain=bnd)  # -> Start, End
gradient = Gradient(
    LowerLimit=dedomain.Start,
    UpperLimit=dedomain.End,
    Parameter=sift.Output0,
    stops=[0: RGB(255, 246, 161), 0.5: RGB(255, 140, 0), 1: RGB(255, 140, 0)])
material = CreateMaterial(Diffuse=gradient, Specular=RGB(255, 255, 255), Emission=RGB(0, 0, 0), Transparency=0, Shine=0)

# ----
py3_3 = Python3Script(T=calc.verified)  # -> out, a; inputs T: tree
# ---------- py3_3: Python ----------
import rhinoscriptsyntax as rs
import Rhino.Geometry as rg
import re
from Grasshopper import DataTree
from Grasshopper.Kernel.Data import GH_Path
from Grasshopper.Kernel.Types import IGH_Goo
from System import Object

# Initialize a new DataTree to store the concatenated text
new_text = DataTree[Object]()

# Loop through each branch in the DataTree
for i in range(T.BranchCount):
    branch_list = T.Branch(i)
    path = T.Path(i)  # Get the path of the current branch
    
    # Initialize a variable to store concatenated text
    concatenated_text = ""
    
    for j in range(branch_list.Count):
        text = branch_list[j]
        
        if j > 0:
            # Add a newline before appending if it's not the first entry
            concatenated_text += "\n" + text
        else:
            concatenated_text = text
    
    # Add the concatenated result to the new DataTree
    new_text.Add(concatenated_text, path)
a = new_text
# ---------- end py3_3 ----------
data_11 = Data(cap)
area = Area(Geometry=data_11)  # -> Area, Centroid

# ----
# Rebar List
number_slider_3 = Slider(3, range=0..10)
dia_mm = Panel("""4
5
6
7
8
10
12
14
16
20
25
32
40
50""")
section_cm2 = Panel("""0.126
0.196
0.283
0.385
0.50
0.79
1.13
1.54
2.01
3.14
4.91
8.04
12.57
19.63""")

annotation_dot = AnnotationDot(Location=area.Centroid, PrimaryText=num, TextHeight=Slider(13, range=0..100))  # -> AnnotationDot, Location, PrimaryText, SecondaryText, TextHeight, Font

# ---- group: Number of bars
series = Series(Start=2, Step=2, Count=number_slider_3)

# ----
py3_4 = Python3Script(rName=dia_mm, rArea=section_cm2, rCount=series)  # -> out, a; inputs rName: list of Int32, rArea: list of Double, rCount: list of Int32
# ---------- py3_4: Python ----------
import rhinoscriptsyntax as rs
import Rhino.Geometry as rg
import re
from Grasshopper import DataTree
from Grasshopper.Kernel.Data import GH_Path
from Grasshopper.Kernel.Types import IGH_Goo
from System import Object

rebar_dict = {}
for i in range(len(rCount)):
    rC = rCount[i]
    for j in range(len(rName)):
        rN = rName[j]
        rA = rArea[j]
        val = rC*rA
        if val > 3:
            name = f"{rC} of HA {rN}" 
            rebar_dict[name] = val
#print (rebar_dict)

# Sorting the rebar_dict based on values (val)
sorted_rebar_dict = {k: v for k, v in sorted(rebar_dict.items(), key=lambda item: item[1])}

# Print the sorted dictionary
for x in sorted_rebar_dict.keys():
  print(x)
class Data: 
    pass

reb_dict = Data()

reb_dict.result = sorted_rebar_dict
a = reb_dict
# ---------- end py3_4 ----------

# ---- group: Rebar Table
py3_5 = Python3Script(classDict=py3_4.a)  # -> out, a
# ---------- py3_5: Python ----------
import rhinoscriptsyntax as rs
import Rhino.Geometry as rg
import re
from Grasshopper import DataTree
from Grasshopper.Kernel.Data import GH_Path
from Grasshopper.Kernel.Types import IGH_Goo
from System import Object


test = []

avDict = classDict.result
for name in avDict:
    quant = avDict[name]
    test.append((name, quant))
a = test
# ---------- end py3_5 ----------

# ----
py3_6 = Python3Script(reqTree=num, classDict=py3_4.a)  # -> out, a, b; inputs reqTree: tree of Double
# ---------- py3_6: Python ----------
from System import Object
from Grasshopper import DataTree
from Grasshopper.Kernel.Data import GH_Path

finalTree = DataTree[Object]()
rebarTree = DataTree[Object]()
avDict = classDict.result  # Assuming this is a dictionary of available quantities

for i in range(reqTree.BranchCount):
    reqList = reqTree.Branch(i)
    path = reqTree.Path(i)
    for j in range(reqList.Count):
        req = reqList[j]
        if req is not None:
            # Initialize variables to store the closest match
            closest_name = None
            closest_quant = None
            min_diff = float('inf')  # Set initial minimum difference to a very large number

            for name in avDict:
                quant = avDict[name]
                diff = abs(quant - req)  # Calculate the absolute difference
                
                if diff < min_diff:  # Find the closest match
                    min_diff = diff
                    closest_name = name
                    closest_quant = quant

            # Add the closest matching (name, quant) to the final tree
            if closest_name is not None and closest_quant is not None:
                finalTree.Add((closest_name, closest_quant), path)
                rebar_names = closest_name.split(' ')
                print (rebar_names)
                rebarTree.Add(int(rebar_names[0]), path)
                rebarTree.Add(int(rebar_names[3]), path)

a = finalTree
b = rebarTree
# ---------- end py3_6 ----------
panel_9 = Panel(py3_5.a)
offset_from_edge_wall = Panel("100")
rebar_hole_dia = Panel("150")
number_dia = Panel(py3_6.b)
data_12 = Data(extrude_2.rect)
py3_7 = Python3Script(offDist=offset_from_edge_wall, holeDia=rebar_hole_dia, baseTree=data_12, rebarTree=py3_6.b)  # -> out, hole, rebar; inputs offDist: Int32, holeDia: Int32, baseTree: tree of Rectangle3d, rebarTree: tree of Int32
# ---------- py3_7: Python ----------
from System import Object
from Grasshopper import DataTree
from Grasshopper.Kernel.Data import GH_Path
import math
import Rhino.Geometry as rg

def CreateRebar(rectangle, offset_dist, hole_diam, rebar_rad, rebar_number):
    rect_crv = rectangle.ToPolyline() # crv is a polyline
    rect_poly = rect_crv.BreakAtAngles(math.pi/2)
    rect_poly_list = list(rect_poly)
    rect_poly_list.sort(key=lambda polyline: polyline.Length)
    rect_poly_list.pop(-1)
    rect_poly_list.pop(-1)
    rebars = []
    holes = []
    for edge in rect_poly_list: # these are the edges of the rectangle (Wall)
        edge_crv = edge.ToNurbsCurve() # edges are nurbs
        offset_edge = edge_crv.Offset(rg.Plane.WorldXY, -offset_dist, 0.001, rg.CurveOffsetCornerStyle.Sharp)[0]
        center = offset_edge.PointAt(0.5)
        hole = rg.Circle(center, hole_diam/2)
        holes.append(hole)

        if rebar_number == 2:
            reb_cir = rg.Circle(center, rebar_rad)
            rebars.append(reb_cir)

        elif rebar_number == 4:
            crv = hole.ToNurbsCurve()
            crv.Domain = rg.Interval(0,1)
            par = [0, 0.5]
            for t in par:
                pt = crv.PointAt(t)
                vec = center - pt
                vec.Unitize()
                scaled_vec = vec * rebarRad
                translation = rg.Transform.Translation(scaled_vec)
                pt.Transform(translation)
                reb_cir = rg.Circle(pt, rebarRad)
                rebars.append(reb_cir)

        elif rebar_number == 6:
            crv = hole.ToNurbsCurve()
            crv.Domain = rg.Interval(0,1)
            par = [0, 0.333, 0.666]
            for t in par:
                pt = crv.PointAt(t)
                vec = center - pt
                vec.Unitize()
                scaled_vec = vec * rebarRad
                translation = rg.Transform.Translation(scaled_vec)
                pt.Transform(translation)
                reb_cir = rg.Circle(pt, rebarRad)
                rebars.append(reb_cir)

        elif rebar_number == 8:
            crv = hole.ToNurbsCurve()
            crv.Domain = rg.Interval(0,1)
            par = [0, 0.25, 0.5, 0.75]
            for t in par:
                pt = crv.PointAt(t)
                vec = center - pt
                vec.Unitize()
                scaled_vec = vec * rebarRad
                translation = rg.Transform.Translation(scaled_vec)
                pt.Transform(translation)
                reb_cir = rg.Circle(pt, rebarRad)
                rebars.append(reb_cir)

    return holes, rebars
#######################################################   
# INPUTS    
#######################################################
minCover = 0.015
offset_dist_m = offDist/1000
hole_dia_m = holeDia/1000
print (offset_dist_m)
holeCirTree = DataTree[Object]()
rebarCirTree = DataTree[Object]()

for i in range(baseTree.BranchCount):
    baseList = baseTree.Branch(i)
    rebarList = rebarTree.Branch(i)
    path = baseTree.Path(i)
    for j in range(baseList.Count):
        rect = baseList[j] # base is a rectangle
        rebarNum = rebarList[j]
        rebarDia = rebarList[j+1]/1000 # converted to m
        rebarRad = rebarDia/2
        offset_dist = offset_dist_m + (hole_dia_m / 2)

        if rebarNum == 2: # only one rebard per side
            reb_circles = CreateRebar(rect, offset_dist, hole_dia_m, rebarRad, rebarNum)
            holeCirTree.AddRange(reb_circles[0], path)
            rebarCirTree.AddRange(reb_circles[1], path)

        elif rebarNum == 4: # two rebard per side
            reb_circles = CreateRebar(rect, offset_dist, hole_dia_m, rebarRad, rebarNum)
            holeCirTree.AddRange(reb_circles[0], path)
            rebarCirTree.AddRange(reb_circles[1], path)

        elif rebarNum == 6: # two rebard per side
            reb_circles = CreateRebar(rect, offset_dist, hole_dia_m, rebarRad, rebarNum)
            holeCirTree.AddRange(reb_circles[0], path)
            rebarCirTree.AddRange(reb_circles[1], path)
        
        elif rebarNum == 8: # two rebard per side
            reb_circles = CreateRebar(rect, offset_dist, hole_dia_m, rebarRad, rebarNum)
            holeCirTree.AddRange(reb_circles[0], path)
            rebarCirTree.AddRange(reb_circles[1], path)


hole = holeCirTree
rebar = rebarCirTree
# ---------- end py3_7 ----------
data_13 = Data(extrude_2.height)
extr = Extrude(Base=py3_7.hole, Direction=data_13)
extr_2 = Extrude(Base=py3_7.rebar, Direction=data_13)
data_14 = Data(toggle_2)
panel_10 = Panel("""Clicker
Mover
Selector
Dotter
Texter""")
clean = CleanTree(RemoveNulls=True, RemoveInvalid=True, RemoveEmpty=True, Tree=data_11)
c_script_4 = CSharpScript(active=data_14, nickNames=panel_10)  # -> out, a; inputs active: Boolean, nickNames: tree of String
# ---------- c_script_4: C# ----------
// Grasshopper Script Instance
#region Usings
using System;
using System.Linq;
using System.Collections;
using System.Collections.Generic;
using System.Drawing;

using Rhino;
using Rhino.Geometry;

using Grasshopper;
using Grasshopper.Kernel;
using Grasshopper.Kernel.Data;
using Grasshopper.Kernel.Types;
#endregion

public class Script_Instance : GH_ScriptInstance
{
    #region Notes
    /* 
      Members:
        RhinoDoc RhinoDocument
        GH_Document GrasshopperDocument
        IGH_Component Component
        int Iteration

      Methods (Virtual & overridable):
        Print(string text)
        Print(string format, params object[] args)
        Reflect(object obj)
        Reflect(object obj, string method_name)
    */
    #endregion

    private void RunScript(bool active, DataTree<string> nickNames, ref object a)
    {
        _nickNames = nickNames;
        _active = active;
        GrasshopperDocument.ScheduleSolution(5, Callback);
    }
    private DataTree<string> _nickNames;
    private bool _active;
    private void Callback(GH_Document doc)
    {
        foreach(var obj in GrasshopperDocument.ActiveObjects())
        if(_nickNames.AllData().Contains(obj.NickName))
        {
            obj.Locked = !_active;
            
            obj.ExpireSolution(false);
        }
    }
}
# ---------- end c_script_4 ----------
swatch_3 = ColourSwatch(SwatchColor=RGB(255, 255, 255))
entwine_5 = Entwine(
    Branch00=ColourSwatch(SwatchColor=RGB(201, 201, 201)),
    Branch01=ColourSwatch(SwatchColor=RGB(255, 255, 255)),
    Branch02=swatch_3,
    Branch03=swatch_3,
    FlattenInputs=True)  # -> simplify(Result)
clean_2 = CleanTree(RemoveNulls=True, RemoveInvalid=True, RemoveEmpty=True, Tree=extrude_2.D)

# ---- group: Hole
# Reservation Geo
swatch_4 = ColourSwatch(SwatchColor=RGBA(240, 240, 240, 133))
preview_2 = CustomPreview(Geometry=extr, Material=swatch_4)

# ---- group: Rebar
# Rebar Geo
swatch_5 = ColourSwatch(SwatchColor=RGB(0, 0, 0))
preview_3 = CustomPreview(Geometry=extr_2, Material=swatch_5)

# ----
# Rigid Wall
py3_8 = Python3Script(Brep=clean_2, FaceColor=entwine_5, EdgeColor=ColourSwatch(SwatchColor=RGB(0, 0, 0)), EdgeWidth=Slider(0, range=0..10))  # -> out, a; inputs Brep: tree of Brep, FaceColor: tree
# ---------- py3_8: Python ----------
"""Grasshopper Script"""
import System
import Rhino
import Grasshopper
import Rhino.Geometry as rg
import Rhino as rc
from System.Drawing import Color

class MyComponent(Grasshopper.Kernel.GH_ScriptInstance):
    def __init__(self):
        super().__init__()
        self.original_heights = {}  # To store the original height of each Brep by its path

    def RunScript(self,
            Brep: Grasshopper.DataTree[Rhino.Geometry.Brep],
            FaceColor: Grasshopper.DataTree[object],
            EdgeColor,
            EdgeWidth):
        
        # Assign input parameters
        self.brep = Brep
        self.edgeColor = EdgeColor
        self.edgeWidth = EdgeWidth
        self.faceColor = FaceColor

    # Preview overrides 
    def DrawViewportMeshes(self, arg):
        for branch_index in range(self.brep.BranchCount):
            meshList = self.brep.Branch(branch_index)
            color = self.faceColor.Branch(branch_index)[0]

            path = self.brep.Path(branch_index)
            for j in range(len(meshList)):
                brep = meshList[j]
                mater = rc.Display.DisplayMaterial()
                mater.Emission = color
                arg.Display.DrawBrepShaded(brep, mater)

    def DrawViewportWires(self, arg):
        for branch_index in range(self.brep.BranchCount):
            meshList = self.brep.Branch(branch_index)
            path = self.brep.Path(branch_index)
            for j in range(len(meshList)):
                brep = meshList[j]
                edges = brep.Edges  # Get the edges of the Brep

                # Draw each edge of the Brep as a curve
                for edge in edges:
                    arg.Display.DrawCurve(edge, self.edgeColor, self.edgeWidth)
# ---------- end py3_8 ----------

# ----
# Non-reinforced Wall
preview_4 = CustomPreview(Geometry=sift.Output1, Material=ColourSwatch(SwatchColor=RGB(255, 255, 255)))

data_15 = Data(data_11)
smesh = SimpleMesh(Brep=data_15)
cap_2 = CapHoles(Brep=extr)
mover = Python3Script(Meshes=smesh)  # -> Index, Mesh, a; inputs Meshes: tree of Mesh; disabled
# ---------- mover: Python ----------
import Rhino as rc
from ghpythonlib.componentbase import executingcomponent as component 
from Grasshopper import DataTree
from Grasshopper.Kernel.Data import GH_Path
import Rhino
import Grasshopper

class MyMouseCallback(rc.UI.MouseCallback):
    
    def __init__(self):
        super(MyMouseCallback, self).__init__()
        self.move = None  # To store mouse movement event
        
    def OnMouseMove(self, arg):
        """Trigger Grasshopper component expiration on mouse movement."""
        self.move = arg
        ghenv.Component.ExpireSolution(True)  # Request solution expiration for updates

class MyComponent(component):

    def RunScript(self, Meshes: Grasshopper.DataTree[Rhino.Geometry.Mesh]):


        # Get mouse viewport position
        mpt = rc.RhinoDoc.ActiveDoc.Views.ActiveView.ScreenToClient(rc.UI.MouseCursor.Location)
        
        # Make ray along frustum line at mouse position
        r, fl = rc.RhinoDoc.ActiveDoc.Views.ActiveView.ActiveViewport.GetFrustumLine(mpt.X, mpt.Y)
        ray = rc.Geometry.Ray3d(fl.From, fl.Direction)
        
        # Shot ray onto meshes in the DataTree
        hits = []
        for branch_index in range(Meshes.BranchCount):
            mesh_list = Meshes.Branch(branch_index)  # Get the list of meshes in the branch
            path = Meshes.Path(branch_index)  # Get the current branch path

            # Iterate through the meshes in the branch
            for i, m in enumerate(mesh_list):
                t = rc.Geometry.Intersect.Intersection.MeshRay(m, ray)
                if t >= 0.0:  # If intersection occurs
                    hits.append((t, path, i, m))  # Record the hit with distance, path, and mesh index
        
        # Get the closest hit and return the path and mesh index
        if hits:
            hits.sort(reverse=False)  # Sort hits by distance (smallest first for closest hit)
            t, path, index, m = hits[0]  # Get the closest mesh
            return path, index, m  # Return the branch path, mesh index, and mesh
        else:
            return None, None, None  # No hit

    def __enter__(self):

        """Enable mouse tracking when the component starts."""
        self.mouse = MyMouseCallback()
        self.mouse.Enabled = True
        
    def __exit__(self, exc_type, exc_val, exc_tb):
        """Disable mouse tracking when the component ends."""
        self.mouse.Enabled = False
        del self.mouse
# ---------- end mover ----------
data_16 = Data(material)

clean_3 = CleanTree(RemoveNulls=True, RemoveInvalid=True, RemoveEmpty=True, Tree=cap_2)
clicker = Python3Script(Meshes=smesh)  # -> Index, Mesh; inputs Meshes: tree of Mesh; disabled
# ---------- clicker: Python ----------
import Rhino as rc
from ghpythonlib.componentbase import executingcomponent as component
import System.Windows.Forms as WinForms
import Grasshopper
import Rhino 
class MyMouseCallback(rc.UI.MouseCallback):
    def __init__(self):
        super(MyMouseCallback, self).__init__()
        self.click = None
        
    def OnMouseDown(self, arg):
        if arg.Button == WinForms.MouseButtons.Left:
            self.click = arg
            # Force re-run of the script so we can process the click
            ghenv.Component.ExpireSolution(True)


class MyComponent(component):
    def __init__(self):
        super().__init__()
        
        # Store last-selected mesh
        self.selected_mesh_info = None  
        self.mouse = None

    def RunScript(self, Meshes: Grasshopper.DataTree[Rhino.Geometry.Mesh]):
        # 1) Initialize the mouse callback if not present
        if not self.mouse:
            self.mouse = MyMouseCallback()
            self.mouse.Enabled = True

        # 2) If no new click but we do have a stored selection
        if self.mouse.click is None and self.selected_mesh_info is not None:
            path, m = self.selected_mesh_info
            return path, m

        # 3) If a click happened...
        if self.mouse.click is not None:
            viewport_point = self.mouse.click.ViewportPoint
            if viewport_point is None:
                return None, None

            # Convert 2D screen point to 3D ray
            r, fl = rc.RhinoDoc.ActiveDoc.Views.ActiveView.ActiveViewport.GetFrustumLine(
                viewport_point.X, viewport_point.Y
            )
            ray = rc.Geometry.Ray3d(fl.From, fl.Direction)

            # Check for hits
            hits = []
            for branch_index in range(Meshes.BranchCount):
                meshList = Meshes.Branch(branch_index)
                path = Meshes.Path(branch_index)
                for j, m in enumerate(meshList):
                    t = rc.Geometry.Intersect.Intersection.MeshRay(m, ray)
                    if t >= 0.0:
                        hits.append((t, path, m))

            # Return the closest
            if hits:
                hits.sort(key=lambda x: x[0])
                _, path, m = hits[0]
                self.selected_mesh_info = (path, m)
            
            self.mouse.click = None
            return path, m

        return None, None

    def __enter__(self):
        # Enable mouse callback
        self.mouse = MyMouseCallback()
        self.mouse.Enabled = True

    def __exit__(self, exc_type, exc_val, exc_tb):
        # Disable it on exit
        if self.mouse:
            self.mouse.Enabled = False
            self.mouse = None
# ---------- end clicker ----------
filter_4 = StreamFilter(Gate=data_14, Stream1=clicker.Index)
pshift_3 = ShiftPaths(Data=data_16, Offset=-1)

sdiff = SolidDifference(BrepsA=clean, BrepsB=clean_3)
split = SplitTree(Data=sdiff, Masks=flatten(filter_4))  # -> Positive, Negative
split_2 = SplitTree(Data=pshift_3, Masks=flatten(filter_4))  # -> Positive, Negative

filter_5 = StreamFilter(Gate=data_14, Stream1=mover.Index)

# ---- group: Pre-selection border
# Dotted Highlighter
number_slider_4 = Slider(0.05, range=0..10)
bbox = BoundingBox(Content=smesh, Plane=PlaneXY(0, 0, 0))  # -> Box, Box_2
py3_9 = Python3Script(B=bbox.Box, O=number_slider_4)  # -> a; inputs B: Box, O: Double
# ---------- py3_9: Python ----------
import Rhino.Geometry as rg

B.Inflate(O)
a = B
# ---------- end py3_9 ----------
pshift_4 = ShiftPaths(Data=py3_9, Offset=-1)
split_3 = SplitTree(Data=pshift_4, Masks=flatten(filter_5))  # -> Positive, Negative
edges = BrepEdges(Brep=split_3.Positive)  # -> Naked, Interior, NonManifold
dotter = Python3Script(Lines=edges.Interior, Color=ColourSwatch(SwatchColor=RGB(255, 255, 255)), Width=Slider(2, range=0..10))  # -> out, a; inputs Lines: list of Line; disabled
# ---------- dotter: Python ----------
"""Grasshopper Script"""
import System
import Rhino
import Grasshopper
import Rhino.Display as rd

import rhinoscriptsyntax as rs

class MyComponent(Grasshopper.Kernel.GH_ScriptInstance):
    def RunScript(self,
            Lines: System.Collections.Generic.List[Rhino.Geometry.Line],
            Color,
            Width):
        
        self.lines = Lines
        #self.color = Color
        pattern = [0.1,0.1]
        self.pen = rd.DisplayPen ()
        self.pen.SetPattern(pattern)
        self.pen.Thickness = Width
        ''' self.pen.HaloColor = Color
        self.pen.HaloThickness = 1 '''

    # Preview overrides 
    @property
    def ClippingBox(self):
        return Rhino.Geometry.BoundingBox.Empty

    def DrawViewportWires(self, args):
        pass

    def DrawViewportMeshes(self, args):
         # Convert List to an array (Rhino.Geometry.Line[])
        if self.lines:
            lines_array = self.lines.ToArray()
            args.Display.DrawLines(lines_array, self.pen)
# ---------- end dotter ----------

# ---- group: Verification Text
data_17 = Data(py3_3.a)
pshift_5 = ShiftPaths(Data=data_17, Offset=-2)
split_4 = SplitTree(Data=pshift_5, Masks=flatten(filter_4))  # -> Positive, Negative
pt = ConstructPoint(XCoordinate=Slider(0, range=0..1), YCoordinate=Slider(0.35, range=0..1), ZCoordinate=0)
texter = Python3Script(T=split_4.Positive, C=ColourSwatch(SwatchColor=RGB(0, 0, 0)), H=Slider(25, range=0..100), P=pt)  # -> out, a; inputs T: String, C: Color, H: Int32, P: Point3d; disabled
# ---------- texter: Python ----------
"""Grasshopper Script"""
import System
import Rhino
import Grasshopper

import rhinoscriptsyntax as rs

class MyComponent(Grasshopper.Kernel.GH_ScriptInstance):
    def RunScript(self,
            T: str,
            C: System.Drawing.Color,
            H: int,
            P: Rhino.Geometry.Point3d):
        self.t = T
        self.c = C

        self.h = H
        self.f = "Arial"

        main_window = Rhino.UI.RhinoEtoApp.MainWindow
        screen_rect = main_window.Bounds
        self.p = Rhino.Geometry.Point2d(screen_rect.Width*P.X, screen_rect.Height*P.Y)
        #self.p = Rhino.Geometry.Point2d(P.X, P.Y)
        


    def DrawViewportWires(self, args):

        args.Display.Draw2dText(self.t,self.c,
        self.p,False,self.h,self.f)

        #args.Display.DrawDot(self.l, self.t, self.dC, self.tC)
# ---------- end texter ----------

# ---- group: Scale
py3_10 = Python3Script(B=split.Positive)  # -> out, a; inputs B: Brep
# ---------- py3_10: Python ----------
import System
import Rhino
import Grasshopper
import Rhino.Geometry as rg

scale_factor = 0.5
bbox = B.GetBoundingBox(rg.Plane.WorldXY)
corner = bbox.GetCorners()[0]
pl = rg.Plane(corner, rg.Plane.WorldXY.XAxis, rg.Plane.WorldXY.YAxis)
scale = rg.Transform.Scale(pl, 1, 1, scale_factor) 
B.Transform(scale)

a = B
# ---------- end py3_10 ----------

# ---- group: Custom Preview + Scale down
# Selected Scaled Wall
number_slider_5 = Slider(10, range=0..10)
selector = Python3Script(
    Brep=py3_10.a,
    Material=split_2.Positive,
    EdgeColor=ColourSwatch(SwatchColor=RGB(0, 0, 0)),
    EdgeWidth=number_slider_5,
    SelPath=filter_4)  # -> out, a; inputs Brep: tree of Brep, Material: tree; disabled
# ---------- selector: Python ----------
"""Grasshopper Script"""
import System
import Rhino
import Grasshopper
import Rhino.Geometry as rg

class MyComponent(Grasshopper.Kernel.GH_ScriptInstance):
    def __init__(self):
        self.original_heights = {}  # To store the original height of each Brep by its path
        self.scaled_paths = set()  # To store paths of Breps that have already been scaled


    def RunScript(self,
            Brep: Grasshopper.DataTree[Rhino.Geometry.Brep],
            Material: Grasshopper.DataTree[object],
            EdgeColor,
            EdgeWidth,
            SelPath):
        
        # Assign input parameters
        self.brep = Brep
        self.edgeColor = EdgeColor
        self.edgeWidth = EdgeWidth
        self.material = Material
        self.selPath = SelPath

    # Preview overrides 
    def DrawViewportMeshes(self, arg):
        for branch_index in range(self.brep.BranchCount):
            meshList = self.brep.Branch(branch_index)
            matList = self.material.Branch(branch_index)

            path = self.brep.Path(branch_index)
            for j in range(len(meshList)):
                brep = meshList[j]
                mater = matList[j]

                # Check if the current Brep matches the selected path from the mouse click
                if self.selPath == path:
                    # Get the current bounding box height (Z dimension)
                    bbox = brep.GetBoundingBox(rg.Plane.WorldXY)
                    current_height = bbox.Max.Z - bbox.Min.Z

                    # Store the original height if it hasn't been stored yet
                    if path not in self.original_heights:
                        self.original_heights[path] = current_height

                    original_height = self.original_heights[path]

                     # Scale down the Brep to exactly 0.5 of its original height, only once
                    if path not in self.scaled_paths:
                        if current_height > 0.5 * original_height:
                            # Perform immediate scaling to 0.5 * original height
                            scale_factor = 0.5 * original_height / current_height
                            corner = bbox.GetCorners()[0]
                            pl = rg.Plane(corner, rg.Plane.WorldXY.XAxis, rg.Plane.WorldXY.YAxis)
                            scale = rg.Transform.Scale(pl, 1, 1, scale_factor)  # Scale directly to 0.5 * original height
                            brep.Transform(scale)

                        # Mark this path as scaled
                        self.scaled_paths.add(path)

                # Draw the shaded Brep with the current material
                arg.Display.DrawBrepShaded(brep, mater)

'''     def DrawViewportWires(self, arg):
        for branch_index in range(self.brep.BranchCount):
            meshList = self.brep.Branch(branch_index)
            path = self.brep.Path(branch_index)
            for j in range(len(meshList)):
                brep = meshList[j]
                edges = brep.Edges  # Get the edges of the Brep

                # Draw each edge of the Brep as a curve
                for edge in edges:
                    arg.Display.DrawCurve(edge, self.edgeColor, self.edgeWidth)
 '''
# ---------- end selector ----------

# ----
volume = Volume(Geometry=split.Positive)  # -> Volume, Centroid

# ---- group: Steel Chosen
# Selected Rebar
split_5 = TextSplit(Text=py3_6.a, Separators="(,)")
item_2 = ListItem(List=split_5, Index=1, Wrap=True)
pshift_6 = ShiftPaths(Data=item_2, Offset=-2)
split_6 = SplitTree(Data=area.Centroid, Masks=flatten(filter_4))  # -> Positive, Negative
split_7 = SplitTree(Data=pshift_6, Masks=flatten(filter_4))  # -> Positive, Negative
text_dot = Python3Script(
    L=volume.Centroid,
    T=split_7.Positive,
    H=Slider(13, range=0..100),
    DC=ColourSwatch(SwatchColor=RGB(0, 153, 255)),
    TC=ColourSwatch(SwatchColor=RGB(255, 255, 255)))  # -> out, a; inputs L: tree of Point3d, T: tree of String, H: Int32, DC: Color, TC: Color
# ---------- text_dot: Python ----------
import Rhino
import Rhino.Geometry as rg
import Grasshopper
import System.Drawing

class MyComponent(Grasshopper.Kernel.GH_ScriptInstance):
    # Static class variable to track event subscription
    subscribed = False

    def __init__(self):
        # We'll store references to the data and colors
        self.l = None
        self.t = None
        self.h = 0
        self.dC = System.Drawing.Color.Black
        self.tC = System.Drawing.Color.White

    def RunScript(self,
            L: Grasshopper.DataTree[Rhino.Geometry.Point3d],
            T: Grasshopper.DataTree[str],
            H: int,
            DC: System.Drawing.Color,
            TC: System.Drawing.Color):
        """
        This method runs once per Grasshopper solution. We store data for later
        use in the drawForeground event and subscribe to that event if not already done.
        """
        self.l = L
        self.t = T
        self.h = H
        self.dC = DC
        self.tC = TC

        # Subscribe to the DrawForeground event only once
        if not MyComponent.subscribed:
            Rhino.Display.DisplayPipeline.DrawForeground += self.drawForeground
            MyComponent.subscribed = True

    def drawForeground(self, sender, e):
        """
        This callback is invoked by Rhino's display pipeline AFTER all normal
        geometry is drawn, so the text will appear in the foreground.
        """
        if self.l is None or self.t is None:
            return

        # Loop through branches and items
        for i in range(self.l.BranchCount):
            points = self.l.Branch(i)
            texts = self.t.Branch(i)
            for j in range(len(points)):
                pt = points[j]
                txt = texts[j]
                dot = rg.TextDot(txt, pt)
                dot.FontHeight = self.h
                # DrawDot automatically creates a bubble/dot style
                e.Display.DrawDot(dot, self.dC, self.tC, System.Drawing.Color.Black)

    def __del__(self):
        """
        Destructor called when Grasshopper discards this script instance.
        Unsubscribe from the event so we don't keep drawing after the script is gone.
        """
        if MyComponent.subscribed:
            Rhino.Display.DisplayPipeline.DrawForeground -= self.drawForeground
            MyComponent.subscribed = False
# ---------- end text_dot ----------

# ---- group: Dont Use
preview_5 = CustomPreview(Geometry=py3_10.a, Material=split_2.Positive)

# ----
filter_6 = StreamFilter(Gate=data_14, Stream0=split_4.Negative, Stream1=split_4.Positive)

# ----
# Unselected Wall
preview_6 = CustomPreview(Geometry=split.Negative, Material=split_2.Negative)

# ==== cluster Cluster_3
domain_x = ClusterInput()
domain_y = ClusterInput()
D = ClusterInput()
num = ClusterInput()
z_orient = ClusterInput()
line = ClusterInput()
geo = ClusterInput()
f_x = ClusterInput()
Y = ClusterInput()
crv = ClusterInput()
num_2 = ClusterInput()
num_3 = ClusterInput()
num_4 = ClusterInput()
data = ClusterInput()
num_5 = ClusterInput()
domain_x_2 = Data(domain_x)
domain_y_2 = Data(domain_y)
z_orient_2 = Vector(z_orient)
line_2 = Geometry(line)
X = Number(f_x)
crv_2 = Geometry(crv)
num_6 = Number(num_2)
num_7 = Number(num_3)
num_8 = Number(num_4)
Y_2 = Number(Y)
num_9 = Number(num_5)
geo_2 = Geometry(geo)
split = SplitTree(Data=simplify(D), Masks=flatten("{3}"))  # -> Positive, Negative
data_2 = Data(data)
num_10 = Number(num)
data_3 = Data(D)
entwine = Entwine(Branch00=num_7, Branch01=num_8, FlattenInputs=True)
entwine_2 = Entwine(Branch00=num_6, Branch01=num_9, FlattenInputs=True)
split_2 = SplitTree(Data=line_2, Masks=flatten("{3}"))  # -> Positive, Negative
split_3 = SplitTree(Data=z_orient_2, Masks=flatten("{3}"))  # -> Positive, Negative
split_4 = SplitTree(Data=domain_x_2, Masks=flatten("{3}"))  # -> Positive, Negative
split_5 = SplitTree(Data=domain_y_2, Masks=flatten("{3}"))  # -> Positive, Negative
data_4 = Data(line_2)
data_5 = Data(z_orient_2)
data_6 = Data(domain_x_2)
data_7 = Data(domain_y_2)
cluster = Cluster(I=split_4.Negative)
cluster_2 = Cluster(I=split_5.Negative)
concat = Concatenate(FragmentA=cluster, FragmentB=cluster_2, JoinSeparator="/")

# ----
# 1 as cross-sec dim is creating problems
panel = Panel("10")

num_11 = Number(expr("x*100", cluster_2))
equals = Equality(FirstNumber=num_11, SecondNumber=0)  # -> Equality, Inequality
sift = SiftPattern(List=num_11, SiftPattern=equals.Equality)  # -> Output0, Output1
rep = ReplaceText(Text=sift.Output1, Find="0", Replace=panel, RecursiveReplace=False)
combine = CombineData(Input0=sift.Output0, Input1=rep)  # -> Result, Index
long = LongestList(ListB=split_2.Negative, ListC=split.Negative, PaddingMode=2)  # -> ListB, ListC
num_12 = Number(expr("x*100", cluster))
split_6 = SplitTree(Data=long.ListC, Masks=flatten("{3}"))  # -> Positive, Negative
line_3 = Geometry(graft(split_2.Negative))
crosec = CrossSectionKaramba3D(
    FamilyNameOfCrossSection=concat,
    Material=split_6.Negative,
    Height_cm=combine.Result,
    UpperFlangeWidth_cm=num_12,
    LowerFlangeWidth_cm=num_12,
    mode="Trapezoid")  # -> simplify(CrossSection)
llinter = LineLineIntersectionKaramba3D(IntersectingLines=flatten(line_3), LinesToIntersect=line_3, LimitDistance_m=0.005)  # -> InterSecPoints, LineSubSegments
data_8 = Data(graft(split_3.Negative))
match = MatchTree(Tree=llinter.LineSubSegments, Guide=line_3)
data_9 = Data(graft(crosec))
py3 = Python3Script(myTree=match)  # -> out, a; inputs myTree: tree of Line
# ---------- py3: Python ----------
import Rhino.Geometry as rg 
from Grasshopper import DataTree
from Grasshopper.Kernel.Data import GH_Path
from System import Object
from enum import Enum

# Enum for materials
class Material(Enum):
    conc = 0
    stone_deformable = 1
    stone_rigid = 2
    inf_rigid = 3

# Initialize the DataTree to store results
beamid_tree = DataTree[Object]()

# Loop through branches in myTree
elem_no = 0
for i in range(myTree.BranchCount):
    # Get the branch list and path
    branch_list = myTree.Branch(i)
    path = myTree.Path(i)
    
    # Check if the path has enough indices to access
    if len(path.Indices) < 2:
        print(f"Path {i} does not have enough indices, skipping.")
        continue
    
    # Get the first index of the path for Material comparison
    path_0 = path.Indices[0]
    
    # Map the path index to Material type
    if path_0 == Material.conc.value:
        val = "CO"
    elif path_0 == Material.stone_deformable.value:
        val = "SD"
    elif path_0 == Material.stone_rigid.value:
        val = "SR"
    elif path_0 == Material.inf_rigid.value:
        val = "IR"
    else:
        print(f"Unknown material type for path index: {path_0}, skipping.")
        continue

    # Generate beam ID for each item in the branch
    for j in range(len(branch_list)):
        # Ensure that path.Indices[1] exists
        path_1 = path.Indices[1]
        beamid = val + "-{0}-{1}".format(path_1, j)
        beamid_tree.Add(beamid, path)

# Assign the final tree to output
a = beamid_tree
# ---------- end py3 ----------
long_2 = LongestList(ListA=match, ListB=data_9, ListC=data_8, PaddingMode=2)  # -> ListA, ListB, ListC
linetobeam = LineToBeamKaramba3D(
    Line=match,
    Identifier=py3.a,
    CrossSection=long_2.ListB,
    New=True,
    Remove=True,
    LimitDistance_m=0.005,
    ZOrientation=long_2.ListC,
    Bending=True,
    SetBucklingLength=True,
    ToPolylineMaxAngle=0.03,
    ToPolylineTolerance=0.01,
    ToPolylineMaxEdgeLength=0.25)  # -> simplify(Element), Points, Info

number_slider = Slider(10000, range=0..10000)
number_slider_2 = Slider(10000, range=0..10000)
number_slider_3 = Slider(0, range=0..100)
panel_2 = Panel("10000000")
vec = VectorXYZ(XComponent=number_slider_2, YComponent=number_slider_2, ZComponent=number_slider_2)  # -> Vector, Length
vec_2 = VectorXYZ(XComponent=number_slider, YComponent=number_slider, ZComponent=number_slider)  # -> Vector, Length
crosec_2 = CrossSectionKaramba3D(
    FamilyNameOfCrossSection="Rigid",
    NameOfCrossSection="Spring",
    CTranslation_kN_m=vec_2.Vector,
    CRotation_kNm_rad=vec.Vector,
    mode="Spring")
split_7 = SplitTree(Data=crosec, Masks=flatten("{2}"))  # -> Positive, Negative
match_2 = MatchTree(Tree=crosec_2, Guide=split_7.Positive)
long_3 = LongestList(ListA=split_7.Positive, ListB=match_2, PaddingMode=2)  # -> ListA, ListB
merge = Merge(Data1=split_7.Negative, Data2=long_3.ListB)

data_10 = Data(long.ListC)
panel_4 = Panel(crosec)
pshift = ShiftPaths(Data=match, Offset=-1)
cs = CSharpScript(T=pshift, i=Slider(2, range=0..10))  # -> out, a; inputs T: tree, i: Int32
# ---------- cs: C# ----------
// Grasshopper Script Instance
#region Usings
using System;
using System.Collections;
using System.Collections.Generic;
using System.Drawing;

using Rhino;
using Rhino.Geometry;

using Grasshopper;
using Grasshopper.Kernel;
using Grasshopper.Kernel.Data;
using Grasshopper.Kernel.Types;
#endregion

public class Script_Instance : GH_ScriptInstance
{
    #region Notes
    /* 
      Members:
        RhinoDoc RhinoDocument
        GH_Document GrasshopperDocument
        IGH_Component Component
        int Iteration

      Methods (Virtual & overridable):
        Print(string text)
        Print(string format, params object[] args)
        Reflect(object obj)
        Reflect(object obj, string method_name)
    */
    #endregion

    private void RunScript(DataTree<object> T, int i, ref object a)
    {
        int count = T.BranchCount;
        if (i<0 || i> count -1)
        {
            this.Component.AddRuntimeMessage(GH_RuntimeMessageLevel.Error, "Index must be smaller than the branch count");
            return;
        }

        DataTree<object> outTree = new DataTree<object>(); 
        GH_Path path = T.Paths[i];
        List<object> branchList = T.Branches[i];

        outTree.AddRange(branchList, path);
        
        a = outTree;
        IGH_Component igc = this.Component as IGH_Component;
        igc.Message = path.ToString();
        //a = outTree;

        
    }
}
# ---------- end cs ----------

data_11 = Data(graft(match))
data_12 = Data(crv_2)
midpt = CurveMiddle(Curve=data_12)  # -> graft(Midpoint)
midpt_2 = CurveMiddle(Curve=data_11)  # -> flatten(Midpoint)
cps = ClosestPoints(Point=midpt, Cloud=midpt_2, Count=1)  # -> ClosestPoint, flatten(CPIndex), Distance
item = ListItem(List=flatten(py3.a), Index=cps.CPIndex, Wrap=True)
match_3 = MatchTree(Tree=graft(item), Guide=midpt)
pshift_2 = ShiftPaths(Data=match_3, Offset=-1)

# ---- group: Brep at floor
data_13 = Data(geo_2)

# ---- group: vert+hori lines
data_14 = Data(match)

# ----
brep = Brep(graft(data_13))
fmerge = MergeFaces(Brep=brep)  # -> Breps, Before, After
explode = Explode(Curve=data_14, Recursive=True)  # -> Segments, flatten(Vertices)
area = Area(Geometry=fmerge.Breps)  # -> Area, Centroid
pdecon = Deconstruct(Point=explode.Vertices)  # -> XComponent, YComponent, ZComponent
pdecon_2 = Deconstruct(Point=area.Centroid)  # -> XComponent, YComponent, ZComponent
element = ElementKaramba3D(flatten(linetobeam.Element))
mindex = MemberIndex(Set=pdecon.ZComponent, Member=pdecon_2.ZComponent)  # -> Index, Count
item_2 = ListItem(List=explode.Vertices, Index=mindex.Index, Wrap=True)
multiplication = Multiplication(A=num_10, B=100)
panel_5 = Panel("0.1")
mesh_breps = MeshBrepsKaramba3D(
    Brep=fmerge.Breps,
    InclusionPoints=item_2,
    MeshResolution=1,
    EdgeRefinementFactor=0.67,
    PointReduction=False,
    SmoothingStepSize=0,
    SmoothingIterations=5)  # -> Mesh, Info

# ---- group: Cross Section (Karamba3D)
crosec_3 = CrossSectionKaramba3D(FamilyNameOfCrossSection="Floor", Material=data_2, Height_cm=multiplication, mode="Shell - Const")

# ----
data_15 = Data(entwine)
data_16 = Data(entwine_2)
tstat = TreeStatistics(Tree=mesh_breps.Mesh)  # -> Paths, Length, Count
item_3 = ListItem(List=crosec_3, Index=0, Wrap=True)
item_4 = ListItem(List=tstat.Paths, Index=-1, Wrap=True)
mtoshell = MeshToShellKaramba3D(Mesh=mesh_breps.Mesh, CrossSection=item_3, LimitDistance_m=0.005)  # -> flatten(Element), Points, Info
split_8 = SplitTree(Data=mesh_breps.Mesh, Masks=flatten(item_4))  # -> Positive, Negative

debrep = DeconstructBrep(Brep=fmerge.Breps)  # -> Faces, Edges, Vertices
item_5 = ListItem(List=debrep.Faces, Index=0, Wrap=True)
Z = UnitZ(Factor=1)
cluster_3 = Cluster_2(S=item_5)
align = AlignPlane(Plane=cluster_3, Direction=Z)  # -> Plane, Angle
rotate = Rotate(Geometry=align.Plane, Angle=-1.570796327, Plane=align.Plane)  # -> Geometry, Transform
trim = TrimTree(Tree=rotate.Geometry, Depth=1)
bbox = BoundingBox(Content=item_5, Plane=trim)  # -> Box, Box_2
debox = DeconstructBox(Box=bbox.Box)  # -> Plane, X, Y, Z
dedomain = DeconstructDomain(Domain=debox.X)  # -> Start, End
dedomain_2 = DeconstructDomain(Domain=debox.Y)  # -> Start, End
subtraction = Subtraction(A=dedomain.End, B=dedomain.Start)
subtraction_2 = Subtraction(A=dedomain_2.End, B=dedomain_2.Start)
sort = SortList(Keys=flatten(subtraction))  # -> Keys, ValuesA
sort_2 = SortList(Keys=flatten(subtraction_2))  # -> Keys, ValuesA
item_6 = ListItem(List=sort.Keys, Index=0, Wrap=True)
item_7 = ListItem(List=sort_2.Keys, Index=0, Wrap=True)

beam_loads = BeamLoadsKaramba3D(LoadCase="LC0", TPosition=0.5, mode="Concentrated", menu=[buttons(on, off)])
entwine_3 = Entwine(Branch00=split_8.Negative, Branch01=split_8.Positive, FlattenInputs=True)

explode_2 = Explode(Curve=match, Recursive=True)  # -> Segments, Vertices
pdecon_3 = Deconstruct(Point=explode_2.Vertices)  # -> XComponent, YComponent, ZComponent
smaller = SmallerThan(FirstNumber=pdecon_3.ZComponent, SecondNumber=0.001)  # -> SmallerThan, OrEqualTo
cull = CullPattern(List=explode_2.Vertices, CullPattern=smaller.SmallerThan)  # -> flatten(List)
geo_3 = Geometry(cull)
supp = SupportKaramba3D(PosInd=geo_3, menu=[buttons(on, on, on, off, off, on)])

data_17 = Data(pshift_2)
panel_6 = Panel("""LC1 = G1 + G2 + 0.3*Q + 1*X + 0.3*Y
LC2 = G1 + G2 + 0.3*Q + 0.3*X+ 1*Y
LC3 = X +0.3*Y
LC4 = 0.3*X + Y
LC5 = G1+ G2 + 0.3*Q
LC6 = 1.35*(G1+G2)+1.5*Q""")
long_4 = LongestList(ListA=data_16, ListB=entwine_3, PaddingMode=2)  # -> ListA, ListB
long_5 = LongestList(ListA=data_15, ListB=entwine_3, PaddingMode=2)  # -> ListA, ListB

Z_2 = UnitZ(Factor=1)
neg = Negative(Value=Z_2)
loads = LoadsKaramba3D(Vector=neg, LCase="G1", mode="Gravity")

multiplication_2 = Multiplication(A=X, B=1000)
multiplication_3 = Multiplication(A=Y_2, B=1000)
Y_3 = UnitY(Factor=multiplication_3)
X_2 = UnitX(Factor=multiplication_2)
beam_loads_2 = BeamLoadsKaramba3D(
    BeamIdentifier=graft(data_17),
    LoadCase="X",
    ForceVector=graft(X_2),
    TPosition=1,
    mode="Concentrated",
    menu=[buttons(off, on)])
beam_loads_3 = BeamLoadsKaramba3D(
    BeamIdentifier=graft(data_17),
    LoadCase="Y",
    ForceVector=graft(Y_3),
    TPosition=1,
    mode="Concentrated",
    menu=[buttons(off, on)])

# ---- group: Q
Z_3 = UnitZ(Factor=long_5.ListA)
neg_2 = Negative(Value=Z_3)
loads_2 = LoadsKaramba3D(
    Vector=neg_2,
    Mesh=long_5.ListB,
    ElementIdentifiers=flatten(""),
    LCase="Q",
    mode="MeshLoad -Const.",
    menu=[buttons(off, on, off), buttons(on, off)])

# ---- group: G'
Z_4 = UnitZ(Factor=long_4.ListA)
neg_3 = Negative(Value=Z_4)
loads_3 = LoadsKaramba3D(
    Vector=neg_3,
    Mesh=long_4.ListB,
    ElementIdentifiers=flatten(""),
    LCase="G2",
    mode="MeshLoad -Const.",
    menu=[buttons(off, on, off), buttons(on, off)])

# ----
lccombinator = LoadCaseCombinatorKaramba3D(LoadCaseCombinationRulesKaramba3D=panel_6)  # -> LoadCaseCombinations, NamesOfLoadCases, NumberOfLoadCases
panel_7 = Panel(lccombinator.LoadCaseCombinations)
merge_2 = Merge(Data1=item_6, Data2=item_7)
load = LoadKaramba3D(flatten([lccombinator.LoadCaseCombinations, loads, beam_loads_2, beam_loads_3, loads_3, loads_2]))
mesh = ElementKaramba3D(flatten(mtoshell.Element))
beams = ElementKaramba3D(flatten(element))
support = SupportKaramba3D(flatten(supp))
load_2 = LoadKaramba3D(flatten(load))
assemble = AssembleModelKaramba3D(Elem=[beams, mesh], Support=support, Load=load_2)  # -> Model, Info, Mass_kg, CentreOfGravity, LoadCaseNames
item_8 = ListItem(List=assemble.LoadCaseNames, Index=Slider(10, range=0..10), Wrap=True)
selectelems = SelectElementsKaramba3D(Model=assemble.Model, ElementIdentifiers=data_17)  # -> Model, Elements
panel_8 = Panel(item_8)
modelview = ModelViewKaramba3D(Model=assemble.Model, LoadCase=panel_8)  # -> Model, DeformedMesh, DeformedAxes, DeformedModel, MaximumDeformation
disassemble = DisassembleElementKaramba3D(Element=selectelems.Elements)  # -> Element, ElementIdentifier, AxisOfElement, CrossSection, Joint, Material, LocalCoordinateSystem, ElementIsActive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
elem_id = Data(item)
elem_id_2 = Data(merge_2)
elem_id_3 = ClusterOutput(elem_id)
lcnames = ClusterOutput(assemble.LoadCaseNames)
elem_id_4 = ClusterOutput(elem_id_2)
model = ClusterOutput(assemble.Model)
item_9 = ListItem(List=flatten(disassemble.AxisOfElement), Index=0, Wrap=True)
panel_9 = Panel(assemble.LoadCaseNames)
item_10 = ListItem(List=flatten(disassemble.ElementIdentifier), Index=Slider(0, range=0..21), Wrap=True)
panel_10 = Panel(item_10)
analyse = AnalyseKaramba3D(Model=assemble.Model, LoadCases=panel_9)  # -> AnalysedModel, MaximumDisplacement_cm, ResultingForce_kN, ChangeOfElasticEnergy_kNm
item_11 = ListItem(List=assemble.LoadCaseNames, Index=Slider(2, range=0..10), Wrap=True)
panel_11 = Panel(item_11)
panel_12 = Panel(analyse.MaximumDisplacement_cm)
analyse_2 = AnalyseKaramba3D(Model=assemble.Model, LoadCases=panel_11)  # -> AnalysedModel, MaximumDisplacement_cm, ResultingForce_kN, ChangeOfElasticEnergy_kNm
modelview_2 = ModelViewKaramba3D(Model=analyse_2.AnalysedModel)  # -> Model, DeformedMesh, DeformedAxes, DeformedModel, MaximumDeformation
b_forces = BeamForcesKaramba3D(AnalysedModel=analyse_2.AnalysedModel, BeamsIdentifiers=item_10, Ts=[0, 1])  # -> Model, NormalForce_kN, ShearForceVz_kN, ShearForceVy_kN, TorsionalMomentMt_kNm, BendingMomentMy_kNm, BendingMomentMz_kNm, LoadCaseIndex
panel_13 = Panel(analyse_2.MaximumDisplacement_cm)
beamview = BeamViewKaramba3D(Model=modelview_2.Model)  # -> Model, MeshesOfRenderedBeams, DeformedBeamAxes, LegendColours, LegendTags
pshift_3 = ShiftPaths(Data=b_forces.NormalForce_kN, Offset=-1)
panel_14 = Panel(b_forces.NormalForce_kN)

# ==== cluster Cluster_5
geo = ClusterInput()
geo_2 = ClusterInput()
geo_3 = ClusterInput()
num = ClusterInput()
num_2 = ClusterInput()
geo_4 = Geometry(geo)
geo_5 = Geometry(geo_2)
geo_6 = Geometry(geo_3)
num_3 = Number(num_2)
num_4 = Number(num)
entwine = Entwine(Branch00=geo_4, Branch01=geo_5, FlattenInputs=True)  # -> simplify(Result)
entwine_2 = Entwine(Branch00=geo_4, Branch01=geo_5, FlattenInputs=True)  # -> simplify(Result)
area = Area(Geometry=geo_6)  # -> Area, Centroid
brep = Brep(graft(entwine))
pdecon = Deconstruct(Point=area.Centroid)  # -> XComponent, YComponent, ZComponent
debrep = DeconstructBrep(Brep=brep)  # -> Faces, Edges, Vertices
cset = CreateSet(List=pdecon.ZComponent)  # -> Set, Map
c_script = CSharpScript(brep=entwine)  # -> out, Outer, Inners; inputs brep: Brep
# ---------- c_script: C# ----------
    if (brep != null){


      var ins = new List<Curve>();
      for (int i = 0 ; i < brep.Loops.Count ; i++){
        if (brep.Loops[i].LoopType == BrepLoopType.Outer){
          Outer = new Curve[]{brep.Loops[i].To3dCurve()};
        }else{
          ins.Add(brep.Loops[i].To3dCurve());
        }
      }
      Inners = ins;

    }else{
      Outer = new Curve[0];
      Inners = new Curve[0];
    }
# ---------- end c_script ----------
item = ListItem(List=debrep.Faces, Index=0, Wrap=True)
sort = SortList(Keys=cset.Set)  # -> Keys, ValuesA
Z = UnitZ(Factor=1)
cluster = Cluster_2(S=item)
mindex = MemberIndex(Set=pdecon.ZComponent, Member=sort.Keys)  # -> Index, Count
align = AlignPlane(Plane=cluster, Direction=Z)  # -> Plane, Angle
item_2 = ListItem(List=geo_6, Index=mindex.Index, Wrap=True)  # -> simplify(Item)
rotate = Rotate(Geometry=align.Plane, Angle=-1.570796327, Plane=align.Plane)  # -> Geometry, Transform
# VERTICALS
trim = TrimTree(Tree=rotate.Geometry, Depth=1)
data = Data(item_2)
bbox = BoundingBox(Content=c_script.Outer, Plane=trim)  # -> Box, Box_2
debox = DeconstructBox(Box=bbox.Box)  # -> Plane, X, Y, Z
dedomain = DeconstructDomain(Domain=debox.Y)  # -> Start, End
dedomain_2 = DeconstructDomain(Domain=debox.X)  # -> Start, End
pt = PointOriented(BasePlane=trim, UComponent=dedomain_2.Start, VComponent=dedomain.Start, WComponent=0)
subtraction = Subtraction(A=dedomain_2.End, B=dedomain_2.Start)
subtraction_2 = Subtraction(A=dedomain.End, B=dedomain.Start)
pl_origin = PlaneOrigin(Base=trim, Origin=pt)

# ---- group: sort along x
geo_7 = Geometry(c_script.Inners)
end = EndPoints(Curve=geo_7)  # -> Start, End
plcoord = PlaneCoordinates(Point=end.Start, System=pl_origin)  # -> XCoordinate, YCoordinate, ZCoordinate
sort_2 = SortList(Keys=plcoord.XCoordinate, ValuesA=geo_7)  # -> Keys, ValuesA

# ----
bbox_2 = BoundingBox(Content=sort_2.ValuesA, Plane=pl_origin)  # -> Box, Box_2
E = Number(subtraction_2)
L = Number(subtraction)
debox_2 = DeconstructBox(Box=bbox_2.Box)  # -> Plane, X, Y, Z
dup = DuplicateData(Data=debox_2.Y, Number=2, Order=False)
dedomain_3 = DeconstructDomain(Domain=debox_2.X)  # -> Start, End
weave = Weave(Pattern=[0, 1], Stream0=dedomain_3.Start, Stream1=dedomain_3.End, NullGaps=False)
domain = Domain(E)
ins = InsertItems(List=weave, Item="0", Indices="0", Wrap=False)
ins_2 = InsertItems(List=dup, Item=domain, Indices="0", Wrap=False)

# ---- group: X
ins_3 = InsertItems(List=ins, Item=L, Indices="-1", Wrap=True)

# ---- group: Y
ins_4 = InsertItems(List=ins_2, Item=domain, Indices="-1", Wrap=True)

# ----
partition = PartitionList(List=ins_3, Size="2")
item_3 = ListItem(List=partition, Index=0, Wrap=True)  # -> Item, Item1
dom = ConstructDomain(DomainStart=item_3.Item, DomainEnd=item_3.Item1)
trim_2 = TrimTree(Tree=dom, Depth=1)
dedomain_4 = DeconstructDomain(Domain=trim_2)  # -> Start, End
dispatch = Dispatch(List=ins_4, DispatchPattern=[True, False])  # -> ListA, ListB

# ---- group: left X
x = Data(dedomain_4.Start)

# ---- group: right X
x_2 = Data(dedomain_4.End)

# ---- group: left Y
dedomain_5 = DeconstructDomain(Domain=dispatch.ListA)  # -> Start, End

# ---- group: right Y
dedomain_6 = DeconstructDomain(Domain=dispatch.ListB)  # -> Start, End

# ----
max_angle = Panel("30")
subtraction_3 = Subtraction(A=x_2, B=x)
tan = Tangent(Value=degrees(max_angle))
D = Number(subtraction_3)

# ---- group: max height
multiplication = Multiplication(A=D, B=tan)

# ----
subtraction_4 = Subtraction(A=dedomain_5.Start, B=multiplication)
subtraction_5 = Subtraction(A=dedomain_6.Start, B=multiplication)
addition = Addition(A=multiplication, B=dedomain_5.End)
addition_2 = Addition(A=multiplication, B=dedomain_6.End)
data_2 = Data()
max = Maximum(A=dedomain_5.Start, B=subtraction_5)
max_2 = Maximum(A=dedomain_6.Start, B=subtraction_4)
data_3 = Data()
min = Minimum(A=dedomain_5.End, B=addition_2)
min_2 = Minimum(A=dedomain_6.End, B=addition)
addition_3 = Addition(A=max, B=max_2)
addition_4 = Addition(A=min, B=min_2)
division = Division(A=addition_3, B=2)
division_2 = Division(A=addition_4, B=2)
subtraction_6 = Subtraction(A=division_2, B=division)
h = Number(subtraction_6)
E_2 = Number(E)
D_2 = Number(D)
expression = Expression(h=h, E=E_2, D=D_2, Expression="h+(1/3)*D*(E-h)/h")
h_eff = Number(expression)
# ACROTERES
number_slider = Slider(0, range=0..10)
subtraction_7 = Subtraction(A=h_eff, B=subtraction_6)
division_3 = Division(A=subtraction_7, B=2)
Z_2 = UnitZ(Factor=1)
addition_5 = Addition(A=division_2, B=division_3)
subtraction_8 = Subtraction(A=division, B=division_3)
dedomain_7 = DeconstructDomain(Domain=trim_2)  # -> Start, End
addition_6 = Addition(A=dedomain_7.Start, B=dedomain_7.End)
division_4 = Division(A=addition_6, B=2)
E_3 = Number(E)

# ----
# Two Way >>> Beams: X & Y
# Y >>> Beams in Y
# X >>> Beams in X
list = ValueList({"Two Way": 0, "Y": 1, "X": 2}, selected="Y")

pln = Plane(pl_origin)
max_3 = Maximum(A="0", B=subtraction_8)
min_3 = Minimum(A=E_3, B=addition_5)
X = UnitX(Factor=1)
Y = UnitY(Factor=1)
deplane = DeconstructPlane(Plane=pln)  # -> Origin, XAxis, YAxis, ZAxis
python = GhPythonScript(vec=deplane.XAxis)  # -> out, a; inputs vec: Vector3d
# ---------- python: Python ----------
import rhinoscriptsyntax as rs

x = vec.X
y = vec.Y
if x<-0.5 or x>0.5:
    a = True

if y<-0.5 or y>0.5:
    a = False
# ---------- end python ----------
filter = StreamFilter(Gate=list, Stream1=Y, Stream2=X)
pt_2 = PointOriented(BasePlane=pln, UComponent=division_4, VComponent="0", WComponent=0)
pt_3 = PointOriented(BasePlane=pln, UComponent=division_4, VComponent=max_3, WComponent=0)
pt_4 = PointOriented(BasePlane=pln, UComponent=division_4, VComponent=min_3, WComponent=0)
pt_5 = PointOriented(BasePlane=pln, UComponent=division_4, VComponent=E_3, WComponent=0)
ln = Line(StartPoint=pt_2, EndPoint=pt_3)
ln_2 = Line(StartPoint=pt_4, EndPoint=pt_5)
ln_3 = Line(StartPoint=pt_3, EndPoint=pt_4)
pln_2 = Plane(pl_origin)
D_3 = Number(D)
data_4 = Data(c_script.Inners)
panel = Panel(ln_3)
match = MatchTree(Tree=pln_2, Guide=data_4)
match_2 = MatchTree(Tree=D_3, Guide=data_4)
lng = ListLength(List=match_2)
match_3 = MatchTree(Tree=ln_2, Guide=data_4)
match_4 = MatchTree(Tree=ln, Guide=data_4)
match_5 = MatchTree(Tree=ln_3, Guide=data_4)
long = LongestList(ListA=match_5, ListB=python.a, PaddingMode=2)  # -> ListA, ListB
repeat = RepeatData(Data=match, Length=lng)
geo_8 = Geometry([ln, ln_2])
geo_9 = Geometry(ln_3)
trim_3 = TrimTree(Tree=match_4, Depth=1)
trim_4 = TrimTree(Tree=match_5, Depth=1)
trim_5 = TrimTree(Tree=match_3, Depth=1)
trim_6 = TrimTree(Tree=match_2, Depth=1)
cull = CullPattern(List=match_5, CullPattern=long.ListB)
trim_7 = TrimTree(Tree=repeat, Depth=2)
merge = Merge(Data1=trim_3, Data2=trim_5)
merge_2 = Merge(Data1=trim_6, Data2=trim_6)
merge_3 = Merge(Data1=trim_7, Data2=trim_7)
entwine_3 = Entwine(Branch0X=trim_7, Branch1X=merge_3, FlattenInputs=False)
entwine_4 = Entwine(Branch0X=trim_4, Branch1X=merge, FlattenInputs=False)
entwine_5 = Entwine(Branch0X=trim_6, Branch1X=merge_2, FlattenInputs=False)
previewlw = CustomPreviewLineweights(Geometry=geo_9, Shader=ColourSwatch(SwatchColor=RGB(0, 0, 0)), Thickness=Slider(1, range=0..10), Absolute=False)
previewlw_2 = CustomPreviewLineweights(Geometry=geo_8, Shader=ColourSwatch(SwatchColor=RGB(0, 0, 0)), Thickness=Slider(3, range=0..10), Absolute=False)
null = NullItem(Item=entwine_4)  # -> NullFlags, InvalidFlags, Description
cull_2 = CullPattern(List=entwine_4, CullPattern=invert(null.InvalidFlags))
cull_3 = CullPattern(List=entwine_3, CullPattern=invert(null.InvalidFlags))
cull_4 = CullPattern(List=entwine_5, CullPattern=invert(null.InvalidFlags))
entwine_6 = Entwine(Branch00=num_3, Branch01=num_4, Branch02=num_3, Branch03=num_4, FlattenInputs=True)
deplane_2 = DeconstructPlane(Plane=cull_3)  # -> Origin, XAxis, YAxis, ZAxis
cluster_2 = Cluster_4(num=entwine_6)
cluster_3 = Cluster_4(num=cull_4)
line = Geometry(cull_2)
z_orient = Vector(deplane_2.XAxis)
domain_x = Data(cluster_2)
domain_y = Data(cluster_3)
panel_2 = Panel(cluster_3)
py3 = Python3Script(x=line)  # -> out, a; unedited script template
long_2 = LongestList(ListA=line, ListB=z_orient, ListC=domain_x, ListD=domain_y, PaddingMode=2)  # -> ListA, ListB, ListC, ListD
bang = ExplodeTree(Data=cull_2)  # -> Branch0, Branch1
Z_3 = UnitZ(Factor=1)

# ---- group: domain x
entwine_7 = Entwine(Branch00=num_3, Branch01=num_4, FlattenInputs=True)

# ----
cluster_4 = Cluster_4(num=entwine_7)
panel_3 = Panel("""Stone_Rigid
Conc_Deformable
Stone_Deformable
infinite""")
panel_4 = Panel("""Conc_Deformable
Stone_Deformable
Conc_Rigid
Stone_Rigid""")
panel_5 = Panel("""Conc
Stone_Deformable
Conc
Stone_Rigid""")
panel_6 = Panel("""Stone_Rigid
Conc
Stone_Deformable
infinite""")
ins_5 = InsertItems(List=sort.Keys, Item=0, Indices=0, Wrap=True)
consec = ConsecutiveDomains(Numbers=ins_5, Additive=False)
entwine_8 = Entwine(Branch0X=panel_5, Branch1X=panel_6, FlattenInputs=False)  # -> flatten(Result)
line_2 = Geometry(long_2.ListA)
split = SplitTree(Data=line_2, Masks=flatten("{0;1}"))  # -> Positive, Negative
data_5 = Data(split.Positive)

midpt = CurveMiddle(Curve=data_5)
pdecon_2 = Deconstruct(Point=midpt)  # -> XComponent, YComponent, ZComponent
data_6 = Data(consec)
inc = Includes(Value=pdecon_2.ZComponent, Domain=graft(data_6))  # -> Includes, Deviation
cull_5 = CullPattern(List=midpt, CullPattern=inc.Includes)  # -> simplify(List)
cull_6 = CullPattern(List=data_5, CullPattern=inc.Includes)  # -> simplify(List)
split_2 = SplitTree(Data=cull_6, Masks=flatten("{0}"))  # -> Positive, Negative
split_3 = SplitTree(Data=cull_5, Masks=flatten("{0}"))  # -> Positive, Negative
project = Project(Geometry=split_3.Positive, Plane=PlaneXY(0, 0, 0))  # -> Geometry, Transform
project_2 = Project(Geometry=split_3.Negative, Plane=PlaneXY(0, 0, 0))  # -> Geometry, Transform
cps = ClosestPoints(Point=project.Geometry, Cloud=project_2.Geometry, Count=1)  # -> ClosestPoint, CPIndex, Distance
pshift = ShiftPaths(Data=cps.CPIndex, Offset=-1)
item_4 = ListItem(List=split_2.Negative, Index=pshift, Wrap=True)
item_5 = ListItem(List=split_3.Negative, Index=pshift, Wrap=True)
merge_4 = Merge(Data1=split_2.Positive, Data2=item_4)
merge_5 = Merge(Data1=split_3.Positive, Data2=item_5)

z_orient_2 = Vector(long_2.ListB)
domain_x_2 = Data(long_2.ListC)
domain_y_2 = Data(long_2.ListD)
# EXPORT
number_slider_2 = Slider(3, range=0..20)
cset_2 = CreateSet(List=entwine_8)  # -> flatten(Set), graft(Map)
data_7 = Data(ln_3)
tstat = TreeStatistics(Tree=data_7)  # -> Paths, Length, Count
join = BrepJoin(Breps=data)  # -> Breps, Closed
tmatch = MatchText(Text=tstat.Paths, Pattern="{1*", Case=True)
cull_7 = CullPattern(List=tstat.Paths, CullPattern=tmatch)
split_4 = SplitTree(Data=data_7, Masks=flatten(cull_7))  # -> Positive, Negative
lng_2 = ListLength(List=sort.Keys)  # -> expr("x-1", Length)
item_6 = ListItem(List=sort.Keys, Index=0, Wrap=True)  # -> Item, Item1
data_8 = Data(split_4.Positive)
material = Data(cset_2.Set)
flr_height = Data(item_6.Item1)
subtraction_9 = Subtraction(A=flr_height, B=item_6.Item)
no_of_floors = Data(lng_2)
gf_height = Data(item_6.Item)
no_of_floors_2 = ClusterOutput(no_of_floors)
multiplication_2 = Multiplication(A=no_of_floors, B=subtraction_9)
material_2 = ClusterOutput(material)
data_9 = ClusterOutput(data_8)
flr_height_2 = ClusterOutput(subtraction_9)
gf_height_2 = ClusterOutput(gf_height)
addition_7 = Addition(A=gf_height, B=multiplication_2)
bld_height = ClusterOutput(addition_7)
grouped = Geometry(merge_4)
grouped_2 = ClusterOutput(grouped)

# ----
# group breps by plane
debrep_2 = DeconstructBrep(Brep=entwine_2)  # -> Faces, Edges, Vertices
X_2 = UnitX(Factor=1)

trim_8 = TrimTree(Tree=debrep_2.Faces, Depth=1)

debrep_3 = DeconstructBrep(Brep=trim_8)  # -> Faces, Edges, Vertices

trim_9 = TrimTree(Tree=debrep_3.Faces, Depth=1)
cluster_5 = Cluster_2(S=trim_9)

# ----
# HORIZONTALS
deplane_3 = DeconstructPlane(Plane=cluster_5)  # -> Origin, XAxis, YAxis, ZAxis
dprod = DotProduct(VectorA=deplane_3.ZAxis, VectorB=X_2, Unitize=True)
abs = Absolute(Value=dprod)
expression_2 = Expression(x=abs, Expression="Round(x,3)")
cset_3 = CreateSet(List=expression_2)  # -> Set, Map
mindex_2 = MemberIndex(Set=expression_2, Member=cset_3.Set)  # -> Index, Count
trim_10 = TrimTree(Tree=mindex_2.Index, Depth=1)
item_7 = ListItem(List=trim_9, Index=trim_10, Wrap=True)
unflatten = UnflattenTree(Tree=item_7, Guide=mindex_2.Index)
join_2 = BrepJoin(Breps=unflatten)  # -> Breps, Closed

panel_7 = Panel(mindex_2.Index)
item_8 = ListItem(List=join_2.Breps, Index=0, Wrap=True)

# ----
# group breps by height
debrep_4 = DeconstructBrep(Brep=join_2.Breps)  # -> Faces, Edges, Vertices
bbox_3 = BoundingBox(Content=debrep_4.Faces, Plane=PlaneXY(0, 0, 0))  # -> Box, Box_2
debox_3 = DeconstructBox(Box=bbox_3.Box)  # -> Plane, X, Y, Z
dedomain_8 = DeconstructDomain(Domain=debox_3.Z)  # -> Start, End
sort_3 = SortList(Keys=dedomain_8.Start, ValuesA=debrep_4.Faces)  # -> Keys, ValuesA
expression_3 = Expression(x=sort_3.Keys, Expression="Round(x,3)")
cset_4 = CreateSet(List=expression_3)  # -> Set, Map
mindex_3 = MemberIndex(Set=expression_3, Member=cset_4.Set)  # -> Index, Count
trim_11 = TrimTree(Tree=mindex_3.Index, Depth=1)
item_9 = ListItem(List=sort_3.ValuesA, Index=trim_11, Wrap=True)
unflatten_2 = UnflattenTree(Tree=item_9, Guide=mindex_3.Index)
group = Group(Objects=unflatten_2)

panel_8 = Panel(debox_3.X)
trim_12 = TrimTree(Tree=group, Depth=1)
ins_6 = InsertItems(List=trim_12, Item=data_3, Indices="-1", Wrap=True)

# ---- group: sup
cull_i = CullIndex(List=trim_12, Indices="0", Wrap=True)

# ----
ins_7 = InsertItems(List=trim_12, Item=data_3, Indices="0", Wrap=True)

# ---- group: inf
cull_i_2 = CullIndex(List=trim_12, Indices="-1", Wrap=True)

# ----
trim_13 = TrimTree(Tree=ins_6, Depth=1)
trim_14 = TrimTree(Tree=ins_7, Depth=1)
ungroup = Ungroup(Group=trim_13)
ungroup_2 = Ungroup(Group=trim_14)
clean = CleanTree(RemoveNulls=True, RemoveInvalid=True, RemoveEmpty=False, Tree=ungroup)
clean_2 = CleanTree(RemoveNulls=True, RemoveInvalid=True, RemoveEmpty=False, Tree=ungroup_2)
brep_2 = Brep(clean_2)
brep_3 = Brep(clean)
item_10 = ListItem(List=brep_2, Index=0, Wrap=True)
debrep_5 = DeconstructBrep(Brep=item_10)  # -> Faces, Edges, Vertices
c_script_2 = CSharpScript(brep=brep_2)  # -> out, Outer, Inners; inputs brep: Brep; same code as c_script
c_script_3 = CSharpScript(brep=brep_3)  # -> out, Outer, Inners; inputs brep: Brep; same code as c_script
item_11 = ListItem(List=debrep_5.Faces, Index=0, Wrap=True)
trim_15 = TrimTree(Tree=c_script_2.Inners, Depth=1)
cluster_6 = Cluster_2(S=item_11)
trim_16 = TrimTree(Tree=c_script_2.Outer, Depth=1)
trim_17 = TrimTree(Tree=c_script_3.Inners, Depth=1)
# {Material; North-South; Floor Level, Beam Level}
trim_18 = TrimTree(Tree=c_script_3.Outer, Depth=1)
pshift_2 = ShiftPaths(Data=trim_18, Offset=expr("-x", number_slider))
align_2 = AlignPlane(Plane=cluster_6, Direction=Z_2)  # -> Plane, Angle
rotate_2 = Rotate(Geometry=align_2.Plane, Angle=-1.570796327, Plane=align_2.Plane)  # -> Geometry, Transform
trim_19 = TrimTree(Tree=rotate_2.Geometry, Depth=1)
pln_3 = Plane(trim_19)
bbox_4 = BoundingBox(Content=trim_18, Plane=pln_3, UnionBox=False)  # -> Box, Box_2
bbox_5 = BoundingBox(Content=trim_16, Plane=trim_19, UnionBox=False)  # -> Box, Box_2
pshift_3 = ShiftPaths(Data=bbox_5.Box, Offset=-1)
pshift_4 = ShiftPaths(Data=bbox_4.Box, Offset=-1)
panel_9 = Panel(pshift_4)
debox_4 = DeconstructBox(Box=pshift_3)  # -> Plane, X, Y, Z
debox_5 = DeconstructBox(Box=pshift_4)  # -> Plane, X, Y, Z
dedomain_9 = DeconstructDomain(Domain=debox_4.Y)  # -> Start, End
dedomain_10 = DeconstructDomain(Domain=debox_4.X)  # -> Start, End
dedomain_11 = DeconstructDomain(Domain=debox_5.Y)  # -> Start, End
dedomain_12 = DeconstructDomain(Domain=debox_5.X)  # -> Start, End

sort_4 = SortList(Keys=dedomain_9.Start)  # -> Keys, ValuesA
sort_5 = SortList(Keys=dedomain_10.Start)  # -> Keys, ValuesA
item_12 = ListItem(List=sort_5.Keys, Index=0, Wrap=True)
item_13 = ListItem(List=sort_4.Keys, Index=0, Wrap=True)

sort_6 = SortList(Keys=dedomain_11.Start)  # -> Keys, ValuesA
sort_7 = SortList(Keys=dedomain_12.Start)  # -> Keys, ValuesA
item_14 = ListItem(List=sort_6.Keys, Index=0, Wrap=True)
item_15 = ListItem(List=sort_7.Keys, Index=0, Wrap=True)

pt_6 = PointOriented(BasePlane=trim_19, UComponent=dedomain_10.Start, VComponent=dedomain_9.Start, WComponent=0)
pt_7 = PointOriented(BasePlane=pln_3, UComponent=item_15, VComponent=item_14, WComponent=0)
subtraction_10 = Subtraction(A=dedomain_12.End, B=dedomain_12.Start)
subtraction_11 = Subtraction(A=dedomain_11.End, B=dedomain_11.Start)
pt_8 = PointOriented(BasePlane=trim_19, UComponent=item_12, VComponent=item_13, WComponent=0)
subtraction_12 = Subtraction(A=dedomain_10.End, B=dedomain_10.Start)
subtraction_13 = Subtraction(A=dedomain_9.End, B=dedomain_9.Start)
pl_origin_2 = PlaneOrigin(Base=trim_19, Origin=pt_8)

# ---- group: sort along x
geo_10 = Geometry(trim_15)
end_2 = EndPoints(Curve=geo_10)  # -> Start, End
plcoord_2 = PlaneCoordinates(Point=end_2.Start, System=pl_origin_2)  # -> XCoordinate, YCoordinate, ZCoordinate
sort_8 = SortList(Keys=plcoord_2.XCoordinate, ValuesA=geo_10)  # -> Keys, ValuesA

# ----
plcoord_3 = PlaneCoordinates(Point=pt_6, System=pl_origin_2)  # -> XCoordinate, YCoordinate, ZCoordinate
sort_9 = SortList(Keys=plcoord_3.XCoordinate, ValuesA=subtraction_12, ValuesB=subtraction_13)  # -> Keys, ValuesA, ValuesB
pl_origin_3 = PlaneOrigin(Base=pln_3, Origin=pt_7)

# ---- group: sort along x
geo_11 = Geometry(trim_17)
end_3 = EndPoints(Curve=geo_11)  # -> Start, End
plcoord_4 = PlaneCoordinates(Point=end_3.Start, System=pl_origin_3)  # -> XCoordinate, YCoordinate, ZCoordinate
sort_10 = SortList(Keys=plcoord_4.XCoordinate, ValuesA=geo_11)  # -> Keys, ValuesA

# ----
plcoord_5 = PlaneCoordinates(Point=end_2.Start, System=pl_origin_3)  # -> XCoordinate, YCoordinate, ZCoordinate

sort_11 = SortList(Keys=dedomain_9.End)  # -> Keys, ValuesA
item_16 = ListItem(List=sort_11.Keys, Index=0, Wrap=True)

bbox_6 = BoundingBox(Content=sort_10.ValuesA, Plane=pl_origin_3)  # -> Box, Box_2
bbox_7 = BoundingBox(Content=sort_8.ValuesA, Plane=pl_origin_2)  # -> Box, Box_2
height_of_wall = Number(subtraction_11)
py3_2 = Python3Script(val=subtraction_10)  # -> out, a; inputs val: list
# ---------- py3_2: Python ----------
if val:
    val.insert(0, 0)

a = val
# ---------- end py3_2 ----------
E_4 = Number(sort_9.ValuesB)
L_2 = Number(sort_9.ValuesA)
ma = MassAddition(Input=py3_2.a)  # -> Result, PartialResults
debox_6 = DeconstructBox(Box=bbox_6.Box)  # -> Plane, X, Y, Z
debox_7 = DeconstructBox(Box=bbox_7.Box)  # -> Plane, X, Y, Z
panel_10 = Panel(subtraction_10)

py3_3 = Python3Script(val=L_2)  # -> out, a; inputs val: list; same code as py3_2
ma_2 = MassAddition(Input=py3_3.a)  # -> Result, PartialResults
consec_2 = ConsecutiveDomains(Numbers=ma_2.PartialResults, Additive=False)

pt_9 = PointOriented(BasePlane=trim_19, UComponent=item_12, VComponent=item_16, WComponent=0)
consec_3 = ConsecutiveDomains(Numbers=ma.PartialResults, Additive=False)
dedomain_13 = DeconstructDomain(Domain=debox_7.Y)  # -> Start, End
dedomain_14 = DeconstructDomain(Domain=debox_6.Y)  # -> Start, End
pl_origin_4 = PlaneOrigin(Base=trim_19, Origin=pt_9)
dedomain_15 = DeconstructDomain(Domain=debox_6.X)  # -> graft(Start), graft(End)
beam_domain = Domain(simplify(consec_3))
subtraction_14 = Subtraction(A=E_4, B=dedomain_13.End)
avr = Average(Input=[dedomain_15.Start, dedomain_15.End])
cs = CSharpScript(T=pshift_3, i=Slider(14, range=0..20))  # -> out, a; inputs T: tree, i: Int32; same code as cs
opening_domain = Domain(simplify(debox_7.X))
beam_domain_2 = Domain(simplify(consec_2))
dist_sup = Number(simplify(subtraction_14))
trim_20 = TrimTree(Tree=avr, Depth=1)
item_17 = ListItem(List=cs.a, Index=0, Wrap=True)
opening_domain_2 = Domain(simplify(debox_6.X))
dist_base = Number(simplify(dedomain_14.Start))
clean_3 = CleanTree(RemoveNulls=True, RemoveInvalid=True, RemoveEmpty=False, Tree=trim_20)

merge_6 = Merge(Data1=graft(opening_domain_2), Data2=graft(opening_domain))
merge_7 = Merge(Data1=opening_domain_2, Data2=opening_domain)

panel_11 = Panel(beam_domain_2)
merge_8 = Merge(Data1=beam_domain, Data2=beam_domain_2)

# ---- group: Manipulation for non-aligning windows
dedomain_16 = DeconstructDomain(Domain=merge_6)  # -> Start, End
avr_2 = Average(Input=dedomain_16.End)
avr_3 = Average(Input=dedomain_16.Start)
dom_2 = ConstructDomain(DomainStart=avr_3, DomainEnd=avr_2)
trim_21 = TrimTree(Tree=dom_2, Depth=1)
clean_4 = CleanTree(RemoveNulls=True, RemoveInvalid=True, RemoveEmpty=False, Tree=trim_21)

# ----
panel_12 = Panel(merge_8)
dist_base_2 = Number(simplify(dist_base))
domain_2 = Domain(simplify(opening_domain_2))
domain_3 = Domain(simplify(opening_domain))
dist_sup_2 = Number(simplify(dist_sup))
data_10 = Data(ungroup)

area_2 = Area(Geometry=clean)  # -> Area, Centroid
lng_3 = ListLength(List=area_2.Centroid)
repeat_2 = RepeatData(Data="false", Length=lng_3)

# ---- group: bool is acrotere
unflatten_3 = UnflattenTree(Tree=repeat_2, Guide=area_2.Centroid)

# ----
bool_is_acrotere = Boolean(unflatten_3)

# ---- group: all domains
dedomain_17 = DeconstructDomain(Domain=beam_domain_2)  # -> Start, End
dedomain_18 = DeconstructDomain(Domain=merge_7)  # -> Start, End
num_5 = Number([dedomain_18.Start, dedomain_18.End, dedomain_17.Start, dedomain_17.End])

# ----
cset_5 = CreateSet(List=num_5)  # -> Set, Map

# ---- group: all domains (continued)
sort_12 = SortList(Keys=cset_5.Set)  # -> Keys, ValuesA
consec_4 = ConsecutiveDomains(Numbers=sort_12.Keys, Additive=False)

# ---- group: remove super short ones
dedomain_19 = DeconstructDomain(Domain=consec_4)  # -> Start, End
subtraction_15 = Subtraction(A=dedomain_19.Start, B=dedomain_19.End)
abs_2 = Absolute(Value=subtraction_15)
larger = LargerThan(FirstNumber=abs_2, SecondNumber="0.001")  # -> LargerThan, OrEqualTo

# ----
panel_13 = Panel(num_5)
cull_8 = CullPattern(List=consec_4, CullPattern=larger.LargerThan)
data_11 = Data(cull_8)
intersect = CSharpScript(dom=data_11, Set=domain_2)  # -> out, A; inputs Set: list
# ---------- intersect: C# ----------
    var outIndices = new List<int>();
    var mid = (dom.Min + dom.Max) * 0.5;
    for (int i = 0; i < Set.Count ; i++){
      if (Set[i].IncludesParameter(mid))outIndices.Add(i);
    }
    A = outIndices;
# ---------- end intersect ----------
intersect_2 = CSharpScript(dom=data_11, Set=domain_3)  # -> out, A; inputs Set: list; same code as intersect
long_3 = LongestList(ListA=pl_origin_4, ListB=data_11, PaddingMode=2)  # -> ListA, ListB
trim_22 = TrimTree(Tree=intersect.A, Depth=1)
trim_23 = TrimTree(Tree=intersect_2.A, Depth=1)
domain_4 = Domain(graft(long_3.ListB))
pln_4 = Plane(graft(long_3.ListA))
item_18 = ListItem(List=dist_base_2, Index=trim_22, Wrap=True)
item_19 = ListItem(List=dist_sup_2, Index=trim_23, Wrap=True)
unflatten_4 = UnflattenTree(Tree=item_18, Guide=intersect.A)
unflatten_5 = UnflattenTree(Tree=item_19, Guide=intersect_2.A)
dedomain_20 = DeconstructDomain(Domain=domain_4)  # -> Start, End
panel_14 = Panel(pln_4)
item_20 = ListItem(List=unflatten_4, Index=0, Wrap=False)
item_21 = ListItem(List=unflatten_5, Index=0, Wrap=False)
pt_10 = PointOriented(BasePlane=pln_4, UComponent=dedomain_20.Start, VComponent=0, WComponent=0)
pt_11 = PointOriented(BasePlane=pln_4, UComponent=dedomain_20.End, VComponent=0, WComponent=0)
deplane_4 = DeconstructPlane(Plane=pln_4)  # -> Origin, XAxis, YAxis, ZAxis
nullrep = ReplaceNulls(Items=item_21, Replacements="0")  # -> Items, Count
nullrep_2 = ReplaceNulls(Items=item_20, Replacements="0")  # -> Items, Count
neg = Negative(Value=deplane_4.YAxis)
ln_4 = Line(StartPoint=pt_10, EndPoint=pt_11)
neg_2 = Negative(Value=nullrep_2.Items)
explode = Explode(Curve=ln_4, Recursive=True)  # -> Segments, Vertices
cs_2 = CSharpScript(T=ln_4, i=Slider(0, range=0..20))  # -> out, a; inputs T: tree, i: Int32; same code as cs
pshift_5 = ShiftPaths(Data=ln_4, Offset=expr("-x", Slider(3, range=0..10)))
dom_3 = ConstructDomain(DomainStart=neg_2, DomainEnd=nullrep.Items)
midpt_2 = CurveMiddle(Curve=pshift_5)
extr = Extrude(Base=explode.Segments, Direction=Z_3)
points = PointList(Points=midpt_2, Size=Slider(0.52, range=0..10))
lng_4 = ListLength(List=ln_4)
cull_9 = CullPattern(List=dom_3, CullPattern=lng_4)
trim_24 = TrimTree(Tree=neg, Depth=1)
trim_25 = TrimTree(Tree=ln_4, Depth=1)
trim_26 = TrimTree(Tree=cull_9, Depth=1)
clean_5 = CleanTree(RemoveNulls=True, RemoveInvalid=True, RemoveEmpty=False, Tree=trim_24)
match_6 = MatchTree(Tree=clean_5, Guide=data_10)
match_7 = MatchTree(Tree=trim_26, Guide=data_10)
match_8 = MatchTree(Tree=trim_25, Guide=data_10)

# ---- group: z Orient
trim_27 = TrimTree(Tree=match_6, Depth=3)

# ---- group: domain y
trim_28 = TrimTree(Tree=match_7, Depth=3)

# ---- group: line
trim_29 = TrimTree(Tree=match_8, Depth=3)

# ----
data_12 = Data(match_8)
data_13 = Data(match_7)
tstat_2 = TreeStatistics(Tree=data_12)  # -> Paths, Length, Count
tmatch_2 = MatchText(Text=tstat_2.Paths, Pattern="*;1}", Case=True)
dispatch_2 = Dispatch(List=tstat_2.Paths, DispatchPattern=tmatch_2)  # -> ListA, ListB
split_5 = SplitTree(Data=data_12, Masks=flatten(dispatch_2.ListA))  # -> Positive, Negative
split_6 = SplitTree(Data=data_13, Masks=flatten(dispatch_2.ListA))  # -> Positive, Negative
dedomain_21 = DeconstructDomain(Domain=split_6.Positive)  # -> Start, End
subtraction_16 = Subtraction(A=dedomain_21.Start, B=dedomain_21.End)
abs_3 = Absolute(Value=subtraction_16)
bool = Boolean(abs_3)
dispatch_3 = Dispatch(List=split_5.Positive, DispatchPattern=bool)  # -> ListA, ListB
crv = Curve(dispatch_3.ListB)
trim_30 = TrimTree(Tree=crv, Depth=3)

null_2 = NullItem(Item=trim_29)  # -> NullFlags, InvalidFlags, Description

bool_is_acrotere_2 = Boolean(bool_is_acrotere)
item_22 = ListItem(List=bool_is_acrotere_2, Index=0, Wrap=True)
dedomain_22 = DeconstructDomain(Domain=match_7)  # -> Start, End
and = GateAnd(B=invert(dedomain_22.End), C=dedomain_22.Start)
lng_5 = ListLength(List=dedomain_22.Start)
cull_10 = CullPattern(List=and, CullPattern=lng_5)
trim_31 = TrimTree(Tree=cull_10, Depth=3)
cull_11 = CullPattern(List=trim_31, CullPattern=invert(null_2.InvalidFlags))

cull_12 = CullPattern(List=trim_28, CullPattern=invert(null_2.InvalidFlags))
cull_13 = CullPattern(List=trim_29, CullPattern=invert(null_2.InvalidFlags))
cull_14 = CullPattern(List=trim_27, CullPattern=invert(null_2.InvalidFlags))
data_14 = Data(match_8)
data_15 = Data(match_7)
dedomain_23 = DeconstructDomain(Domain=data_15)  # -> Start, End
long_4 = LongestList(ListA=cull_13, ListB=cull_14, ListC=cluster_4, ListD=cull_12, PaddingMode=2)  # -> ListA, ListB, ListC, ListD
panel_15 = Panel(cull_11)
subtraction_17 = Subtraction(A=dedomain_23.Start, B=dedomain_23.End)
abs_4 = Absolute(Value=subtraction_17)
bool_2 = Boolean(cull_11)
bool_3 = Boolean(abs_4)
dispatch_4 = Dispatch(List=data_14, DispatchPattern=bool_3)  # -> ListA, ListB
dispatch_5 = Dispatch(List=long_4.ListA, DispatchPattern=bool_2)  # -> ListA, ListB
dispatch_6 = Dispatch(List=long_4.ListB, DispatchPattern=bool_2)  # -> ListA, ListB
dispatch_7 = Dispatch(List=long_4.ListC, DispatchPattern=bool_2)  # -> ListA, ListB
dispatch_8 = Dispatch(List=long_4.ListD, DispatchPattern=bool_2)  # -> ListA, ListB
entwine_9 = Entwine(Branch0X=flatten(dispatch_5.ListA), Branch1X=dispatch_5.ListB, FlattenInputs=False)
entwine_10 = Entwine(Branch0X=flatten(dispatch_7.ListA), Branch1X=dispatch_7.ListB, FlattenInputs=False)
entwine_11 = Entwine(Branch0X=flatten(dispatch_8.ListA), Branch1X=dispatch_8.ListB, FlattenInputs=False)
dedomain_24 = DeconstructDomain(Domain=entwine_11)  # -> Start, End

# ---- group: Rigid
crv_2 = Curve(dispatch_4.ListB)

# ----
entwine_12 = Entwine(Branch0X=flatten(dispatch_6.ListA), Branch1X=dispatch_6.ListB, FlattenInputs=False)

# ---- group: Deformable
curve = Curve(dispatch_4.ListA)

# ----
subtraction_18 = Subtraction(A=dedomain_24.Start, B=dedomain_24.End)
trim_32 = TrimTree(Tree=crv_2, Depth=2)
abs_5 = Absolute(Value=subtraction_18)
bool_4 = Boolean(abs_5)
dispatch_9 = Dispatch(List=entwine_9, DispatchPattern=bool_4)  # -> ListA, ListB
dispatch_10 = Dispatch(List=entwine_12, DispatchPattern=bool_4)  # -> ListA, ListB
dispatch_11 = Dispatch(List=entwine_10, DispatchPattern=bool_4)  # -> ListA, ListB
dispatch_12 = Dispatch(List=entwine_11, DispatchPattern=bool_4)  # -> ListA, ListB
entwine_13 = Entwine(Branch0X=dispatch_9.ListA, Branch1X=flatten(dispatch_9.ListB), FlattenInputs=False)
entwine_14 = Entwine(Branch0X=dispatch_11.ListA, Branch1X=flatten(dispatch_11.ListB), FlattenInputs=False)
entwine_15 = Entwine(Branch0X=dispatch_12.ListA, Branch1X=flatten(dispatch_12.ListB), FlattenInputs=False)
entwine_16 = Entwine(Branch0X=dispatch_10.ListA, Branch1X=flatten(dispatch_10.ListB), FlattenInputs=False)
domain_y_3 = Data(entwine_15)
line_3 = Geometry(entwine_13)
z_orient_3 = Vector(entwine_16)
domain_x_3 = Data(entwine_14)
entwine_17 = Entwine(Branch0X=line_2, Branch1X=line_3, FlattenInputs=False)
entwine_18 = Entwine(Branch0X=domain_x_2, Branch1X=domain_x_3, FlattenInputs=False)
entwine_19 = Entwine(Branch0X=domain_y_2, Branch1X=domain_y_3, FlattenInputs=False)
entwine_20 = Entwine(Branch0X=z_orient_2, Branch1X=z_orient_3, FlattenInputs=False)
geo_12 = Geometry(data_12)
geo_13 = Geometry(crv_2)
cs_3 = CSharpScript(T=line_3, i=number_slider_2)  # -> out, a; inputs T: tree, i: Int32; same code as cs
pshift_6 = ShiftPaths(Data=geo_12, Offset=3)
item_23 = ListItem(List=flatten(cs_3.a), Index=Slider(41, range=0..100), Wrap=True)
c_script_4 = CSharpScript(tree=entwine_20, path=cset_2.Map)  # -> out, A; inputs tree: tree, path: tree of Int32
# ---------- c_script_4: C# ----------
    
    var newTree = new DataTree<object>();
    for (int i = 0 ; i < tree.Paths.Count ; i++){
      newTree.AddRange(tree.Branch(i), new GH_Path(path.Branch(i)[0]));
    }
    
    A = newTree;
# ---------- end c_script_4 ----------
c_script_5 = CSharpScript(tree=entwine_18, path=cset_2.Map)  # -> out, A; inputs tree: tree, path: tree of Int32; same code as c_script_4
c_script_6 = CSharpScript(tree=entwine_19, path=cset_2.Map)  # -> out, A; inputs tree: tree, path: tree of Int32; same code as c_script_4
c_script_7 = CSharpScript(tree=entwine_17, path=cset_2.Map)  # -> out, A; inputs tree: tree, path: tree of Int32; same code as c_script_4
clean_6 = CleanTree(RemoveNulls=True, RemoveInvalid=True, RemoveEmpty=True, Tree=pshift_6)
match_9 = MatchTree(Tree=join.Breps, Guide=clean_6)
area_3 = Area(Geometry=match_9)  # -> Area, Centroid
line_4 = Geometry(c_script_7.A)
z_orient_4 = Vector(c_script_4.A)
domain_x_4 = Data(c_script_5.A)
domain_y_4 = Data(c_script_6.A)
branch = TreeBranch(Tree=area_3.Area, Path="{1}", MaintainPaths=True)
gf_area = Data(branch)
domain_x_5 = ClusterOutput(domain_x_4)
domain_y_5 = ClusterOutput(domain_y_4)
gf_area_2 = ClusterOutput(gf_area)
z_orient_5 = ClusterOutput(z_orient_4)
line_5 = ClusterOutput(line_4)
T = ClusterOutput(match_9)
geo_14 = ClusterOutput(geo_12)
geo_15 = ClusterOutput(geo_13)
panel_16 = Panel(domain_x_4)

# ==== cluster EXTRUDE
domain_y = ClusterInput()
domain_x = ClusterInput()
def_cols = ClusterInput()
z_orient = ClusterInput()
line = ClusterInput()
def_cols_2 = Geometry(def_cols)
line_2 = Geometry(line)
z_orient_2 = Vector(z_orient)
domain_x_2 = Data(domain_x)
domain_y_2 = Data(domain_y)
midpt = CurveMiddle(Curve=flatten(line_2))
end = EndPoints(Curve=line_2)  # -> Start, End
midpt_2 = CurveMiddle(Curve=flatten(def_cols_2))
tstat = TreeStatistics(Tree=graft(line_2))  # -> Paths, Length, Count
vec2pt = Vector2Pt(PointA=end.Start, PointB=end.End, Unitize=False)  # -> Vector, Length
cps = ClosestPoints(Point=midpt_2, Cloud=midpt, Count=1)  # -> ClosestPoint, CPIndex, Distance
cull_i = CullIndex(List=tstat.Paths, Indices=flatten(cps.CPIndex), Wrap=True)
pl = PlaneNormal(Origin=end.Start, ZAxis=vec2pt.Vector)
align = AlignPlane(Plane=pl, Direction=z_orient_2)  # -> Plane, Angle
rectangle = Rectangle(Plane=align.Plane, XSize=domain_y_2, YSize=domain_x_2, Radius=0)  # -> Rectangle, Length
extr = Extrude(Base=rectangle.Rectangle, Direction=vec2pt.Vector)
item = ListItem(List=flatten(extr), Index=cps.CPIndex, Wrap=True)
cull_i_2 = CullIndex(List=flatten(extr), Indices=flatten(cps.CPIndex), Wrap=True)
item_2 = ListItem(List=flatten(rectangle.Rectangle), Index=cps.CPIndex, Wrap=True)
item_3 = ListItem(List=flatten(vec2pt.Vector), Index=cps.CPIndex, Wrap=True)
c_script = CSharpScript(D=cull_i_2, P=cull_i)  # -> out, a; inputs D: list of Brep, P: list of String
# ---------- c_script: C# ----------
// Grasshopper Script Instance
#region Usings
using System;
using System.Linq;
using System.Collections;
using System.Collections.Generic;
using System.Drawing;

using Rhino;
using Rhino.Geometry;

using Grasshopper;
using Grasshopper.Kernel;
using Grasshopper.Kernel.Data;
using Grasshopper.Kernel.Types;
#endregion

public class Script_Instance : GH_ScriptInstance
{
    #region Notes
    /* 
      Members:
        RhinoDoc RhinoDocument
        GH_Document GrasshopperDocument
        IGH_Component Component
        int Iteration

      Methods (Virtual & overridable):
        Print(string text)
        Print(string format, params object[] args)
        Reflect(object obj)
        Reflect(object obj, string method_name)
    */
    #endregion

    private void RunScript(List<Brep> D, List<string> P, ref object a)
    {
        // Write your logic here
        DataTree<Brep> finalTree = new DataTree<Brep>();
        for(int i = 0; i < D.Count; i++)
        {
            Brep data = D[i];
            GH_Path path = new GH_Path();
            path.FromString((P[i]));
            finalTree.Add(data, path);
        }
        a = finalTree;
    }
}
# ---------- end c_script ----------
other = Data(item_2)
match = MatchTree(Tree=item, Guide=graft(def_cols_2))
pshift = ShiftPaths(Data=c_script.a, Offset=-1)
match_2 = MatchTree(Tree=other, Guide=graft(def_cols_2))
match_3 = MatchTree(Tree=graft(item_3), Guide=graft(def_cols_2))
T = ClusterOutput(match)
D = ClusterOutput(pshift)
height = ClusterOutput(match_3)
rect = ClusterOutput(match_2)

number_slider = Slider(6, range=0..20)
cs = CSharpScript(T=graft(def_cols_2), i=number_slider)  # -> out, a; inputs T: tree, i: Int32; same code as cs
cs_2 = CSharpScript(T=graft(match), i=number_slider)  # -> out, a; inputs T: tree, i: Int32; same code as cs
cs_3 = CSharpScript(T=graft(match_2), i=number_slider)  # -> out, a; inputs T: tree, i: Int32; same code as cs
cs_4 = CSharpScript(T=graft(match_3), i=number_slider)  # -> out, a; inputs T: tree, i: Int32; same code as cs

# ==== cluster EXTRUDE_2
line = ClusterInput()
domain_y = ClusterInput()
domain_x = ClusterInput()
z_orient = ClusterInput()
domain_y_2 = Data(domain_y)
domain_x_2 = Data(domain_x)
line_2 = Geometry(line)
z_orient_2 = Vector(z_orient)
end = EndPoints(Curve=line_2)  # -> Start, End
vec2pt = Vector2Pt(PointA=end.Start, PointB=end.End, Unitize=False)  # -> Vector, Length
pl = PlaneNormal(Origin=end.Start, ZAxis=vec2pt.Vector)
align = AlignPlane(Plane=pl, Direction=z_orient_2)  # -> Plane, Angle
rectangle = Rectangle(Plane=align.Plane, XSize=domain_y_2, YSize=domain_x_2, Radius=0)  # -> Rectangle, Length
extr = Extrude(Base=rectangle.Rectangle, Direction=vec2pt.Vector)
E = ClusterOutput(extr)

# ==== cluster Cluster
I = ClusterInput()
dedomain = DeconstructDomain(Domain=I)  # -> Start, End
subtraction = Subtraction(A=dedomain.Start, B=dedomain.End)
abs = Absolute(Value=subtraction)
y = ClusterOutput(abs)

# ==== cluster Cluster_2
S = ClusterInput()
evalsrf = EvaluateSurface(Surface=reparameterize(S), Point="{0.5, 0.5, 0}")  # -> Point, Normal, UDirection, VDirection, Frame
F = ClusterOutput(evalsrf.Frame)

# ==== cluster Cluster_4
num = ClusterInput()
num_2 = Number(num)
multiplication = Multiplication(A=num_2, B=0.5)
multiplication_2 = Multiplication(A=num_2, B=-0.5)
dom = ConstructDomain(DomainStart=multiplication_2, DomainEnd=multiplication)
I = ClusterOutput(dom)
