# Grasshopper definition Geometric Module_Clean.gh (Grasshopper 1.0.8)
# plug-ins: Human

num = Number(0.2)
geo = Geometry([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])
geo_2 = Geometry([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])
geo_3 = Geometry([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])
num_2 = Number(0.2)
entwine = Entwine(Branch00=geo, Branch01=geo_2, FlattenInputs=True)  # -> simplify(Result)
entwine_2 = Entwine(Branch00=geo, Branch01=geo_2, FlattenInputs=True)  # -> simplify(Result)
area = Area(Geometry=geo_3)  # -> Area, Centroid
pdecon = Deconstruct(Point=area.Centroid)  # -> XComponent, YComponent, ZComponent
cset = CreateSet(List=pdecon.ZComponent)  # -> Set, Map
sort = SortList(Keys=cset.Set)  # -> Keys, ValuesA
mindex = MemberIndex(Set=pdecon.ZComponent, Member=sort.Keys)  # -> Index, Count
item = ListItem(List=geo_3, Index=mindex.Index, Wrap=True)  # -> simplify(Item)
brep = Brep(graft(entwine))
c_script = CSharpScript(brep=entwine)  # -> out, Outer, Inners; inputs brep: Brep
# ---------- c_script: C# ----------
    if (brep != null){


      var ins = new List<Curve>();
      for (int i = 0 ; i < brep.Loops.Count ; i++){
        if (brep.Loops[i].LoopType == BrepLoopType.Outer){
          Outer = new Curve[]{brep.Loops[i].To3dCurve()};
        }else{
          ins.Add(brep.Loops[i].To3dCurve());
        }
      }
      Inners = ins;

    }else{
      Outer = new Curve[0];
      Inners = new Curve[0];
    }
# ---------- end c_script ----------
debrep = DeconstructBrep(Brep=brep)  # -> Faces, Edges, Vertices
item_2 = ListItem(List=debrep.Faces, Index=0, Wrap=True)
Z = UnitZ(Factor=1)
cluster = Cluster(S=item_2)
align = AlignPlane(Plane=cluster, Direction=Z)  # -> Plane, Angle
rotate = Rotate(Geometry=align.Plane, Angle=-1.570796327, Plane=align.Plane)  # -> Geometry, Transform
# VERTICALS
trim = TrimTree(Tree=rotate.Geometry, Depth=1)
bbox = BoundingBox(Content=c_script.Outer, Plane=trim)  # -> Box, Box_2
debox = DeconstructBox(Box=bbox.Box)  # -> Plane, X, Y, Z
dedomain = DeconstructDomain(Domain=debox.X)  # -> Start, End
dedomain_2 = DeconstructDomain(Domain=debox.Y)  # -> Start, End
pt = PointOriented(BasePlane=trim, UComponent=dedomain.Start, VComponent=dedomain_2.Start, WComponent=0)
subtraction = Subtraction(A=dedomain.End, B=dedomain.Start)
subtraction_2 = Subtraction(A=dedomain_2.End, B=dedomain_2.Start)
pl_origin = PlaneOrigin(Base=trim, Origin=pt)

# ---- group: sort along x
geo_4 = Geometry(c_script.Inners)
end = EndPoints(Curve=geo_4)  # -> Start, End
plcoord = PlaneCoordinates(Point=end.Start, System=pl_origin)  # -> XCoordinate, YCoordinate, ZCoordinate
sort_2 = SortList(Keys=plcoord.XCoordinate, ValuesA=geo_4)  # -> Keys, ValuesA

# ----
bbox_2 = BoundingBox(Content=sort_2.ValuesA, Plane=pl_origin)  # -> Box, Box_2
E = Number(subtraction_2)
L = Number(subtraction)
debox_2 = DeconstructBox(Box=bbox_2.Box)  # -> Plane, X, Y, Z
dedomain_3 = DeconstructDomain(Domain=debox_2.X)  # -> Start, End
weave = Weave(Pattern=[0, 1], Stream0=dedomain_3.Start, Stream1=dedomain_3.End, NullGaps=False)
domain = Domain(E)
dup = DuplicateData(Data=debox_2.Y, Number=2, Order=False)
ins = InsertItems(List=weave, Item="0", Indices="0", Wrap=False)

# ---- group: X
ins_2 = InsertItems(List=ins, Item=L, Indices="-1", Wrap=True)

# ----
ins_3 = InsertItems(List=dup, Item=domain, Indices="0", Wrap=False)
partition = PartitionList(List=ins_2, Size="2")

# ---- group: Y
ins_4 = InsertItems(List=ins_3, Item=domain, Indices="-1", Wrap=True)

# ----
item_3 = ListItem(List=partition, Index=0, Wrap=True)  # -> Item, Item1
dom = ConstructDomain(DomainStart=item_3.Item, DomainEnd=item_3.Item1)
trim_2 = TrimTree(Tree=dom, Depth=1)
dispatch = Dispatch(List=ins_4, DispatchPattern=[True, False])  # -> ListA, ListB
dedomain_4 = DeconstructDomain(Domain=trim_2)  # -> Start, End

# ---- group: right Y
dedomain_5 = DeconstructDomain(Domain=dispatch.ListB)  # -> Start, End

# ---- group: left Y
dedomain_6 = DeconstructDomain(Domain=dispatch.ListA)  # -> Start, End

# ---- group: left X
x = Data(dedomain_4.Start)

# ---- group: right X
x_2 = Data(dedomain_4.End)

# ----
max_angle = Panel("30")
subtraction_3 = Subtraction(A=x_2, B=x)
tan = Tangent(Value=degrees(max_angle))
D = Number(subtraction_3)
data = Data()

# ---- group: max height
multiplication = Multiplication(A=D, B=tan)

# ----
addition = Addition(A=multiplication, B=dedomain_6.End)
addition_2 = Addition(A=multiplication, B=dedomain_5.End)
subtraction_4 = Subtraction(A=dedomain_6.Start, B=multiplication)
subtraction_5 = Subtraction(A=dedomain_5.Start, B=multiplication)
max = Maximum(A=dedomain_6.Start, B=subtraction_5)
max_2 = Maximum(A=dedomain_5.Start, B=subtraction_4)
min = Minimum(A=dedomain_6.End, B=addition_2)
min_2 = Minimum(A=dedomain_5.End, B=addition)
addition_3 = Addition(A=max, B=max_2)
addition_4 = Addition(A=min, B=min_2)
division = Division(A=addition_3, B=2)
division_2 = Division(A=addition_4, B=2)
subtraction_6 = Subtraction(A=division_2, B=division)
h = Number(subtraction_6)
D_2 = Number(D)
E_2 = Number(E)
expression = Expression(h=h, E=E_2, D=D_2, Expression="h+(1/3)*D*(E-h)/h")
Z_2 = UnitZ(Factor=1)
h_eff = Number(expression)
subtraction_7 = Subtraction(A=h_eff, B=subtraction_6)
dedomain_7 = DeconstructDomain(Domain=trim_2)  # -> Start, End
division_3 = Division(A=subtraction_7, B=2)
addition_5 = Addition(A=dedomain_7.Start, B=dedomain_7.End)
division_4 = Division(A=addition_5, B=2)
subtraction_8 = Subtraction(A=division, B=division_3)
addition_6 = Addition(A=division_2, B=division_3)
pln = Plane(pl_origin)
E_3 = Number(E)
min_3 = Minimum(A=E_3, B=addition_6)
max_3 = Maximum(A="0", B=subtraction_8)
pt_2 = PointOriented(BasePlane=pln, UComponent=division_4, VComponent=max_3, WComponent=0)
pt_3 = PointOriented(BasePlane=pln, UComponent=division_4, VComponent="0", WComponent=0)
pt_4 = PointOriented(BasePlane=pln, UComponent=division_4, VComponent=min_3, WComponent=0)
pt_5 = PointOriented(BasePlane=pln, UComponent=division_4, VComponent=E_3, WComponent=0)
ln = Line(StartPoint=pt_3, EndPoint=pt_2)
ln_2 = Line(StartPoint=pt_4, EndPoint=pt_5)
ln_3 = Line(StartPoint=pt_2, EndPoint=pt_4)
pln_2 = Plane(pl_origin)
data_2 = Data(c_script.Inners)
D_3 = Number(D)
match = MatchTree(Tree=ln, Guide=data_2)
match_2 = MatchTree(Tree=ln_3, Guide=data_2)
match_3 = MatchTree(Tree=ln_2, Guide=data_2)
match_4 = MatchTree(Tree=pln_2, Guide=data_2)
match_5 = MatchTree(Tree=D_3, Guide=data_2)

geo_5 = Geometry(ln_3)
geo_6 = Geometry([ln, ln_2])
previewlw = CustomPreviewLineweights(Geometry=geo_5, Shader=ColourSwatch(SwatchColor=RGB(0, 0, 0)), Thickness=Slider(1, range=0..10), Absolute=False)
previewlw_2 = CustomPreviewLineweights(Geometry=geo_6, Shader=ColourSwatch(SwatchColor=RGB(0, 0, 0)), Thickness=Slider(3, range=0..10), Absolute=False)

lng = ListLength(List=match_5)
repeat = RepeatData(Data=match_4, Length=lng)
trim_3 = TrimTree(Tree=match, Depth=1)
trim_4 = TrimTree(Tree=match_2, Depth=1)
trim_5 = TrimTree(Tree=match_3, Depth=1)
trim_6 = TrimTree(Tree=match_5, Depth=1)
trim_7 = TrimTree(Tree=repeat, Depth=2)
merge = Merge(Data1=trim_6, Data2=trim_6)
merge_2 = Merge(Data1=trim_7, Data2=trim_7)
merge_3 = Merge(Data1=trim_3, Data2=trim_5)
entwine_3 = Entwine(Branch0X=trim_4, Branch1X=merge_3, FlattenInputs=False)
entwine_4 = Entwine(Branch0X=trim_7, Branch1X=merge_2, FlattenInputs=False)
entwine_5 = Entwine(Branch0X=trim_6, Branch1X=merge, FlattenInputs=False)
null = NullItem(Item=entwine_3)  # -> NullFlags, InvalidFlags, Description
cull = CullPattern(List=entwine_3, CullPattern=invert(null.InvalidFlags))
cull_2 = CullPattern(List=entwine_4, CullPattern=invert(null.InvalidFlags))
cull_3 = CullPattern(List=entwine_5, CullPattern=invert(null.InvalidFlags))

# ---- group: domain x
entwine_6 = Entwine(Branch00=num_2, Branch01=num, FlattenInputs=True)

# ----
entwine_7 = Entwine(Branch00=num_2, Branch01=num, Branch02=num_2, Branch03=num, FlattenInputs=True)
deplane = DeconstructPlane(Plane=cull_2)  # -> Origin, XAxis, YAxis, ZAxis
cluster_2 = Cluster_2(num=entwine_7)
cluster_3 = Cluster_2(num=cull_3)
line = Geometry(cull)
z_orient = Vector(deplane.XAxis)
domain_x = Data(cluster_2)
domain_y = Data(cluster_3)
long = LongestList(ListA=line, ListB=z_orient, ListC=domain_x, ListD=domain_y, PaddingMode=2)  # -> ListA, ListB, ListC, ListD
cluster_4 = Cluster_2(num=entwine_6)
panel = Panel("""Conc_Deformable
Stone_Deformable
Conc_Rigid
Stone_Rigid""")
panel_2 = Panel("""Stone_Rigid
Conc_Deformable
Stone_Deformable
infinite""")
panel_3 = Panel("""Stone_Rigid
Conc
Stone_Deformable
infinite""")
panel_4 = Panel("""Conc
Stone_Deformable
Conc
Stone_Rigid""")
split = SplitTree(Data=long.ListA, Masks=flatten("{0;1}"))  # -> Positive, Negative
data_3 = Data(item)
data_4 = Data(split.Positive)
ins_5 = InsertItems(List=sort.Keys, Item=0, Indices=0, Wrap=True)
consec = ConsecutiveDomains(Numbers=ins_5, Additive=False)

midpt = CurveMiddle(Curve=data_4)
pdecon_2 = Deconstruct(Point=midpt)  # -> XComponent, YComponent, ZComponent
data_5 = Data(consec)
inc = Includes(Value=pdecon_2.ZComponent, Domain=graft(data_5))  # -> Includes, Deviation
cull_4 = CullPattern(List=midpt, CullPattern=inc.Includes)  # -> simplify(List)
cull_5 = CullPattern(List=data_4, CullPattern=inc.Includes)  # -> simplify(List)
split_2 = SplitTree(Data=cull_5, Masks=flatten("{0}"))  # -> Positive, Negative
split_3 = SplitTree(Data=cull_4, Masks=flatten("{0}"))  # -> Positive, Negative
project = Project(Geometry=split_3.Positive, Plane=PlaneXY(0, 0, 0))  # -> Geometry, Transform
project_2 = Project(Geometry=split_3.Negative, Plane=PlaneXY(0, 0, 0))  # -> Geometry, Transform
cps = ClosestPoints(Point=project.Geometry, Cloud=project_2.Geometry, Count=1)  # -> ClosestPoint, CPIndex, Distance
pshift = ShiftPaths(Data=cps.CPIndex, Offset=-1)
item_4 = ListItem(List=split_2.Negative, Index=pshift, Wrap=True)
item_5 = ListItem(List=split_3.Negative, Index=pshift, Wrap=True)
merge_4 = Merge(Data1=split_2.Positive, Data2=item_4)
merge_5 = Merge(Data1=split_3.Positive, Data2=item_5)

entwine_8 = Entwine(Branch0X=panel_4, Branch1X=panel_3, FlattenInputs=False)  # -> flatten(Result)
line_2 = Geometry(long.ListA)
z_orient_2 = Vector(long.ListB)
domain_x_2 = Data(long.ListC)
domain_y_2 = Data(long.ListD)
cset_2 = CreateSet(List=entwine_8)  # -> flatten(Set), graft(Map)
data_6 = Data(ln_3)
tstat = TreeStatistics(Tree=data_6)  # -> Paths, Length, Count
join = BrepJoin(Breps=data_3)  # -> Breps, Closed
tmatch = MatchText(Text=tstat.Paths, Pattern="{1*", Case=True)
cull_6 = CullPattern(List=tstat.Paths, CullPattern=tmatch)
item_6 = ListItem(List=sort.Keys, Index=0, Wrap=True)  # -> Item, Item1
split_4 = SplitTree(Data=data_6, Masks=flatten(cull_6))  # -> Positive, Negative
lng_2 = ListLength(List=sort.Keys)  # -> expr("x-1", Length)
flr_height = Data(item_6.Item1)
data_7 = Data(split_4.Positive)
material = Data(cset_2.Set)
subtraction_9 = Subtraction(A=flr_height, B=item_6.Item)
gf_height = Data(item_6.Item)
no_of_floors = Data(lng_2)
multiplication_2 = Multiplication(A=no_of_floors, B=subtraction_9)
addition_7 = Addition(A=gf_height, B=multiplication_2)
grouped = Geometry(merge_4)

# ----
# group breps by plane
debrep_2 = DeconstructBrep(Brep=entwine_2)  # -> Faces, Edges, Vertices
X = UnitX(Factor=1)

trim_8 = TrimTree(Tree=debrep_2.Faces, Depth=1)

debrep_3 = DeconstructBrep(Brep=trim_8)  # -> Faces, Edges, Vertices

trim_9 = TrimTree(Tree=debrep_3.Faces, Depth=1)
cluster_5 = Cluster(S=trim_9)

# ----
# HORIZONTALS
deplane_2 = DeconstructPlane(Plane=cluster_5)  # -> Origin, XAxis, YAxis, ZAxis
dprod = DotProduct(VectorA=deplane_2.ZAxis, VectorB=X, Unitize=True)
abs = Absolute(Value=dprod)
expression_2 = Expression(x=abs, Expression="Round(x,3)")
cset_3 = CreateSet(List=expression_2)  # -> Set, Map
mindex_2 = MemberIndex(Set=expression_2, Member=cset_3.Set)  # -> Index, Count
trim_10 = TrimTree(Tree=mindex_2.Index, Depth=1)
item_7 = ListItem(List=trim_9, Index=trim_10, Wrap=True)
unflatten = UnflattenTree(Tree=item_7, Guide=mindex_2.Index)
join_2 = BrepJoin(Breps=unflatten)  # -> Breps, Closed

# ----
# group breps by height
debrep_4 = DeconstructBrep(Brep=join_2.Breps)  # -> Faces, Edges, Vertices
bbox_3 = BoundingBox(Content=debrep_4.Faces, Plane=PlaneXY(0, 0, 0))  # -> Box, Box_2
debox_3 = DeconstructBox(Box=bbox_3.Box)  # -> Plane, X, Y, Z
dedomain_8 = DeconstructDomain(Domain=debox_3.Z)  # -> Start, End
sort_3 = SortList(Keys=dedomain_8.Start, ValuesA=debrep_4.Faces)  # -> Keys, ValuesA
expression_3 = Expression(x=sort_3.Keys, Expression="Round(x,3)")
cset_4 = CreateSet(List=expression_3)  # -> Set, Map
mindex_3 = MemberIndex(Set=expression_3, Member=cset_4.Set)  # -> Index, Count
trim_11 = TrimTree(Tree=mindex_3.Index, Depth=1)
item_8 = ListItem(List=sort_3.ValuesA, Index=trim_11, Wrap=True)
unflatten_2 = UnflattenTree(Tree=item_8, Guide=mindex_3.Index)
group = Group(Objects=unflatten_2)

trim_12 = TrimTree(Tree=group, Depth=1)
ins_6 = InsertItems(List=trim_12, Item=data, Indices="0", Wrap=True)
ins_7 = InsertItems(List=trim_12, Item=data, Indices="-1", Wrap=True)
trim_13 = TrimTree(Tree=ins_6, Depth=1)
trim_14 = TrimTree(Tree=ins_7, Depth=1)
ungroup = Ungroup(Group=trim_13)
ungroup_2 = Ungroup(Group=trim_14)
clean = CleanTree(RemoveNulls=True, RemoveInvalid=True, RemoveEmpty=False, Tree=ungroup)
clean_2 = CleanTree(RemoveNulls=True, RemoveInvalid=True, RemoveEmpty=False, Tree=ungroup_2)
brep_2 = Brep(clean)
brep_3 = Brep(clean_2)
item_9 = ListItem(List=brep_2, Index=0, Wrap=True)
c_script_2 = CSharpScript(brep=brep_2)  # -> out, Outer, Inners; inputs brep: Brep; same code as c_script
debrep_5 = DeconstructBrep(Brep=item_9)  # -> Faces, Edges, Vertices
c_script_3 = CSharpScript(brep=brep_3)  # -> out, Outer, Inners; inputs brep: Brep; same code as c_script
item_10 = ListItem(List=debrep_5.Faces, Index=0, Wrap=True)
cluster_6 = Cluster(S=item_10)
trim_15 = TrimTree(Tree=c_script_2.Outer, Depth=1)
trim_16 = TrimTree(Tree=c_script_2.Inners, Depth=1)
trim_17 = TrimTree(Tree=c_script_3.Outer, Depth=1)
trim_18 = TrimTree(Tree=c_script_3.Inners, Depth=1)
align_2 = AlignPlane(Plane=cluster_6, Direction=Z_2)  # -> Plane, Angle
rotate_2 = Rotate(Geometry=align_2.Plane, Angle=-1.570796327, Plane=align_2.Plane)  # -> Geometry, Transform
trim_19 = TrimTree(Tree=rotate_2.Geometry, Depth=1)
bbox_4 = BoundingBox(Content=trim_15, Plane=trim_19, UnionBox=False)  # -> Box, Box_2
# {Material; North-South; Floor Level, Beam Level}
pln_3 = Plane(trim_19)
pshift_2 = ShiftPaths(Data=bbox_4.Box, Offset=-1)
bbox_5 = BoundingBox(Content=trim_17, Plane=pln_3, UnionBox=False)  # -> Box, Box_2
debox_4 = DeconstructBox(Box=pshift_2)  # -> Plane, X, Y, Z
pshift_3 = ShiftPaths(Data=bbox_5.Box, Offset=-1)
dedomain_9 = DeconstructDomain(Domain=debox_4.Y)  # -> Start, End
dedomain_10 = DeconstructDomain(Domain=debox_4.X)  # -> Start, End
debox_5 = DeconstructBox(Box=pshift_3)  # -> Plane, X, Y, Z

sort_4 = SortList(Keys=dedomain_9.Start)  # -> Keys, ValuesA
sort_5 = SortList(Keys=dedomain_10.Start)  # -> Keys, ValuesA
item_11 = ListItem(List=sort_5.Keys, Index=0, Wrap=True)
item_12 = ListItem(List=sort_4.Keys, Index=0, Wrap=True)

dedomain_11 = DeconstructDomain(Domain=debox_5.Y)  # -> Start, End
dedomain_12 = DeconstructDomain(Domain=debox_5.X)  # -> Start, End

sort_6 = SortList(Keys=dedomain_11.Start)  # -> Keys, ValuesA
sort_7 = SortList(Keys=dedomain_12.Start)  # -> Keys, ValuesA
item_13 = ListItem(List=sort_7.Keys, Index=0, Wrap=True)
item_14 = ListItem(List=sort_6.Keys, Index=0, Wrap=True)

pt_6 = PointOriented(BasePlane=trim_19, UComponent=dedomain_10.Start, VComponent=dedomain_9.Start, WComponent=0)
pt_7 = PointOriented(BasePlane=trim_19, UComponent=item_11, VComponent=item_12, WComponent=0)
subtraction_10 = Subtraction(A=dedomain_10.End, B=dedomain_10.Start)
subtraction_11 = Subtraction(A=dedomain_9.End, B=dedomain_9.Start)
pl_origin_2 = PlaneOrigin(Base=trim_19, Origin=pt_7)

# ---- group: sort along x
geo_7 = Geometry(trim_16)
end_2 = EndPoints(Curve=geo_7)  # -> Start, End
plcoord_2 = PlaneCoordinates(Point=end_2.Start, System=pl_origin_2)  # -> XCoordinate, YCoordinate, ZCoordinate
sort_8 = SortList(Keys=plcoord_2.XCoordinate, ValuesA=geo_7)  # -> Keys, ValuesA

# ----
pt_8 = PointOriented(BasePlane=pln_3, UComponent=item_13, VComponent=item_14, WComponent=0)
plcoord_3 = PlaneCoordinates(Point=pt_6, System=pl_origin_2)  # -> XCoordinate, YCoordinate, ZCoordinate
pl_origin_3 = PlaneOrigin(Base=pln_3, Origin=pt_8)

# ---- group: sort along x
geo_8 = Geometry(trim_18)
end_3 = EndPoints(Curve=geo_8)  # -> Start, End
plcoord_4 = PlaneCoordinates(Point=end_3.Start, System=pl_origin_3)  # -> XCoordinate, YCoordinate, ZCoordinate
sort_9 = SortList(Keys=plcoord_4.XCoordinate, ValuesA=geo_8)  # -> Keys, ValuesA

# ----
sort_10 = SortList(Keys=dedomain_9.End)  # -> Keys, ValuesA
item_15 = ListItem(List=sort_10.Keys, Index=0, Wrap=True)

sort_11 = SortList(Keys=plcoord_3.XCoordinate, ValuesA=subtraction_10, ValuesB=subtraction_11)  # -> Keys, ValuesA, ValuesB
L_2 = Number(sort_11.ValuesA)
E_4 = Number(sort_11.ValuesB)
pt_9 = PointOriented(BasePlane=trim_19, UComponent=item_11, VComponent=item_15, WComponent=0)
bbox_6 = BoundingBox(Content=sort_8.ValuesA, Plane=pl_origin_2)  # -> Box, Box_2
pl_origin_4 = PlaneOrigin(Base=trim_19, Origin=pt_9)
bbox_7 = BoundingBox(Content=sort_9.ValuesA, Plane=pl_origin_3)  # -> Box, Box_2
debox_6 = DeconstructBox(Box=bbox_6.Box)  # -> Plane, X, Y, Z

py3 = Python3Script(val=L_2)  # -> out, a; inputs val: list
# ---------- py3: Python ----------
if val:
    val.insert(0, 0)

a = val
# ---------- end py3 ----------
ma = MassAddition(Input=py3.a)  # -> Result, PartialResults
consec_2 = ConsecutiveDomains(Numbers=ma.PartialResults, Additive=False)

debox_7 = DeconstructBox(Box=bbox_7.Box)  # -> Plane, X, Y, Z
dedomain_13 = DeconstructDomain(Domain=debox_6.Y)  # -> Start, End
subtraction_12 = Subtraction(A=E_4, B=dedomain_13.End)
dedomain_14 = DeconstructDomain(Domain=debox_7.Y)  # -> Start, End
opening_domain = Domain(simplify(debox_7.X))
opening_domain_2 = Domain(simplify(debox_6.X))
beam_domain = Domain(simplify(consec_2))
dist_base = Number(simplify(dedomain_14.Start))
dist_sup = Number(simplify(subtraction_12))
merge_6 = Merge(Data1=opening_domain, Data2=opening_domain_2)
dist_base_2 = Number(simplify(dist_base))
domain_2 = Domain(simplify(opening_domain))
domain_3 = Domain(simplify(opening_domain_2))
dist_sup_2 = Number(simplify(dist_sup))
data_8 = Data(ungroup_2)

# ---- group: all domains
dedomain_15 = DeconstructDomain(Domain=beam_domain)  # -> Start, End
dedomain_16 = DeconstructDomain(Domain=merge_6)  # -> Start, End
num_3 = Number([dedomain_16.Start, dedomain_16.End, dedomain_15.Start, dedomain_15.End])

# ----
cset_5 = CreateSet(List=num_3)  # -> Set, Map

# ---- group: all domains (continued)
sort_12 = SortList(Keys=cset_5.Set)  # -> Keys, ValuesA
consec_3 = ConsecutiveDomains(Numbers=sort_12.Keys, Additive=False)

# ---- group: remove super short ones
dedomain_17 = DeconstructDomain(Domain=consec_3)  # -> Start, End
subtraction_13 = Subtraction(A=dedomain_17.Start, B=dedomain_17.End)
abs_2 = Absolute(Value=subtraction_13)
larger = LargerThan(FirstNumber=abs_2, SecondNumber="0.001")  # -> LargerThan, OrEqualTo

# ----
cull_7 = CullPattern(List=consec_3, CullPattern=larger.LargerThan)
data_9 = Data(cull_7)
intersect = CSharpScript(dom=data_9, Set=domain_2)  # -> out, A; inputs Set: list
# ---------- intersect: C# ----------
    var outIndices = new List<int>();
    var mid = (dom.Min + dom.Max) * 0.5;
    for (int i = 0; i < Set.Count ; i++){
      if (Set[i].IncludesParameter(mid))outIndices.Add(i);
    }
    A = outIndices;
# ---------- end intersect ----------
intersect_2 = CSharpScript(dom=data_9, Set=domain_3)  # -> out, A; inputs Set: list; same code as intersect
long_2 = LongestList(ListA=pl_origin_4, ListB=data_9, PaddingMode=2)  # -> ListA, ListB
trim_20 = TrimTree(Tree=intersect.A, Depth=1)
trim_21 = TrimTree(Tree=intersect_2.A, Depth=1)
item_16 = ListItem(List=dist_base_2, Index=trim_20, Wrap=True)
item_17 = ListItem(List=dist_sup_2, Index=trim_21, Wrap=True)
domain_4 = Domain(graft(long_2.ListB))
pln_4 = Plane(graft(long_2.ListA))
unflatten_3 = UnflattenTree(Tree=item_16, Guide=intersect.A)
unflatten_4 = UnflattenTree(Tree=item_17, Guide=intersect_2.A)
dedomain_18 = DeconstructDomain(Domain=domain_4)  # -> Start, End
item_18 = ListItem(List=unflatten_3, Index=0, Wrap=False)
item_19 = ListItem(List=unflatten_4, Index=0, Wrap=False)
deplane_3 = DeconstructPlane(Plane=pln_4)  # -> Origin, XAxis, YAxis, ZAxis
pt_10 = PointOriented(BasePlane=pln_4, UComponent=dedomain_18.Start, VComponent=0, WComponent=0)
pt_11 = PointOriented(BasePlane=pln_4, UComponent=dedomain_18.End, VComponent=0, WComponent=0)
nullrep = ReplaceNulls(Items=item_19, Replacements="0")  # -> Items, Count
nullrep_2 = ReplaceNulls(Items=item_18, Replacements="0")  # -> Items, Count
neg = Negative(Value=nullrep_2.Items)
neg_2 = Negative(Value=deplane_3.YAxis)
ln_4 = Line(StartPoint=pt_10, EndPoint=pt_11)
dom_2 = ConstructDomain(DomainStart=neg, DomainEnd=nullrep.Items)
lng_3 = ListLength(List=ln_4)
cull_8 = CullPattern(List=dom_2, CullPattern=lng_3)
trim_22 = TrimTree(Tree=neg_2, Depth=1)
trim_23 = TrimTree(Tree=ln_4, Depth=1)
trim_24 = TrimTree(Tree=cull_8, Depth=1)
clean_3 = CleanTree(RemoveNulls=True, RemoveInvalid=True, RemoveEmpty=False, Tree=trim_22)
match_6 = MatchTree(Tree=trim_24, Guide=data_8)
match_7 = MatchTree(Tree=clean_3, Guide=data_8)
match_8 = MatchTree(Tree=trim_23, Guide=data_8)

# ---- group: z Orient
trim_25 = TrimTree(Tree=match_7, Depth=3)

# ---- group: line
trim_26 = TrimTree(Tree=match_8, Depth=3)

# ---- group: domain y
trim_27 = TrimTree(Tree=match_6, Depth=3)

# ----
null_2 = NullItem(Item=trim_26)  # -> NullFlags, InvalidFlags, Description
cull_9 = CullPattern(List=trim_25, CullPattern=invert(null_2.InvalidFlags))
cull_10 = CullPattern(List=trim_26, CullPattern=invert(null_2.InvalidFlags))
cull_11 = CullPattern(List=trim_27, CullPattern=invert(null_2.InvalidFlags))

dedomain_19 = DeconstructDomain(Domain=match_6)  # -> Start, End
and = GateAnd(B=invert(dedomain_19.End), C=dedomain_19.Start)
lng_4 = ListLength(List=dedomain_19.Start)
cull_12 = CullPattern(List=and, CullPattern=lng_4)
trim_28 = TrimTree(Tree=cull_12, Depth=3)
cull_13 = CullPattern(List=trim_28, CullPattern=invert(null_2.InvalidFlags))

long_3 = LongestList(ListA=cull_10, ListB=cull_9, ListC=cluster_4, ListD=cull_11, PaddingMode=2)  # -> ListA, ListB, ListC, ListD
bool = Boolean(cull_13)
dispatch_2 = Dispatch(List=long_3.ListA, DispatchPattern=bool)  # -> ListA, ListB
dispatch_3 = Dispatch(List=long_3.ListB, DispatchPattern=bool)  # -> ListA, ListB
dispatch_4 = Dispatch(List=long_3.ListC, DispatchPattern=bool)  # -> ListA, ListB
dispatch_5 = Dispatch(List=long_3.ListD, DispatchPattern=bool)  # -> ListA, ListB
data_10 = Data(match_6)
data_11 = Data(match_8)
dedomain_20 = DeconstructDomain(Domain=data_10)  # -> Start, End
entwine_9 = Entwine(Branch0X=flatten(dispatch_2.ListA), Branch1X=dispatch_2.ListB, FlattenInputs=False)
entwine_10 = Entwine(Branch0X=flatten(dispatch_4.ListA), Branch1X=dispatch_4.ListB, FlattenInputs=False)
entwine_11 = Entwine(Branch0X=flatten(dispatch_5.ListA), Branch1X=dispatch_5.ListB, FlattenInputs=False)
entwine_12 = Entwine(Branch0X=flatten(dispatch_3.ListA), Branch1X=dispatch_3.ListB, FlattenInputs=False)
subtraction_14 = Subtraction(A=dedomain_20.Start, B=dedomain_20.End)
abs_3 = Absolute(Value=subtraction_14)
dedomain_21 = DeconstructDomain(Domain=entwine_11)  # -> Start, End
bool_2 = Boolean(abs_3)
subtraction_15 = Subtraction(A=dedomain_21.Start, B=dedomain_21.End)
dispatch_6 = Dispatch(List=data_11, DispatchPattern=bool_2)  # -> ListA, ListB
abs_4 = Absolute(Value=subtraction_15)
bool_3 = Boolean(abs_4)

# ---- group: Deformable
curve = Curve(dispatch_6.ListA)

# ---- group: Rigid
crv = Curve(dispatch_6.ListB)

# ----
dispatch_7 = Dispatch(List=entwine_9, DispatchPattern=bool_3)  # -> ListA, ListB
dispatch_8 = Dispatch(List=entwine_12, DispatchPattern=bool_3)  # -> ListA, ListB
dispatch_9 = Dispatch(List=entwine_10, DispatchPattern=bool_3)  # -> ListA, ListB
dispatch_10 = Dispatch(List=entwine_11, DispatchPattern=bool_3)  # -> ListA, ListB
entwine_13 = Entwine(Branch0X=dispatch_7.ListA, Branch1X=flatten(dispatch_7.ListB), FlattenInputs=False)
entwine_14 = Entwine(Branch0X=dispatch_8.ListA, Branch1X=flatten(dispatch_8.ListB), FlattenInputs=False)
entwine_15 = Entwine(Branch0X=dispatch_9.ListA, Branch1X=flatten(dispatch_9.ListB), FlattenInputs=False)
entwine_16 = Entwine(Branch0X=dispatch_10.ListA, Branch1X=flatten(dispatch_10.ListB), FlattenInputs=False)
geo_9 = Geometry(data_11)
geo_10 = Geometry(crv)
domain_y_3 = Data(entwine_16)
line_3 = Geometry(entwine_13)
z_orient_3 = Vector(entwine_14)
domain_x_3 = Data(entwine_15)
entwine_17 = Entwine(Branch0X=domain_x_2, Branch1X=domain_x_3, FlattenInputs=False)
entwine_18 = Entwine(Branch0X=domain_y_2, Branch1X=domain_y_3, FlattenInputs=False)
# EXPORT
entwine_19 = Entwine(Branch0X=line_2, Branch1X=line_3, FlattenInputs=False)
entwine_20 = Entwine(Branch0X=z_orient_2, Branch1X=z_orient_3, FlattenInputs=False)
pshift_4 = ShiftPaths(Data=geo_9, Offset=3)
c_script_4 = CSharpScript(tree=entwine_19, path=cset_2.Map)  # -> out, A; inputs tree: tree, path: tree of Int32
# ---------- c_script_4: C# ----------
    
    var newTree = new DataTree<object>();
    for (int i = 0 ; i < tree.Paths.Count ; i++){
      newTree.AddRange(tree.Branch(i), new GH_Path(path.Branch(i)[0]));
    }
    
    A = newTree;
# ---------- end c_script_4 ----------
c_script_5 = CSharpScript(tree=entwine_20, path=cset_2.Map)  # -> out, A; inputs tree: tree, path: tree of Int32; same code as c_script_4
c_script_6 = CSharpScript(tree=entwine_17, path=cset_2.Map)  # -> out, A; inputs tree: tree, path: tree of Int32; same code as c_script_4
c_script_7 = CSharpScript(tree=entwine_18, path=cset_2.Map)  # -> out, A; inputs tree: tree, path: tree of Int32; same code as c_script_4
clean_4 = CleanTree(RemoveNulls=True, RemoveInvalid=True, RemoveEmpty=True, Tree=pshift_4)
match_9 = MatchTree(Tree=join.Breps, Guide=clean_4)
area_2 = Area(Geometry=match_9)  # -> Area, Centroid
line_4 = Geometry(c_script_4.A)
z_orient_4 = Vector(c_script_5.A)
domain_x_4 = Data(c_script_6.A)
domain_y_4 = Data(c_script_7.A)
branch = TreeBranch(Tree=area_2.Area, Path="{1}", MaintainPaths=True)
gf_area = Data(branch)

line_5 = Geometry(line_4)
z_orient_5 = Vector(z_orient_4)
domain_x_5 = Data(domain_x_4)
domain_y_5 = Data(domain_y_4)
material_2 = Data(material)
T = Tree(match_9)
gf_area_2 = Data(gf_area)
no_of_floors_2 = Data(no_of_floors)
bld_height = Result(addition_7)
gf_height_2 = Data(gf_height)
flr_height_2 = Result(subtraction_9)
data_12 = Data(data_7)
geo_11 = Geometry(geo_9)
geo_12 = Geometry(geo_10)
grouped_2 = Geometry(grouped)

# ==== cluster Cluster
S = ClusterInput()
evalsrf = EvaluateSurface(Surface=reparameterize(S), Point="{0.5, 0.5, 0}")  # -> Point, Normal, UDirection, VDirection, Frame
F = ClusterOutput(evalsrf.Frame)

# ==== cluster Cluster_2
num = ClusterInput()
num_2 = Number(num)
multiplication = Multiplication(A=num_2, B=0.5)
multiplication_2 = Multiplication(A=num_2, B=-0.5)
dom = ConstructDomain(DomainStart=multiplication_2, DomainEnd=multiplication)
I = ClusterOutput(dom)
